# Grasshopper definition 001_Intervals.gh (Grasshopper 1.0.7)
# plug-ins: RhinoCodePluginGH

# ----
# 2nd gpt-4 Text Prompt
# Great, now make the script much more complex model
# with complex trigonometric polynomials and the
# NUMPY python library. Be sure to incorporate the previous code logic.
# ensure that this script produces 3d geometry as
# well for Data visualization purposes.
# Oscillation Algorithm
# The oscillation algorithm can be use to animate
# any geometry that is driven by a number sliders.
# Simply swap out the number sliders at the
# multiplication node in the oscillation script.
panel = Panel("1")  # disabled
trigger = Trigger(Interval=20, TimerInterval=20, Target=data_recorder)  # disabled
data_recorder = DataRecorder(panel, DataLimit=-10, RecordData=False)  # disabled
number_slider = Slider(23, range=0..1000)  # disabled
# gpt-4 Initial Response
# Certainly! In this more complex example, I will
# use the NumPy library to create a complex 3D
# model based on trigonometric polynomials for
# both the function and its derivative. For
# visualization, I will generate both 3D curves and
# a 3D mesh that represents the function values.
list_length = ListLength(List=data_recorder)  # disabled
division = Division(A=list_length, B=number_slider)  # disabled
cosine = Cosine(Value=division)  # disabled
sine = Sine(Value=division)  # disabled
panel_2 = Panel([sine, cosine])  # disabled
multiplication = Multiplication(A=sine)  # disabled
multiplication_2 = Multiplication(A=cosine)  # disabled

# ----
# ADVANCED
# PARAMETRIC
number_slider_2 = Slider(1, range=0..1)
# gpt-4 Text Prompt
# Create a geometric 3D model with
# 
# Single-Variable Calculus
# Functions, Limits, and Continuity
# The Real Line and the Cartesian Plane
# 
# to create a 3D model about
# 
# Intervals
# 
# 
# in python 3 code for the python 3 script
# node in grasshopper for Rhino8WIP using the
# 
# Rhino Common API to create some geometry as well.
# 
# Output the parts of the model in different
# variable outputs in the python 3 node in
# grasshopper.
# 001 Functions, Limits,
# and Continuity
# 001 The Real Line and the Cartesian Plane
# 001 Intervals
number_slider_3 = Slider(10, range=0..100)
# Learn Single-Variable Calculus
# with Python in Grasshopper
# at Wickerson Studios
intervals = Script(
    rows=number_slider_3,
    cols=Slider(10, range=0..100),
    x_step=Slider(1, range=0..1),
    y_step=Slider(1, range=0..1),
    a_coef=Slider(1, range=0..1),
    b_coef=number_slider_2)  # -> out, a, b, c, d, e; inputs rows: Int32, cols: Int32, x_step: Double, y_step: Double, a_coef: Double, b_coef: Double
# ---------- intervals: Python ----------
import Rhino.Geometry as rg
import numpy as np

# Complex trigonometric polynomial function definition
def function(x, y, a_coef, b_coef):
    return a_coef * (np.sin(x) * np.cos(y) + np.sin(2 * x) * np.cos(2 * y)) + \
           b_coef * np.sin(3 * x) * np.cos(3 * y)

def create_model(rows, cols, x_step, y_step, a_coef, b_coef):
    # Create an empty list to hold points
    points = []
    min_z = float('inf')
    max_z = float('-inf')

    # Loop through rows and columns to populate the list of points
    for i in range(rows):
        for j in range(cols):
            x = i * x_step
            y = j * y_step
            z = function(x, y, a_coef, b_coef)
            point = rg.Point3d(x, y, z)
            points.append(point)
            
            # Update min and max z-values
            min_z = min(min_z, z)
            max_z = max(max_z, z)

    # Define the degrees in u and v directions
    degree_u = 3 if rows > 3 else rows - 1
    degree_v = 3 if cols > 3 else cols - 1

    # Create the NURBS surface
    surface = rg.NurbsSurface.CreateFromPoints(points, rows, cols, degree_u, degree_v)

    # Create boundary curves
    boundary_curves = surface.ToBrep().DuplicateEdgeCurves()

    return surface, points, boundary_curves, min_z, max_z

# Parameters for the model
"""
rows = 20
cols = 20
x_step = 0.25
y_step = 0.25
a_coef = 1.0
b_coef = 1.0
"""

# Create the model and assign it to output
surface, control_points, boundary_curves, min_z, max_z = create_model(rows, cols, x_step, y_step, a_coef, b_coef)

# Output the surface
a = surface
# Output the control points
b = control_points
# Output the boundary curves
c = boundary_curves
# Output minimum z-value
d = min_z
# Output maximum z-value
e = max_z
# ---------- end intervals ----------
geometry = Geometry(intervals.a)
geometry_2 = Geometry(intervals.b)
geometry_3 = Geometry(intervals.c)
panel_3 = Panel(intervals.out)
entwine = Entwine(
    Branch00=geometry,
    Branch01=geometry_2,
    Branch02=geometry_3,
    Branch03=intervals.d,
    Branch04=intervals.e,
    FlattenInputs=True)
panel_4 = Panel(entwine)
