# Grasshopper definition 002_Absolute_Value.gh (Grasshopper 1.0.7)
# plug-ins: RhinoCodePluginGH

# ----
# Oscillation Algorithm
# The oscillation algorithm can be use to animate
# any geometry that is driven by a number sliders.
# Simply swap out the number sliders at the
# multiplication node in the oscillation script.
panel = Panel("1")  # disabled
trigger = Trigger(Interval=20, TimerInterval=20, Target=data_recorder)  # disabled
data_recorder = DataRecorder(panel, DataLimit=-10, RecordData=False)  # disabled
number_slider = Slider(23, range=0..1000)  # disabled
# Creating a 3D model involving the absolute
# value function requires you to have a clear vision
#  of what you want to achieve. The absolute
# value function is a single-variable function
# defined for all real numbers. It can be extended
# into the 3D Cartesian plane, but this requires
# some clarity on how you wish to extend it.
# 
# In the simplest case, you could create a surface
#  where the z-value of each point (x, y) on the
# plane is the absolute value of x or y or some
# combination of them.
list_length = ListLength(List=data_recorder)  # disabled
division = Division(A=list_length, B=number_slider)  # disabled
cosine = Cosine(Value=division)  # disabled
sine = Sine(Value=division)  # disabled
panel_2 = Panel([sine, cosine])  # disabled
multiplication = Multiplication(A=sine)  # disabled
multiplication_2 = Multiplication(A=cosine)  # disabled

# ----
# gpt-4 Text Prompt
# Learn Single-Variable Calculus
# with Python in Grasshopper
# at Wickerson Studios
# Create a geometric 3D model with
# 
# Single-Variable Calculus
# Functions, Limits, and Continuity
# The Real Line and the Cartesian Plane
# 
# to create a 3D model about
# 
# Absolute Value
# 
# 
# in python 3 code for the python 3 script
# node in grasshopper for Rhino8WIP using the
# 
# Rhino Common API to create some geometry as well.
# 
# Output the parts of the model in different
# variable outputs in the python 3 node in
# grasshopper.
# 001 Functions, Limits,
# and Continuity
# 001 The Real Line and the Cartesian Plane
# 2nd gpt-4 Text Prompt
# 002 Absolute Value
# Great, now make the script much more complex model
# with complex trigonometric polynomials and the
# NUMPY python library. Be sure to incorporate the previous code logic.
# ensure that this script produces 3d geometry as
# well for Data visualization purposes.
# ADVANCED
# PARAMETRIC
# gpt-4 Initial Response
number_slider_2 = Slider(-10, range=-10..10)
absolute_value = Script(
    x_range=[number_slider_2, Slider(10, range=0..10)],
    y_range=[Slider(-10, range=-10..10), Slider(10, range=0..10)],
    num_points_u=Slider(13, range=0..100),
    num_points_v=Slider(13, range=0..100))  # -> out, a, b, c, d, e; inputs x_range: list of Double, y_range: list of Double, num_points_u: Int32, num_points_v: Int32, a_coef: Double, b_coef: Double
# ---------- absolute_value: Python ----------
import Rhino.Geometry as rg
import numpy as np
import json

def CreateNurbsSurface(x_range, y_range, num_points_u, num_points_v):
    points = []
    x_step = (x_range[1] - x_range[0]) / float(num_points_u - 1)
    y_step = (y_range[1] - y_range[0]) / float(num_points_v - 1)
    
    for i in range(num_points_u):
        x = x_range[0] + i * x_step
        for j in range(num_points_v):
            y = y_range[0] + j * y_step
            z = abs(x) + abs(y)
            point = rg.Point3d(x, y, z)
            points.append(point)
    
    nurbs_surface = rg.NurbsSurface.CreateFromPoints(points, num_points_u, num_points_v, 3, 3)
    return nurbs_surface, points

def CreateComplexSurface(x_range, y_range, num_points_u, num_points_v):
    points = []
    x_values = np.linspace(x_range[0], x_range[1], num_points_u)
    y_values = np.linspace(y_range[0], y_range[1], num_points_v)
    
    for x in x_values:
        for y in y_values:
            z = np.sin(x) * np.cos(y) + np.sin(2 * x) * np.cos(2 * y) + np.abs(x) + np.abs(y)
            point = rg.Point3d(x, y, z)
            points.append(point)
    
    nurbs_surface = rg.NurbsSurface.CreateFromPoints(points, num_points_u, num_points_v, 3, 3)
    return nurbs_surface

# INPUTS
"""
x_range = x_range_input     # Tuple[float, float]
y_range = y_range_input     # Tuple[float, float]
num_points_u = num_u_input  # int
num_points_v = num_v_input  # int
"""

# NURBS Surfaces
basic_surface, control_points = CreateNurbsSurface(x_range, y_range, num_points_u, num_points_v)
complex_surface = CreateComplexSurface(x_range, y_range, num_points_u, num_points_v)

# Domains
domain_u = basic_surface.Domain(0)
domain_v = basic_surface.Domain(1)
domain_dict = {'Domain_U': [domain_u[0], domain_u[1]], 'Domain_V': [domain_v[0], domain_v[1]]}
domain_str = json.dumps(domain_dict, indent=4)

# OUTPUTS
a = basic_surface
b = control_points
c = domain_str
d = complex_surface
# ---------- end absolute_value ----------
geometry = Geometry(absolute_value.a)
geometry_2 = Geometry(absolute_value.b)
geometry_3 = Geometry(absolute_value.d)
panel_3 = Panel(absolute_value.out)
entwine = Entwine(Branch00=geometry, Branch01=geometry_2, Branch02=absolute_value.c, Branch03=geometry_3, FlattenInputs=True)
panel_4 = Panel(entwine)
