# Grasshopper definition 003_Coordinates_Graphs.gh (Grasshopper 1.0.7)
# plug-ins: RhinoCodePluginGH

# ----
# Oscillation Algorithm
# The oscillation algorithm can be use to animate
# any geometry that is driven by a number sliders.
# Simply swap out the number sliders at the
# multiplication node in the oscillation script.
panel = Panel("1")  # disabled
trigger = Trigger(Interval=20, TimerInterval=20, Target=data_recorder)  # disabled
data_recorder = DataRecorder(panel, DataLimit=-10, RecordData=False)  # disabled
number_slider = Slider(23, range=0..1000)  # disabled
# Certainly! Creating a geometric 3D model using
#  the Rhino Common API in Python involves
# several steps. Below is a Python 3 code snippet
# that you can put inside a Python 3 script node in
#  Grasshopper for Rhino 8 WIP.
# 
# In this example, the code creates a 3D surface
# z=sin(x)×cos(y). This is a single-variable function
#  in terms of
# z and demonstrates the concepts of functions,
# limits, and continuity.
list_length = ListLength(List=data_recorder)  # disabled
division = Division(A=list_length, B=number_slider)  # disabled
cosine = Cosine(Value=division)  # disabled
sine = Sine(Value=division)  # disabled
panel_2 = Panel([sine, cosine])  # disabled
multiplication = Multiplication(A=sine)  # disabled
multiplication_2 = Multiplication(A=cosine)  # disabled

# ----
# gpt-4 Text Prompt
# Learn Single-Variable Calculus
# with Python in Grasshopper
# at Wickerson Studios
# Create a geometric 3D model with
# 
# Single-Variable Calculus
# Functions, Limits, and Continuity
# The Real Line and the Cartesian Plane
# 
# to create a 3D model about
# 
# Coordinates and Graphs
# 
# 
# in python 3 code for the python 3 script
# node in grasshopper for Rhino8WIP using the
# 
# Rhino Common API to create some geometry as well.
# 
# Output the parts of the model in different
# variable outputs in the python 3 node in
# grasshopper.
# 001 Functions, Limits,
# and Continuity
# 001 The Real Line and the Cartesian Plane
# 2nd gpt-4 Text Prompt
# 003 coordinates and Graphs
# Great, now make the script much more complex model
# with complex trigonometric polynomials and the
# NUMPY python library. Be sure to incorporate the previous code logic.
# ensure that this script produces 3d geometry as
# well for Data visualization purposes.
# ADVANCED
# gpt-4 Initial Response
# PARAMETRIC
number_slider_2 = Slider(-10, range=-10..10)  # disabled
number_slider_3 = Slider(10, range=0..10)  # disabled
number_slider_4 = Slider(13, range=0..100)  # disabled
number_slider_5 = Slider(10, range=0..10)  # disabled
number_slider_6 = Slider(-10, range=-10..10)  # disabled
number_slider_7 = Slider(13, range=0..100)  # disabled
coords_and_graphs = Script(
    x_range=[number_slider_2, number_slider_5],
    y_range=[number_slider_6, number_slider_3],
    num_points_u=number_slider_4,
    num_points_v=number_slider_7)  # -> out, A, B, C; inputs x_range: list of Double, y_range: list of Double, num_points_u: Int32, num_points_v: Int32, a_coef: Double, b_coef: Double; disabled
# ---------- coords_and_graphs: Python ----------
import Rhino.Geometry as rg
import math

def create_curve_and_derivative():
    curve_points = []  # Points for the original function curve f(x)
    derivative_points = []  # Points for the derivative curve f'(x)
    limit_points = []  # Points that demonstrate limits
    
    # Generate points for the curve and its derivative
    for i in range(0, 101):
        x = i / 10.0 - 5  # x ranges from -5 to 5
        y = math.sin(x)  # The function f(x) = sin(x)
        dy = math.cos(x)  # The derivative f'(x) = cos(x)
        
        curve_point = rg.Point3d(x, y, 0)  # Point for f(x)
        derivative_point = rg.Point3d(x, 0, dy)  # Point for f'(x)
        
        curve_points.append(curve_point)
        derivative_points.append(derivative_point)
        
        # Points to demonstrate a limit at x = 0
        if math.isclose(x, 0.0, abs_tol=0.1):
            limit_point_above = rg.Point3d(x, y, dy + 0.5)
            limit_point_below = rg.Point3d(x, y, dy - 0.5)
            limit_points.append(limit_point_above)
            limit_points.append(limit_point_below)
        
    # Create curves from points
    function_curve = rg.PolylineCurve(curve_points)
    derivative_curve = rg.PolylineCurve(derivative_points)
    
    return function_curve, derivative_curve, limit_points

def main():
    func_curve, deriv_curve, lim_points = create_curve_and_derivative()
    return func_curve, deriv_curve, lim_points

# Outputs
A, B, C = main()
# ---------- end coords_and_graphs ----------
coords_and_graphs_2 = Script(
    x_start=Slider(-5, range=-5..5),
    x_end=Slider(5, range=-5..5),
    num_points=Slider(97, range=0..100),
    scale_factor=Slider(1, range=0..1))  # -> out, A, B, C, D, E; inputs x_start: Double, x_end: Double, num_points: Int32, scale_factor: Int32
# ---------- coords_and_graphs_2: Python ----------
import Rhino.Geometry as rg
import math

# Input data types:
# x_start, x_end: float
# num_points: int
# scale_factor: float

def create_curves_and_derivative(x_start=-5.0, x_end=5.0, num_points=100, scale_factor=1.0):
    curve_points = []  
    derivative_points = []  
    abs_curve_points = []  
    abs_derivative_points = []  
    limit_points = []  

    x_step = (x_end - x_start) / (num_points - 1)
    
    for i in range(num_points):
        x = x_start + i * x_step  
        y = scale_factor * math.sin(x)  
        dy = scale_factor * math.cos(x) 
        abs_y = scale_factor * abs(x) 
        
        abs_dy = scale_factor if x > 0 else -scale_factor if x < 0 else None 
        
        curve_point = rg.Point3d(x, y, 0)  
        derivative_point = rg.Point3d(x, 0, dy)  
        abs_curve_point = rg.Point3d(x, abs_y, 0)  
        
        curve_points.append(curve_point)
        derivative_points.append(derivative_point)
        abs_curve_points.append(abs_curve_point)
        
        if abs_dy is not None:
            abs_derivative_point = rg.Point3d(x, 0, abs_dy)
            abs_derivative_points.append(abs_derivative_point)
        
        if math.isclose(x, 0.0, abs_tol=0.1):
            limit_point_above = rg.Point3d(x, y, dy + 0.5)
            limit_point_below = rg.Point3d(x, y, dy - 0.5)
            limit_points.append(limit_point_above)
            limit_points.append(limit_point_below)
        
    function_curve = rg.PolylineCurve(curve_points)
    derivative_curve = rg.PolylineCurve(derivative_points)
    abs_function_curve = rg.PolylineCurve(abs_curve_points)
    abs_derivative_curve = rg.PolylineCurve(abs_derivative_points) if abs_derivative_points else None
    
    return function_curve, derivative_curve, abs_function_curve, abs_derivative_curve, limit_points

def main(x_start, x_end, num_points, scale_factor):
    return create_curves_and_derivative(x_start, x_end, num_points, scale_factor)

# Recommended input values:
# x_start = -5.0
# x_end = 5.0
# num_points = 100
# scale_factor = 1.0

# Outputs
A, B, C, D, E = main(x_start, x_end, num_points, scale_factor)
# ---------- end coords_and_graphs_2 ----------
geometry = Geometry(coords_and_graphs.B)  # disabled
geometry_2 = Geometry(coords_and_graphs.C)  # disabled
geometry_3 = Geometry(coords_and_graphs.A)  # disabled
geometry_4 = Geometry(coords_and_graphs_2.A)
geometry_5 = Geometry(coords_and_graphs_2.B)
geometry_6 = Geometry(coords_and_graphs_2.C)
geometry_7 = Geometry(coords_and_graphs_2.D)
geometry_8 = Geometry(coords_and_graphs_2.E)
panel_3 = Panel(coords_and_graphs_2.out)
panel_4 = Panel(coords_and_graphs.out)  # disabled
entwine = Entwine(
    Branch00=geometry_4,
    Branch01=geometry_5,
    Branch02=geometry_6,
    Branch03=geometry_7,
    Branch04=geometry_8,
    FlattenInputs=True)
entwine_2 = Entwine(Branch00=geometry_3, Branch01=geometry, Branch02=geometry_2, FlattenInputs=True)  # disabled
panel_5 = Panel(entwine)
panel_6 = Panel(entwine_2)  # disabled
