# Grasshopper definition 004_Operations_On_Functions.gh (Grasshopper 1.0.7)
# plug-ins: RhinoCodePluginGH

# ----
# Oscillation Algorithm
# The oscillation algorithm can be use to animate
# any geometry that is driven by a number sliders.
# Simply swap out the number sliders at the
# multiplication node in the oscillation script.
panel = Panel("1")  # disabled
trigger = Trigger(Interval=20, TimerInterval=20, Target=data_recorder)  # disabled
data_recorder = DataRecorder(panel, DataLimit=-10, RecordData=False)  # disabled
number_slider = Slider(23, range=0..1000)  # disabled
# Creating a 3D model with Python involves using
# some libraries such as NumPy and matplotlib.
# However, you want to create a 3D model using
# the Rhino Common API in Grasshopper for
# Rhino 8 WIP, which involves a different process.
# 
# RhinoCommon is the .NET SDK for Rhino 5 and
#  Rhino 6. Grasshopper is a Rhino plug-in that
# uses RhinoCommon. The python script node in
# Grasshopper can be used to run Python scripts,
# and you can use the RhinoCommon API in
# those scripts.
list_length = ListLength(List=data_recorder)  # disabled
division = Division(A=list_length, B=number_slider)  # disabled
cosine = Cosine(Value=division)  # disabled
sine = Sine(Value=division)  # disabled
panel_2 = Panel([sine, cosine])  # disabled
multiplication = Multiplication(A=sine)  # disabled
multiplication_2 = Multiplication(A=cosine)  # disabled

# ----
# gpt-4 Initial Response
number_slider_2 = Slider(10, range=0..10)  # disabled
# PARAMETRIC
number_slider_3 = Slider(0.9, range=0..10)  # disabled
# gpt-4 Text Prompt
# Learn Single-Variable Calculus
# with Python in Grasshopper
# at Wickerson Studios
# Create a geometric 3D model with
# 
# Single-Variable Calculus
# Functions, Limits, and Continuity
# The Real Line and the Cartesian Plane
# 
# to create a 3D model about
# 
# Coordinates and Graphs
# 
# 
# in python 3 code for the python 3 script
# node in grasshopper for Rhino8WIP using the
# 
# Rhino Common API to create some geometry as well.
# 
# Output the parts of the model in different
# variable outputs in the python 3 node in
# grasshopper.
# 001 Functions, Limits,
# and Continuity
# 002 Functions
# 2nd gpt-4 Text Prompt
# 004 Operations of Functions
# Great, now make the script much more complex model
# with complex trigonometric polynomials and the
# NUMPY python library. Be sure to incorporate the previous code logic.
# ensure that this script produces 3d geometry as
# well for Data visualization purposes.
# ADVANCED
number_slider_4 = Slider(100, range=0..100)  # disabled
number_slider_5 = Slider(20, range=0..20)  # disabled
coords_and_graphs = Script(
    num_points=Slider(200, range=0..200),
    freq_x=Slider(5.2, range=0..10),
    amp_x=Slider(7.6, range=0..10),
    freq_y=Slider(5.2, range=0..10),
    amp_y=Slider(4.5, range=0..10),
    height=Slider(22.18, range=0..100))  # -> out, a, b, c; inputs num_points: Int32, freq_x: Double, amp_x: Double, freq_y: Double, amp_y: Double, height: Double
# ---------- coords_and_graphs: Python ----------
import Rhino
import Rhino.Geometry as rg
import math
import numpy as np

# Initialize empty lists for output
points = []
curves = []
pipes = []

# Number of points on the curve
"""
num_points = 200
# Frequency and amplitude parameters for trigonometric functions
freq_x = 3
amp_x = 10
freq_y = 5
amp_y = 10
# Height of the curve
height = 20
"""

# Generate points based on complex trigonometric polynomials
for i in np.linspace(0, 2 * np.pi, num_points):
    x = amp_x * np.sin(freq_x * i) + 5 * np.sin(2 * freq_x * i)
    y = amp_y * np.cos(freq_y * i) + 5 * np.cos(2 * freq_y * i)
    z = height * (i / (2 * np.pi))
    pt = rg.Point3d(x, y, z)
    points.append(pt)

# Create interpolated curve through points
if len(points) > 1:
    curve = rg.Curve.CreateInterpolatedCurve(points, 3)
    if curve:
        curves.append(curve)

        # Sweep a varying-radius circle along the curve to create a pipe
        sweep = rg.SweepOneRail()
        sweep.AngleToleranceRadians = math.pi / 10
        sweep.ClosedSweep = False
        sweep.SweepTolerance = 0.001
        sweep.SetToRoadlikeTop()

        # Create varying-radius circles and sweep them
        circles = []
        for t in np.linspace(0, 1, 20):
            point = curve.PointAt(curve.Domain.ParameterAt(t))
            radius = 0.5 + 0.5 * np.sin(4 * np.pi * t)  # Varying radius between 0.5 and 1.0
            circle = rg.Circle(point, radius)
            circles.append(circle.ToNurbsCurve())

        breps = sweep.PerformSweep(curve, circles)

        if breps:
            pipes.extend(breps)

# Outputs
a = points
b = curves
c = pipes
# ---------- end coords_and_graphs ----------
coords_and_graphs_2 = Script(num_points=number_slider_4, radius=number_slider_2, height=number_slider_5, pipe_radius=number_slider_3)  # -> out, a, b, c; inputs num_points: Int32, radius: Double, height: Double, pipe_radius: Double; disabled
# ---------- coords_and_graphs_2: Python ----------
import Rhino
import Rhino.Geometry as rg
import math

# Initialize empty lists for output
points = []
curves = []
pipes = []

# Number of points on the spiral
"""
num_points = 100
# Radius of the spiral
radius = 10
# Height of the spiral
height = 20
# Radius of the pipe
pipe_radius = 1.0
"""

# Generate points on a 3D spiral
for i in range(num_points):
    theta = i * (2.0 * math.pi / 10.0)
    x = radius * math.cos(theta)
    y = radius * math.sin(theta)
    z = height * float(i) / num_points
    pt = rg.Point3d(x, y, z)
    points.append(pt)

# Create interpolated curve through points
if len(points) > 1:
    curve = rg.Curve.CreateInterpolatedCurve(points, 3)
    if curve:
        curves.append(curve)
        
        # Create a circle at the start of the curve
        circle = rg.Circle(curve.PointAtStart, pipe_radius)
        curve_circle = circle.ToNurbsCurve()
        
        # Sweep the circle along the curve to create a pipe
        sweep = rg.SweepOneRail()
        sweep.AngleToleranceRadians = math.pi / 10
        sweep.ClosedSweep = False
        sweep.SweepTolerance = 0.001
        sweep.SetToRoadlikeTop()
        brep = sweep.PerformSweep(curve, curve_circle)[0]
        
        if brep:
            pipes.append(brep)

# Outputs
a = points
b = curves
c = pipes
# ---------- end coords_and_graphs_2 ----------
geometry = Geometry(coords_and_graphs.b)
geometry_2 = Geometry(coords_and_graphs.c)
panel_3 = Panel(coords_and_graphs.out)
geometry_3 = Geometry(coords_and_graphs.a)
panel_4 = Panel(coords_and_graphs_2.out)  # disabled
geometry_4 = Geometry(coords_and_graphs_2.b)  # disabled
geometry_5 = Geometry(coords_and_graphs_2.c)  # disabled
geometry_6 = Geometry(coords_and_graphs_2.a)  # disabled
entwine = Entwine(Branch00=geometry_3, Branch01=geometry, Branch02=geometry_2, FlattenInputs=True)
entwine_2 = Entwine(Branch00=geometry_6, Branch01=geometry_4, Branch02=geometry_5, FlattenInputs=True)  # disabled
panel_5 = Panel(entwine)
panel_6 = Panel(entwine_2)  # disabled
