# Grasshopper definition 004b_Operations_On_Functions.gh (Grasshopper 1.0.7)
# plug-ins: RhinoCodePluginGH

# ----
# ADVANCED
# PARAMETRIC
number_slider = Slider(1, range=-1..1)
# gpt-4 Text Prompt
# Learn Single-Variable Calculus
# with Python in Grasshopper
# at Wickerson Studios
# Create a geometric 3D model with
# 
# Single-Variable Calculus
# Functions, Limits, and Continuity
# Functions
# 
# to create a 3D model about
# 
# Operations of Functions
# (f + g)(x) = f(x) + g(x)
# 
# 
# in python 3 code for the python 3 script
# node in grasshopper for Rhino8WIP using the
# 
# Rhino Common API to create some geometry as well.
# 
# Output the parts of the model in different
# variable outputs in the python 3 node in
# grasshopper.
# 001 Functions, Limits,
# and Continuity
# 002 Functions
# 004 Operations of Functions
# (f + g)(x) = f(x) + g(x)
# 2nd gpt-4 Text Prompt
# Great, now make the script much more complex model
# with complex trigonometric polynomials and the
# NUMPY python library. Be sure to incorporate the previous code logic.
# ensure that this script produces 3d geometry as
# well for Data visualization purposes.
# gpt-4 Initial Response
# In order to create a 3D model that
# demonstrates the operation
# 
# (f+g)(x)=f(x)+g(x), we can use Python with the
# Rhino Common API to develop a custom
# Grasshopper node in Rhino 8 WIP. Below is a
# Python script that illustrates how to accomplish
# this.
# 
# This example assumes two functions
# 
# f(x)=sin(x) and
# 
# g(x)=cos(x). The sum
# 
# (f+g)(x) is calculated and plotted as well.
number_slider_2 = Slider(1, range=-1..1)
number_slider_3 = Slider(1, range=-1..1)
number_slider_4 = Slider(1, range=-1..1)
f_g_x_f_x_g_x = Script(a=number_slider_2, b=number_slider_3, c=number_slider_4, d=number_slider)  # -> out, a, b, c; inputs a: Double, b: Double, c: Double, d: Double
# ---------- f_g_x_f_x_g_x: Python ----------
import Rhino
import Rhino.Geometry as rg
import math

def create_curve(f, g, x_range, z_height):
    f_curve_points = []
    g_curve_points = []
    sum_curve_points = []

    # Calculate points for f(x), g(x) and f(x) + g(x)
    for x in x_range:
        f_val = f(x)
        g_val = g(x)
        sum_val = f_val + g_val

        f_curve_points.append(rg.Point3d(x, f_val, 0))
        g_curve_points.append(rg.Point3d(x, g_val, 0))
        sum_curve_points.append(rg.Point3d(x, sum_val, 0))

    # Create the curves
    f_curve = rg.Curve.CreateInterpolatedCurve(f_curve_points, 3)
    g_curve = rg.Curve.CreateInterpolatedCurve(g_curve_points, 3)
    sum_curve = rg.Curve.CreateInterpolatedCurve(sum_curve_points, 3)

    # Create 3D extrusions
    f_extrusion = rg.Extrusion.Create(f_curve, z_height, True)
    g_extrusion = rg.Extrusion.Create(g_curve, z_height, True)
    sum_extrusion = rg.Extrusion.Create(sum_curve, z_height, True)

    return f_extrusion, g_extrusion, sum_extrusion

# Coefficients for the functions
"""
a = 1.0  # coefficient for sine in f(x)
b = 1.0  # frequency for sine in f(x)
c = 1.0  # coefficient for cosine in g(x)
d = 1.0  # frequency for cosine in g(x)
"""

# Functions f(x) and g(x)
f = lambda x: a * math.sin(b * x)
g = lambda x: c * math.cos(d * x)

# X and Z range for creating the geometry
x_start = 0.0
x_end = 6.28318530718  # 2 * Pi
x_step = 0.1
z_height = 10.0  # Height of the extrusion along the Z-axis

x_range = [x for x in [x_start + i*x_step for i in range(int((x_end - x_start) / x_step))]]

# Create the 3D models
f_model, g_model, sum_model = create_curve(f, g, x_range, z_height)

# Output the 3D models as different variable outputs in the Grasshopper Python node
a = f_model
b = g_model
c = sum_model
# ---------- end f_g_x_f_x_g_x ----------
panel = Panel(f_g_x_f_x_g_x.out)
geometry = Geometry(f_g_x_f_x_g_x.b)
geometry_2 = Geometry(f_g_x_f_x_g_x.c)
geometry_3 = Geometry(f_g_x_f_x_g_x.a)
entwine = Entwine(Branch00=geometry_3, Branch01=geometry, Branch02=geometry_2, FlattenInputs=True)
panel_2 = Panel(entwine)

# ----
# Oscillation Algorithm
# The oscillation algorithm can be use to animate
# any geometry that is driven by a number sliders.
# Simply swap out the number sliders at the
# multiplication node in the oscillation script.
panel_3 = Panel("1")  # disabled
trigger = Trigger(Interval=20, TimerInterval=20, Target=data_recorder)  # disabled
data_recorder = DataRecorder(panel_3, DataLimit=-10, RecordData=False)  # disabled
number_slider_5 = Slider(56, range=0..1000)  # disabled
list_length = ListLength(List=data_recorder)  # disabled
division = Division(A=list_length, B=number_slider_5)  # disabled
cosine = Cosine(Value=division)  # disabled
sine = Sine(Value=division)  # disabled
panel_4 = Panel([sine, cosine])  # disabled
multiplication = Multiplication(A=sine, B=number_slider_2)  # disabled
multiplication_2 = Multiplication(A=sine, B=number_slider_4)  # disabled
multiplication_3 = Multiplication(A=cosine, B=number_slider_3)  # disabled
multiplication_4 = Multiplication(A=cosine, B=number_slider)  # disabled
