# Grasshopper definition 004c_Operations_On_Functions.gh (Grasshopper 1.0.7)
# plug-ins: RhinoCodePluginGH

# ----
# 2nd gpt-4 Text Prompt
# Great, now make the script much more complex model
# with complex trigonometric polynomials and the
# NUMPY python library. Be sure to incorporate the previous code logic.
# ensure that this script produces 3d geometry as
# well for Data visualization purposes.
# Oscillation Algorithm
# The oscillation algorithm can be use to animate
# any geometry that is driven by a number sliders.
# Simply swap out the number sliders at the
# multiplication node in the oscillation script.
panel = Panel("1")  # disabled
trigger = Trigger(Interval=20, TimerInterval=20, Target=data_recorder)  # disabled
data_recorder = DataRecorder(panel, DataLimit=-10, RecordData=False)  # disabled
number_slider = Slider(56, range=0..1000)  # disabled
list_length = ListLength(List=data_recorder)  # disabled
division = Division(A=list_length, B=number_slider)  # disabled
cosine = Cosine(Value=division)  # disabled
sine = Sine(Value=division)  # disabled
# gpt-4 Initial Response
# Creating a 3D model based on the operation
# 
# (f×g)(x)=f(x)×g(x) involves quite a few steps, from
#  defining the functions
# 
# f(x) and g(x) to plotting the resulting geometry.
# Here, I will provide a Python 3 script that you can
#  put into a Python 3 script node in Grasshopper
# for Rhino 8 WIP.
# 
# First, let's assume
# f(x) is x^2
# 
# g(x) is sin(x)
# 
# Therefore,
# 
# (f×g)(x)=x ^2 * sin(x).
panel_2 = Panel([sine, cosine])  # disabled

# ----
# gpt-4 Text Prompt
# Create a geometric 3D model with
# 
# Single-Variable Calculus
# Functions, Limits, and Continuity
# Functions
# 
# to create a 3D model about
# 
# Operations of Functions
# (f * g)(x) = f(x) * g(x)
# 
# 
# in python 3 code for the python 3 script
# node in grasshopper for Rhino8WIP using the
# 
# Rhino Common API to create some geometry as well.
# 
# Output the parts of the model in different
# variable outputs in the python 3 node in
# grasshopper.
gene_pool = GenePool(
    Decimals=2,
    Maximum=3,
    Minimum=-3,
    Value=[-2.737311349, -2.564506413, 2.816323832, -2.412489622, -2.669110129, -0.2346351031])
explode_tree = ExplodeTree(Data=graft(gene_pool))  # -> Branch0, Branch1, Branch2, Branch3, Branch4, Branch5
f_g_x_f_x_g_x = Script(
    f_params=flatten([explode_tree.Branch0, explode_tree.Branch1, explode_tree.Branch2]),
    g_params=flatten([explode_tree.Branch3, explode_tree.Branch4, explode_tree.Branch5]))  # -> out, a, b, c, d; inputs f_params: list of Double, g_params: list of Double
# ---------- f_g_x_f_x_g_x: Python ----------
import Rhino.Geometry as rg
import numpy as np

def trig_poly_f(x, a1, a2, a3):
    return a1 * np.sin(x) + a2 * np.cos(2*x) + a3 * np.sin(3*x)

def trig_poly_g(x, b1, b2, b3):
    return b1 * np.cos(x) + b2 * np.sin(2*x) + b3 * np.cos(3*x)

def main(x_start, x_end, x_points, y_start, y_end, y_points, scale, f_params, g_params):
    # Initialize lists to hold points and surfaces
    f_points = []
    g_points = []
    fg_points = []
    surfaces = []
    
    # Create an array for x and y values
    x_values = np.linspace(x_start, x_end, x_points)
    y_values = np.linspace(y_start, y_end, y_points)

    # Loop through x_values and y_values to calculate function values
    for x in x_values:
        for y in y_values:
            f_x = trig_poly_f(x, *f_params)
            g_x = trig_poly_g(x, *g_params)
            fg_x = f_x * g_x

            f_pt = rg.Point3d(x * scale, y * scale, f_x * scale)
            g_pt = rg.Point3d(x * scale, y * scale, g_x * scale)
            fg_pt = rg.Point3d(x * scale, y * scale, fg_x * scale)

            f_points.append(f_pt)
            g_points.append(g_pt)
            fg_points.append(fg_pt)

            if len(fg_points) > 1:
                srf = rg.NurbsSurface.CreateFromCorners(fg_points[-2], fg_points[-1], f_points[-1], f_points[-2])
                if srf:
                    surfaces.append(srf)

    # Output lists of points and surfaces
    return f_points, g_points, fg_points, surfaces

# Parameters for the trigonometric polynomial functions
#f_params = [1, 1, 1]  # coefficients for f(x)
#g_params = [1, 1, 1]  # coefficients for g(x)

# Input parameters
x_start, x_end = -10, 10
x_points = 20
y_start, y_end = -10, 10
y_points = 20
scale = 1

# Function execution
f_points, g_points, fg_points, surfaces = main(x_start, x_end, x_points, y_start, y_end, y_points, scale, f_params, g_params)

# Output
# Connect these to Grasshopper components to visualize
a = f_points
b = g_points
c = fg_points
d = surfaces
# ---------- end f_g_x_f_x_g_x ----------

# ----
# Learn Single-Variable Calculus
# with Python in Grasshopper
# at Wickerson Studios
# 001 Functions, Limits,
# and Continuity
# 002 Functions
# 004 Operations of Functions
# (f * g)(x) = f(x) * g(x)
# ADVANCED
# PARAMETRIC
# To make the script parametric, we can
# generalize the functions
# 
# f(x) and g(x) by passing them as arguments to
# the main function. That way, you can easily
# change the functions without altering the core
# logic of the script.
f_g_x_f_x_g_x_2 = Script()  # -> out, a, b, c, d; disabled
# ---------- f_g_x_f_x_g_x_2: Python ----------
import Rhino.Geometry as rg
import math

def main(x_values, y_values, scale, f_func, g_func):
    # Initialize lists to hold points and surfaces
    f_points = []
    g_points = []
    fg_points = []
    surfaces = []

    # Loop through x_values and y_values to calculate function values
    for x in x_values:
        for y in y_values:
            f_x = f_func(x)
            g_x = g_func(x)
            fg_x = f_x * g_x

            f_pt = rg.Point3d(x * scale, y * scale, f_x * scale)
            g_pt = rg.Point3d(x * scale, y * scale, g_x * scale)
            fg_pt = rg.Point3d(x * scale, y * scale, fg_x * scale)

            f_points.append(f_pt)
            g_points.append(g_pt)
            fg_points.append(fg_pt)

            if len(fg_points) > 1:
                srf = rg.NurbsSurface.CreateFromCorners(fg_points[-2], fg_points[-1], f_points[-1], f_points[-2])
                if srf:
                    surfaces.append(srf)

    # Output lists of points and surfaces
    return f_points, g_points, fg_points, surfaces

# Define functions f(x) and g(x)
def f(x):
    return x**2

def g(x):
    return math.sin(x)

# Input
x_values = [i for i in range(-10, 11)]
y_values = [i for i in range(-10, 11)]
scale = 1

# Function execution
f_points, g_points, fg_points, surfaces = main(x_values, y_values, scale, f, g)

# Output
# Connect these to Grasshopper components to visualize
a = f_points
b = g_points
c = fg_points
d = surfaces
# ---------- end f_g_x_f_x_g_x_2 ----------
geometry = Geometry(f_g_x_f_x_g_x_2.d)  # disabled
panel_3 = Panel(f_g_x_f_x_g_x_2.out)  # disabled
geometry_2 = Geometry(f_g_x_f_x_g_x_2.b)  # disabled
geometry_3 = Geometry(f_g_x_f_x_g_x_2.c)  # disabled
geometry_4 = Geometry(f_g_x_f_x_g_x_2.a)  # disabled
entwine = Entwine(Branch00=geometry_4, Branch01=geometry_2, Branch02=geometry_3, Branch03=geometry, FlattenInputs=True)  # disabled
panel_4 = Panel(entwine)  # disabled

panel_5 = Panel(f_g_x_f_x_g_x.out)
geometry_5 = Geometry(f_g_x_f_x_g_x.b)
geometry_6 = Geometry(f_g_x_f_x_g_x.c)
geometry_7 = Geometry(f_g_x_f_x_g_x.a)
geometry_8 = Geometry(f_g_x_f_x_g_x.d)
entwine_2 = Entwine(Branch00=geometry_7, Branch01=geometry_5, Branch02=geometry_6, Branch03=geometry_8, FlattenInputs=True)
panel_6 = Panel(entwine_2)
