# Grasshopper definition 005_Odd_Even_Functions.gh (Grasshopper 1.0.7)
# plug-ins: RhinoCodePluginGH

# ----
# 2nd gpt-4 Text Prompt
# Great, now make the script much more complex model
# with complex trigonometric polynomials and the
# NUMPY python library. Be sure to incorporate the previous code logic.
# ensure that this script produces 3d geometry as
# well for Data visualization purposes.
# Oscillation Algorithm
# The oscillation algorithm can be use to animate
# any geometry that is driven by a number sliders.
# Simply swap out the number sliders at the
# multiplication node in the oscillation script.
panel = Panel("1")  # disabled
trigger = Trigger(Interval=20, TimerInterval=20, Target=data_recorder)  # disabled
data_recorder = DataRecorder(panel, DataLimit=-10, RecordData=False)  # disabled
number_slider = Slider(56, range=0..1000)  # disabled
# gpt-4 Initial Response
# To generate a geometric 3D model based on
# the concept of Odd and Even functions using
# Python 3 in a Grasshopper node for Rhino 8
# WIP, you'll need to utilize the Rhino Common
# API. The model will showcase two functions -
# one odd and one even - in 3D space.
list_length = ListLength(List=data_recorder)  # disabled
division = Division(A=list_length, B=number_slider)  # disabled
cosine = Cosine(Value=division)  # disabled
sine = Sine(Value=division)  # disabled
# gpt-4 Text Prompt
# Create a geometric 3D model with
# 
# Single-Variable Calculus
# Functions, Limits, and Continuity
# Functions
# 
# to create a 3D model specifically about
# 
# Odd and Even Functions
# 
# 
# in python 3 code for the python 3 script
# node in grasshopper for Rhino8WIP using the
# 
# Rhino Common API to create some geometry as well.
# 
# Output the parts of the model in different
# variable outputs in the python 3 node in
# grasshopper.
panel_2 = Panel([sine, cosine])  # disabled

# ----
# Learn Single-Variable Calculus
# with Python in Grasshopper
# at Wickerson Studios
# 001 Functions, Limits,
# and Continuity
# 002 Functions
# 005 Odd and Even Functions
# ADVANCED
# PARAMETRIC
# To make the script parametric, we can
# generalize the functions
# 
# f(x) and g(x) by passing them as arguments to
# the main function. That way, you can easily
# change the functions without altering the core
# logic of the script.
odd_even_functions = Script()  # -> out, even_output, odd_output
# ---------- odd_even_functions: Python ----------
import Rhino.Geometry as rg
import numpy as np
import math
import cmath

# Complex Function Definitions

def even_complex_function(x, z):
    return cmath.cos(x + 1j * z)

def odd_complex_function(x, z):
    return cmath.sin(x + 1j * z)

# Parameters for the model
x_start = -10.0
x_end = 10.0
x_step = 0.5
z_start = -10.0
z_end = 10.0
z_step = 0.5

# Create geometry for even function
even_points = []
even_mesh = rg.Mesh()

for x in np.arange(x_start, x_end + x_step, x_step):
    for z in np.arange(z_start, z_end + z_step, z_step):
        y = even_complex_function(x, z).real  # Using only the real part for demonstration
        pt = rg.Point3d(x, y, z)
        even_points.append(pt)
        even_mesh.Vertices.Add(pt)

# Create mesh faces for even function
for i in range(int((x_end - x_start) / x_step)):
    for j in range(int((z_end - z_start) / z_step)):
        even_mesh.Faces.AddFace(i + j * (int((x_end - x_start) / x_step) + 1),
                                (i + 1) + j * (int((x_end - x_start) / x_step) + 1),
                                (i + 1) + (j + 1) * (int((x_end - x_start) / x_step) + 1),
                                i + (j + 1) * (int((x_end - x_start) / x_step) + 1))

# Create geometry for odd function
odd_points = []
odd_mesh = rg.Mesh()

for x in np.arange(x_start, x_end + x_step, x_step):
    for z in np.arange(z_start, z_end + z_step, z_step):
        y = odd_complex_function(x, z).real  # Using only the real part for demonstration
        pt = rg.Point3d(x, y, z)
        odd_points.append(pt)
        odd_mesh.Vertices.Add(pt)

# Create mesh faces for odd function
for i in range(int((x_end - x_start) / x_step)):
    for j in range(int((z_end - z_start) / z_step)):
        odd_mesh.Faces.AddFace(i + j * (int((x_end - x_start) / x_step) + 1),
                               (i + 1) + j * (int((x_end - x_start) / x_step) + 1),
                               (i + 1) + (j + 1) * (int((x_end - x_start) / x_step) + 1),
                               i + (j + 1) * (int((x_end - x_start) / x_step) + 1))

# Output to Grasshopper
even_output = even_mesh
odd_output = odd_mesh
# ---------- end odd_even_functions ----------
panel_3 = Panel(odd_even_functions.out)
geometry = Geometry(odd_even_functions.odd_output)
geometry_2 = Geometry(odd_even_functions.even_output)
entwine = Entwine(Branch00=geometry_2, Branch01=geometry, FlattenInputs=True)
panel_4 = Panel(entwine)
