# Grasshopper definition 006 Inverting_NonOneToOne_Functions.gh (Grasshopper 1.0.7)
# plug-ins: RhinoCodePluginGH

# ----
# Oscillation Algorithm
# The oscillation algorithm can be use to animate
# any geometry that is driven by a number sliders.
# Simply swap out the number sliders at the
# multiplication node in the oscillation script.
panel = Panel("1")  # disabled
trigger = Trigger(Interval=20, TimerInterval=20, Target=data_recorder)  # disabled
data_recorder = DataRecorder(panel, DataLimit=-10, RecordData=False)  # disabled
number_slider = Slider(56, range=0..1000)  # disabled
list_length = ListLength(List=data_recorder)  # disabled
division = Division(A=list_length, B=number_slider)  # disabled
cosine = Cosine(Value=division)  # disabled
sine = Sine(Value=division)  # disabled
panel_2 = Panel([sine, cosine])  # disabled

# ----
# gpt-4 Text Prompt
# Learn Single-Variable Calculus
# with Python in Grasshopper
# at Wickerson Studios
# Create a geometric 3D model with
# 
# Single-Variable Calculus
# Functions, Limits, and Continuity
# Inverse Functions
# 
# to create a 3D model specifically about
# 
# Inverting Non-One-to-One Functions
# 
# 
# in python 3 code for the python 3 script
# node in grasshopper for Rhino8WIP using the
# 
# Rhino Common API to create some geometry as well.
# 
# Output the parts of the model in different
# variable outputs in the python 3 node in
# grasshopper.
# 001 Functions, Limits,
# and Continuity
# 003 Inverse Functions
# 2nd gpt-4 Text Prompt
# 006 Inverting Non-One-to-One Functions
# Great, now make the script much more complex model
# with complex trigonometric polynomials and the
# NUMPY python library. Be sure to incorporate the previous code logic.
# ensure that this script produces 3d geometry as
# well for Data visualization purposes.
# ADVANCED
# gpt-4 Initial Response
# Creating a 3D model that involves the concept
# of inverting non-one-to-one functions in a
# Python 3 script for the Grasshopper for Rhino 8
# WIP environment would require you to use the
# Rhino Common API to generate geometry.
# Below is a simple example where we'll use a
# non-one-to-one function
# 
# f(x,y)=x ^2+y ^2
#   and its multi-valued inverse.
# 
# The multi-valued inverse will take a z-value and
# generate a circle with radius
# 
# sqrt(z)
# ​
# To keep things simple, we'll only work with z-
# values generated by
# 
# f(x,y) in a specific range.
# PARAMETRIC
inverting_non_one_to_one_functions = Script()  # -> out, a, b; disabled
# ---------- inverting_non_one_to_one_functions: Python ----------
import Rhino.Geometry as rg
import math

def non_one_to_one_func(x, y):
    return x**2 + y**2

def multi_valued_inverse(z):
    radius = math.sqrt(z)
    return radius

def create_geometry():
    # Function values (z-values)
    z_values = []
    
    # Original Points
    original_points = []
    
    for x in range(-5, 6):
        for y in range(-5, 6):
            z = non_one_to_one_func(x, y)
            z_values.append(z)
            original_points.append(rg.Point3d(x, y, z))
    
    # Inverse geometry (Circles)
    inverse_circles = []
    inverse_polyline_curves = []
    
    for z in z_values:
        radius = multi_valued_inverse(z)
        if radius == 0: 
            continue  # Skip zero-radius
        circle = rg.Circle(rg.Point3d(0, 0, z), radius)
        inverse_circles.append(circle)

        # Create a polyline curve from circle
        polyline_pts = [circle.PointAt(t) for t in [i * math.pi / 10 for i in range(20)]]
        polyline_pts.append(polyline_pts[0])  # Close the polyline
        polyline_curve = rg.PolylineCurve(polyline_pts)
        inverse_polyline_curves.append(polyline_curve)
    
    return original_points, inverse_polyline_curves

# Create geometry
original_points, inverse_polyline_curves = create_geometry()

# Output
# Assuming 'a', 'b' are the output variables in Grasshopper Python node
a = original_points
b = inverse_polyline_curves
# ---------- end inverting_non_one_to_one_functions ----------
panel_3 = Panel(inverting_non_one_to_one_functions.out)  # disabled
geometry = Geometry(inverting_non_one_to_one_functions.b)  # disabled
geometry_2 = Geometry(inverting_non_one_to_one_functions.a)  # disabled
entwine = Entwine(Branch00=geometry_2, Branch01=geometry, FlattenInputs=True)  # disabled
inverting_non_one_to_one_functions_2 = Script(
    x_range=[Slider(-5, range=-5..5), Slider(5, range=-5..5)],
    y_range=[Slider(-5, range=-5..5), Slider(5, range=-5..5)],
    resolution=Slider(8, range=0..30))  # -> out, a, b; inputs x_range: list of Double, y_range: list of Double, resolution: Int32
# ---------- inverting_non_one_to_one_functions_2: Python ----------
import Rhino.Geometry as rg
import numpy as np

# Input Data Types:
# x_range: tuple of float, (min, max)
# y_range: tuple of float, (min, max)
# resolution: integer
def create_geometry(x_range=(-5, 5), y_range=(-5, 5), resolution=50):
    # Define a complex trigonometric polynomial function
    def complex_trig_poly_func(x, y):
        return np.sin(x) * np.cos(y) + x**2 + y**2

    # Define multi-valued inverse function
    def multi_valued_inverse(z):
        if z - 1 >= 0:
            radius = np.sqrt(z - 1)
            return radius
        else:
            return -1

    # Original Points and Complex Function Values (z-values)
    original_points = []
    z_values = []

    x_vals = np.linspace(x_range[0], x_range[1], resolution)
    y_vals = np.linspace(y_range[0], y_range[1], resolution)

    for x in x_vals:
        for y in y_vals:
            z = complex_trig_poly_func(x, y)
            z_values.append(z)
            original_points.append(rg.Point3d(x, y, z))

    # Inverse geometry (3D Circles)
    inverse_circles = []
    inverse_polyline_curves = []

    unique_z_values = np.unique(np.round(z_values, 2))

    for z in unique_z_values:
        radius = multi_valued_inverse(z)
        if radius < 0: 
            continue
        circle = rg.Circle(rg.Point3d(0, 0, z), radius)
        inverse_circles.append(circle)

        # Create a polyline curve from circle
        polyline_pts = [circle.PointAt(t) for t in [i * 2 * np.pi / resolution for i in range(resolution)]]
        polyline_pts.append(polyline_pts[0])
        polyline_curve = rg.PolylineCurve(polyline_pts)
        inverse_polyline_curves.append(polyline_curve)

    return original_points, inverse_polyline_curves

# Suggested input values:
# x_range = (-5, 5)
# y_range = (-5, 5)
# resolution = 50
# These can be plugged as inputs into Grasshopper's Python node

original_points, inverse_polyline_curves = create_geometry(x_range, y_range, resolution)

# Output
# Assuming 'a', 'b' are the output variables in Grasshopper Python node
a = original_points
b = inverse_polyline_curves
# ---------- end inverting_non_one_to_one_functions_2 ----------
panel_4 = Panel(entwine)  # disabled
geometry_3 = Geometry(inverting_non_one_to_one_functions_2.b)
geometry_4 = Geometry(inverting_non_one_to_one_functions_2.a)
panel_5 = Panel(inverting_non_one_to_one_functions_2.out)
entwine_2 = Entwine(Branch00=geometry_4, Branch01=geometry_3, FlattenInputs=True)
loft = Loft(Curves=geometry_3, Options={Adjust=False, Closed=False, LoftEnds=0, LoftSimp=0, LoftType=0, Rebuild=10, Refit=0.01})
panel_6 = Panel(entwine_2)
