# Grasshopper definition 007_Limits.gh (Grasshopper 1.0.7)
# plug-ins: RhinoCodePluginGH

# ----
# Oscillation Algorithm
# The oscillation algorithm can be use to animate
# any geometry that is driven by a number sliders.
# Simply swap out the number sliders at the
# multiplication node in the oscillation script.
panel = Panel("1")  # disabled
trigger = Trigger(Interval=20, TimerInterval=20, Target=data_recorder)  # disabled
data_recorder = DataRecorder(panel, DataLimit=-10, RecordData=False)  # disabled
number_slider = Slider(56, range=0..1000)  # disabled
list_length = ListLength(List=data_recorder)  # disabled
division = Division(A=list_length, B=number_slider)  # disabled
cosine = Cosine(Value=division)  # disabled
sine = Sine(Value=division)  # disabled
panel_2 = Panel([sine, cosine])  # disabled

# ----
# ADVANCED
# PARAMETRIC
number_slider_2 = Slider(0.12, range=0..1)
number_slider_3 = Slider(52, range=0..100)
number_slider_4 = Slider(39, range=0..100)
# gpt-4 Text Prompt
# Create a geometric 3D model with
# 
# Single-Variable Calculus
# Functions, Limits, and Continuity
# Limits
# 
# to create a 3D model specifically about
# 
# Limits
# 
# 
# in python 3 code for the python 3 script
# node in grasshopper for Rhino8WIP using the
# 
# Rhino Common API to create some geometry as well.
# 
# Output the parts of the model in different
# variable outputs in the python 3 node in
# grasshopper.
# 004_Limits
# 2nd gpt-4 Text Prompt
# 007 Limits
# Great, now make the script much more complex model
# with complex trigonometric polynomials and the
# NUMPY python library. Be sure to incorporate the previous code logic.
# ensure that this script produces 3d geometry as
# well for Data visualization purposes.
# gpt-4 Initial Response
# Creating a 3D model to demonstrate the
# concept of limits using Python and the Rhino
# Common API for use in Grasshopper for Rhino
# 8 WIP is a specialized task. Below is an example
#  Python script that will create a 3D surface that
# approaches a limit as x and y tend towards
# infinity. This example uses the function
# 
# f(x,y)= 1/(x^2+y^2)
# 
# Here's how it works:
# 
# It creates a mesh of points in 3D space to
# represent the function
# f(x,y).
# It colors the mesh based on the height to
# visualize the function.
# It outputs the mesh to a variable in the Python
# node in Grasshopper.
# The script will have four outputs:
# 
# A for the 3D mesh
# B for a list of points along the x-axis that
# approach the limit
# C for a list of points along the y-axis that
# approach the limit
# D for a list of points along the line
# y=x that approach the limit
limits = Script()  # -> out, A, B, C, D; disabled
# ---------- limits: Python ----------
import Rhino.Geometry as rg
import math

def create_mesh(x_count, y_count, step):
    mesh = rg.Mesh()
    
    for i in range(x_count):
        for j in range(y_count):
            x = i * step
            y = j * step
            z = 1.0 / (x ** 2 + y ** 2 + 1)  # Add 1 to avoid division by zero
            mesh.Vertices.Add(x, y, z)
            
    for i in range(x_count - 1):
        for j in range(y_count - 1):
            mesh.Faces.AddFace(i * y_count + j, (i + 1) * y_count + j, (i + 1) * y_count + (j + 1), i * y_count + (j + 1))
    
    return mesh

def limit_points(x_count, step):
    x_limit_points = []
    y_limit_points = []
    diag_limit_points = []
    
    for i in range(1, x_count):
        x = i * step
        y = i * step
        
        # Point along x-axis
        xz = 1.0 / (x ** 2 + 1)
        x_limit_points.append(rg.Point3d(x, 0, xz))
        
        # Point along y-axis
        yz = 1.0 / (y ** 2 + 1)
        y_limit_points.append(rg.Point3d(0, y, yz))
        
        # Point along the line y = x
        diagz = 1.0 / (x ** 2 + y ** 2 + 1)
        diag_limit_points.append(rg.Point3d(x, y, diagz))
        
    return x_limit_points, y_limit_points, diag_limit_points

# Mesh settings
x_count = 20
y_count = 20
step = 0.5

# Create the mesh and limit points
A = create_mesh(x_count, y_count, step)
B, C, D = limit_points(x_count, step)
# ---------- end limits ----------
geometry = Geometry(limits.A)  # disabled
geometry_2 = Geometry(limits.B)  # disabled
geometry_3 = Geometry(limits.C)  # disabled
geometry_4 = Geometry(limits.D)  # disabled
# Learn Single-Variable Calculus
# with Python in Grasshopper
# at Wickerson Studios
# 001 Functions, Limits,
# and Continuity
panel_3 = Panel(limits.out)  # disabled
limits_2 = Script(
    x_count=number_slider_3,
    y_count=number_slider_3,
    step=number_slider_2,
    a=Slider(0, range=-3..3),
    b=Slider(-1.95, range=-3..3),
    c=Slider(0.38, range=-3..3))  # -> out, A, B, C, D; inputs x_count: Int32, y_count: Int32, step: Double
# ---------- limits_2: Python ----------
import Rhino.Geometry as rg
import numpy as np
import math

def create_mesh(x_count, y_count, step, a, b, c):
    mesh = rg.Mesh()
    
    for i in range(x_count):
        for j in range(y_count):
            x = i * step
            y = j * step
            
            # Parametric trigonometric polynomial
            z = a * np.cos(b * (x ** 2 + y ** 2)) + c * np.sin(x * y) + 1.0 / (x ** 2 + y ** 2 + 1)
            
            mesh.Vertices.Add(x, y, z)
            
    for i in range(x_count - 1):
        for j in range(y_count - 1):
            mesh.Faces.AddFace(i * y_count + j, (i + 1) * y_count + j, (i + 1) * y_count + (j + 1), i * y_count + (j + 1))
            
    return mesh

def limit_points(x_count, step, a, b, c):
    x_limit_points = []
    y_limit_points = []
    diag_limit_points = []
    
    for i in range(1, x_count):
        x = i * step
        y = i * step
        
        # Points using the parametric function
        xz = a * np.cos(b * x ** 2) + c * 1.0 / (x ** 2 + 1)
        x_limit_points.append(rg.Point3d(x, 0, xz))
        
        yz = a * np.cos(b * y ** 2) + c * 1.0 / (y ** 2 + 1)
        y_limit_points.append(rg.Point3d(0, y, yz))
        
        diagz = a * np.cos(b * (x ** 2 + y ** 2)) + c * np.sin(x * y) + 1.0 / (x ** 2 + y ** 2 + 1)
        diag_limit_points.append(rg.Point3d(x, y, diagz))
        
    return x_limit_points, y_limit_points, diag_limit_points

# Parameters (These will be inputs in your Grasshopper script)
"""
x_count = 50  # Integer: Increased for better resolution
y_count = 50  # Integer: Increased for better resolution
step = 0.2    # Float: Smaller step for better resolution
a = 1.0       # Float: Parameter for cosine term
b = 1.0       # Float: Parameter for the exponent in the cosine term
c = 1.0       # Float: Parameter for sine term
"""

# Create the mesh and limit points
A = create_mesh(x_count, y_count, step, a, b, c)
B, C, D = limit_points(x_count, step, a, b, c)
# ---------- end limits_2 ----------
entwine = Entwine(Branch00=geometry, Branch01=geometry_2, Branch02=geometry_3, Branch03=geometry_4, FlattenInputs=True)  # disabled
geometry_5 = Geometry(limits_2.D)
geometry_6 = Geometry(limits_2.A)
geometry_7 = Geometry(limits_2.B)
geometry_8 = Geometry(limits_2.C)
panel_4 = Panel(limits_2.out)
panel_5 = Panel(entwine)  # disabled
entwine_2 = Entwine(Branch00=geometry_6, Branch01=geometry_7, Branch02=geometry_8, Branch03=geometry_5, FlattenInputs=True)
panel_6 = Panel(entwine_2)
