# Grasshopper definition 008_One-Sided_Limit.gh (Grasshopper 1.0.7)
# plug-ins: RhinoCodePluginGH

# ----
# Oscillation Algorithm
# The oscillation algorithm can be use to animate
# any geometry that is driven by a number sliders.
# Simply swap out the number sliders at the
# multiplication node in the oscillation script.
trigger = Trigger(Interval=20, TimerInterval=20, Target=data_recorder)  # disabled
panel = Panel("1")  # disabled
data_recorder = DataRecorder(panel, DataLimit=-10, RecordData=False)  # disabled
number_slider = Slider(56, range=0..1000)  # disabled
list_length = ListLength(List=data_recorder)  # disabled
division = Division(A=list_length, B=number_slider)  # disabled
cosine = Cosine(Value=division)  # disabled
sine = Sine(Value=division)  # disabled
panel_2 = Panel([sine, cosine])  # disabled

# ----
# ADVANCED
# Creating a 3D model that visually demonstrates
# one-sided limits involves some steps:
# 
# Define the function for which you want to show
# one-sided limits. This function should be 3D to
# take advantage of Rhino's capabilities.
# Use Rhino's Python API to create the geometry
# based on the function.
# Add annotations or additional geometry to
# indicate one-sided limits.
# Separate different parts of the model into
# different variable outputs in the Python node in
# Grasshopper.
# 
# Certainly! Below is a Python script for use in
# Grasshopper for Rhino 8 WIP. This script
# produces a more complex 3D surface model
# using NumPy and trigonometric polynomials.
# The function z = f(x, y) is now a complex
# trigonometric polynomial, incorporating sine,
# cosine, and other trigonometric terms for added
# complexity. NumPy is used to make array
# manipulations more efficient.
# PARAMETRIC
number_slider_2 = Slider(-1, range=-1..1)
# gpt-4 Text Prompt
# Create a geometric 3D model with
# 
# Single-Variable Calculus
# Functions, Limits, and Continuity
# Extension of the Limit Concept
# 
# to create a 3D model specifically about
# 
# One-Sided Limits
# 
# 
# in python 3 code for the python 3 script
# node in grasshopper for Rhino8WIP using the
# 
# Rhino Common API to create some geometry as well.
# 
# Output the parts of the model in different
# variable outputs in the python 3 node in
# grasshopper.
# 001 Functions, Limits,
# and Continuity
# 006 Extention of the Limit Concept
# 2nd gpt-4 Text Prompt
# 008 One-Sided Limits
# Great, now make the script much more complex model
# with complex trigonometric polynomials and the
# NUMPY python library. Be sure to incorporate the previous code logic.
# ensure that this script produces 3d geometry as
# well for Data visualization purposes.
# gpt-4 Initial Response
one_sided_limits = Script()  # -> out, output_surface, output_annotations; disabled
# ---------- one_sided_limits: Python ----------
import Rhino.Geometry as rg
import numpy as np
import math

# Complex trigonometric polynomial function z = f(x,y)
def function(x, y):
    if x > 1 and y > 1:
        return 2
    elif x < -1 and y < -1:
        return -2
    else:
        return np.sin(x) * np.cos(y) + np.sin(2*x) * np.cos(2*y) + np.sin(3*x) * np.cos(3*y)

# Create the complex surface using the function
def create_surface(x_range, y_range, step_size):
    points = []
    u_count = 0
    for x in np.arange(x_range[0], x_range[1], step_size):
        u_count += 1
        for y in np.arange(y_range[0], y_range[1], step_size):
            z = function(x, y)
            pt = rg.Point3d(x * 10, y * 10, z * 10)
            points.append(pt)
    
    v_count = int(len(points) / u_count)
    
    return rg.NurbsSurface.CreateFromPoints(points, u_count, v_count, 3, 3)

# Create annotations for one-sided limits
def create_annotations():
    texts = []
    pt1 = rg.Point3d(10, 10, 20)
    pt2 = rg.Point3d(-10, -10, -20)
    texts.append(rg.TextDot("Limit: 2", pt1))
    texts.append(rg.TextDot("Limit: -2", pt2))
    return texts

# Main execution
surface = create_surface([-1, 1], [-1, 1], 0.1)
annotations = create_annotations()

# Debug: Print annotations to ensure they are created
if annotations:
    for annotation in annotations:
        print("Created annotation with text: ", annotation.Text)

# Output to Grasshopper components
output_surface = surface
output_annotations = annotations
# ---------- end one_sided_limits ----------
geometry = Geometry(one_sided_limits.output_surface)  # disabled
# Learn Single-Variable Calculus
# with Python in Grasshopper
# at Wickerson Studios
panel_3 = Panel(one_sided_limits.out)  # disabled
entwine = Entwine(Branch00=geometry, Branch01=one_sided_limits.output_annotations, FlattenInputs=True)  # disabled
one_sided_limits_2 = Script(
    x_range=[number_slider_2, Slider(1, range=-1..1)],
    y_range=[Slider(-0.2, range=-1..1), Slider(1, range=-1..1)],
    step_size=Slider(0.1, range=0..1),
    amp1=Slider(0.79, range=0..1),
    freq1=Slider(1, range=0..1),
    phase1=Slider(0.33, range=0..1),
    amp2=Slider(1, range=0..1),
    freq2=Slider(2, range=0..2),
    phase2=Slider(0, range=0..1))  # -> out, output_surface; inputs x_range: list of Double, y_range: list of Double, step_size: Double, amp1: Double, freq1: Double, phase1: Double, amp2: Double, freq2: Double, phase2: Double
# ---------- one_sided_limits_2: Python ----------
import Rhino.Geometry as rg
import numpy as np
import math

# Function to generate a point based on a complex trigonometric function z = f(x,y)
def function(x, y, amp1=1, freq1=1, phase1=0, amp2=1, freq2=2, phase2=0):
    if x > 1 and y > 1:
        return 2
    elif x < -1 and y < -1:
        return -2
    else:
        term1 = amp1 * np.sin(freq1 * x + phase1) * np.cos(freq1 * y + phase1)
        term2 = amp2 * np.sin(freq2 * x + phase2) * np.cos(freq2 * y + phase2)
        return term1 + term2

# Create a surface using the function
def create_surface(x_range, y_range, step_size, function_params):
    points = []
    u_count = 0
    for x in np.arange(x_range[0], x_range[1], step_size):
        u_count += 1
        for y in np.arange(y_range[0], y_range[1], step_size):
            z = function(x, y, *function_params)
            pt = rg.Point3d(x * 10, y * 10, z * 10)
            points.append(pt)
    
    v_count = int(len(points) / u_count)
    
    return rg.NurbsSurface.CreateFromPoints(points, u_count, v_count, 3, 3)

# Main execution
function_params = (amp1, freq1, phase1, amp2, freq2, phase2)  # (amp1, freq1, phase1, amp2, freq2, phase2)
surface = create_surface(x_range, y_range, step_size, function_params)

# Output to Grasshopper components
output_surface = surface
# ---------- end one_sided_limits_2 ----------
panel_4 = Panel(entwine)  # disabled
geometry_2 = Geometry(one_sided_limits_2.output_surface)
panel_5 = Panel(one_sided_limits_2.out)
entwine_2 = Entwine(Branch00=geometry_2, FlattenInputs=True)
panel_6 = Panel(entwine_2)
