# Grasshopper definition 009_Limits_at_Infinity.gh (Grasshopper 1.0.7)
# plug-ins: RhinoCodePluginGH

# ----
# Oscillation Algorithm
# The oscillation algorithm can be use to animate
# any geometry that is driven by a number sliders.
# Simply swap out the number sliders at the
# multiplication node in the oscillation script.
trigger = Trigger(Interval=20, TimerInterval=20, Target=data_recorder)  # disabled
# 2nd gpt-4 Text Prompt
panel = Panel("1")  # disabled
data_recorder = DataRecorder(panel, DataLimit=-10, RecordData=False)  # disabled
number_slider = Slider(56, range=0..1000)  # disabled
# Great, now make the script much more complex model
# with complex trigonometric polynomials and the
# NUMPY python library. Be sure to incorporate the previous code logic.
# ensure that this script produces 3d geometry as
# well for Data visualization purposes.
# gpt-4 Initial Response
# Creating a 3D model to visualize "Limits at
# Infinity" using Python, Rhino 8 WIP (Work in
# Progress), and Grasshopper is a rather specific
# task. Below is a Python 3 script that could serve
# as a starting point for the Python 3 node in
# Grasshopper. The script makes use of Rhino
# Common API to generate a geometric 3Dmodel
# of the function
# 
# f(x)= 1/x
# 
# ​which demonstrates the concept of "Limits at Infinity".
list_length = ListLength(List=data_recorder)  # disabled
division = Division(A=list_length, B=number_slider)  # disabled
cosine = Cosine(Value=division)  # disabled
sine = Sine(Value=division)  # disabled
panel_2 = Panel([sine, cosine])  # disabled

# ----
# PARAMETRIC
number_slider_2 = Slider(0.04, range=0..1)
# gpt-4 Text Prompt
# Learn Single-Variable Calculus
# with Python in Grasshopper
# at Wickerson Studios
# Create a geometric 3D model with
# 
# Single-Variable Calculus
# Functions, Limits, and Continuity
# Extension of the Limit Concept
# 
# to create a 3D model specifically about
# 
# Limits at Infinity
# 
# 
# in python 3 code for the python 3 script
# node in grasshopper for Rhino8WIP using the
# 
# Rhino Common API to create some geometry as well.
# 
# Output the parts of the model in different
# variable outputs in the python 3 node in
# grasshopper.
# 001 Functions, Limits,
# and Continuity
# 006 Extention of the Limit Concept
# 009 Limits at Infinity
# ADVANCED
limits_at_infinity = Script()  # -> out, a, b, c; disabled
# ---------- limits_at_infinity: Python ----------
import Rhino.Geometry as rg
import math

def create_curve(f, start, end, step):
    points = []
    for x in range(int(start * 10), int(end * 10), int(step * 10)):
        x = x / 10.0
        y = f(x)
        if y is not None:
            points.append(rg.Point3d(x, y, 0))
    return rg.PolylineCurve(points)

def create_surface(curve1, curve2):
    return rg.Brep.CreateFromLoft([curve1, curve2], rg.Point3d.Unset, rg.Point3d.Unset, rg.LoftType.Normal, False)[0]

def func(x):
    try:
        return 1 / x
    except:
        return None

# Generate the curves
curve1 = create_curve(func, 0.1, 10, 0.1)
curve2 = create_curve(func, -10, -0.1, 0.1)

# Generate the surface between the curves
surface = create_surface(curve1, curve2)

# Output the curves and the surface
a = curve1
b = curve2
c = surface
# ---------- end limits_at_infinity ----------
limits_at_infinity_2 = Script()  # -> out, a, b, c, d; disabled
# ---------- limits_at_infinity_2: Python ----------
import Rhino.Geometry as rg
import numpy as np
import math

def create_curve(f, start, end, step):
    points = []
    for x in np.arange(start, end, step):
        y = f(x)
        if y is not None:
            points.append(rg.Point3d(x, y, 0))
    return rg.PolylineCurve(points)

def create_surface(curve1, curve2):
    return rg.Brep.CreateFromLoft([curve1, curve2], rg.Point3d.Unset, rg.Point3d.Unset, rg.LoftType.Normal, False)[0]

def create_3d_surface(f, x_start, x_end, y_start, y_end, step):
    point_list = []
    for x in np.arange(x_start, x_end, step):
        for y in np.arange(y_start, y_end, step):
            z = f(x, y)
            if z is not None:
                point_list.append(rg.Point3d(x, y, z))

    if len(point_list) == 0:
        return None

    return rg.NurbsSurface.CreateFromPoints(point_list, int((x_end-x_start)/step), int((y_end-y_start)/step), 3, 3)

def complex_func(x):
    try:
        return (np.sin(x**2) + np.cos(x)) / x
    except:
        return None

def complex_3d_func(x, y):
    try:
        return np.sin(x) * np.cos(y) + np.sin(x * y)
    except:
        return None

# Generate the curves
curve1 = create_curve(complex_func, 0.1, 10, 0.1)
curve2 = create_curve(complex_func, -10, -0.1, 0.1)

# Generate the 3D surface
surface_3d = create_3d_surface(complex_3d_func, -5, 5, -5, 5, 0.2)

# Generate the surface between the curves
surface_between_curves = create_surface(curve1, curve2)

# Output the curves and the surfaces
a = curve1
b = curve2
c = surface_between_curves
d = surface_3d
# ---------- end limits_at_infinity_2 ----------
geometry = Geometry(limits_at_infinity_2.a)  # disabled
geometry_2 = Geometry(limits_at_infinity_2.d)  # disabled
geometry_3 = Geometry(limits_at_infinity_2.b)  # disabled
geometry_4 = Geometry(limits_at_infinity_2.c)  # disabled
geometry_5 = Geometry(limits_at_infinity.a)  # disabled
geometry_6 = Geometry(limits_at_infinity.c)  # disabled
limits_at_infinity_3 = Script(
    x_start=number_slider_2,
    x_end=Slider(10, range=0..10),
    y_start=Slider(-5, range=-5..5),
    y_end=Slider(5, range=-5..5),
    step=Slider(0.2, range=0..1))  # -> out, a, b, c, d; inputs x_start: Double, x_end: Double, y_start: Double, y_end: Double, step: Double
# ---------- limits_at_infinity_3: Python ----------
import Rhino.Geometry as rg
import numpy as np
import math

def create_curve(f, start, end, step):
    points = []
    for x in np.arange(start, end, step):
        y = f(x)
        if y is not None:
            points.append(rg.Point3d(x, y, 0))
    return rg.PolylineCurve(points)

def create_surface(curve1, curve2):
    return rg.Brep.CreateFromLoft([curve1, curve2], rg.Point3d.Unset, rg.Point3d.Unset, rg.LoftType.Normal, False)[0]

def create_3d_surface(f, x_start, x_end, y_start, y_end, step):
    point_list = []
    uCount = 0
    vCount = 0
    for x in np.arange(x_start, x_end, step):
        vCount = 0
        for y in np.arange(y_start, y_end, step):
            z = f(x, y)
            if z is not None:
                point_list.append(rg.Point3d(x, y, z))
                vCount += 1
        if vCount > 0:
            uCount += 1

    if len(point_list) == 0 or uCount < 2 or vCount < 2:
        return None

    return rg.NurbsSurface.CreateFromPoints(point_list, uCount, vCount, 3, 3)

# Define your complex functions here
def complex_func(x):
    return (np.sin(x**2) + np.cos(x)) / x

def complex_3d_func(x, y):
    return np.sin(x) * np.cos(y) + np.sin(x * y)

# Inputs from Grasshopper
"""
x_start = 0.1  # float
x_end = 10.0   # float
y_start = -5.0 # float
y_end = 5.0   # float
step = 0.2     # float
"""

# Generate curves and surfaces
curve1 = create_curve(complex_func, x_start, x_end, step)
curve2 = create_curve(complex_func, -x_end, -x_start, step)
surface_3d = create_3d_surface(complex_3d_func, x_start, x_end, y_start, y_end, step)
surface_between_curves = create_surface(curve1, curve2)

# Output variables
a = curve1
b = curve2
c = surface_between_curves
d = surface_3d
# ---------- end limits_at_infinity_3 ----------
geometry_7 = Geometry(limits_at_infinity.b)  # disabled
panel_3 = Panel(limits_at_infinity.out)  # disabled
entwine = Entwine(Branch00=geometry, Branch01=geometry_3, Branch02=geometry_4, Branch03=geometry_2, FlattenInputs=True)  # disabled
panel_4 = Panel(limits_at_infinity_2.out)  # disabled
entwine_2 = Entwine(Branch00=geometry_5, Branch01=geometry_7, Branch02=geometry_6, FlattenInputs=True)  # disabled
geometry_8 = Geometry(limits_at_infinity_3.a)
geometry_9 = Geometry(limits_at_infinity_3.b)
geometry_10 = Geometry(limits_at_infinity_3.c)
geometry_11 = Geometry(limits_at_infinity_3.d)
entwine_3 = Entwine(Branch00=geometry_8, Branch01=geometry_9, Branch02=geometry_10, Branch03=geometry_11, FlattenInputs=True)
panel_5 = Panel(limits_at_infinity_3.out)
panel_6 = Panel(entwine_2)  # disabled
panel_7 = Panel(entwine)  # disabled
panel_8 = Panel(entwine_3)
