# Grasshopper definition 010_Infinite_Limits.gh (Grasshopper 1.0.7)
# plug-ins: RhinoCodePluginGH, MeshEdit Components

# ----
# Oscillation Algorithm
# The oscillation algorithm can be use to animate
# any geometry that is driven by a number sliders.
# Simply swap out the number sliders at the
# multiplication node in the oscillation script.
trigger = Trigger(Interval=20, TimerInterval=20, Target=data_recorder)  # disabled
panel = Panel("1")  # disabled
data_recorder = DataRecorder(panel, DataLimit=-10, RecordData=False)  # disabled
number_slider = Slider(56, range=0..1000)  # disabled
# Creating a 3D model about Infinite Limits using
# Python, Grasshopper, and Rhino Common API
# requires you to follow several steps. Below is a
# general approach to create a 3D model in the
# Python node in Grasshopper for Rhino 8 WIP.
# 
# Understand the Concepts: Understand the
# mathematical concepts of Single-Variable
# Calculus, Functions, Limits, and Continuity, and
# the Extension of the Limit Concept. An infinite
# limit refers to the behavior of a function as it
# approaches infinity or as the input of the
# function approaches infinity. This concept can
# be used to create shapes or geometries that
# infinitely approach a certain boundary but never
# touch it.
list_length = ListLength(List=data_recorder)  # disabled
division = Division(A=list_length, B=number_slider)  # disabled
cosine = Cosine(Value=division)  # disabled
sine = Sine(Value=division)  # disabled
panel_2 = Panel([sine, cosine])  # disabled

# ----
# ADVANCED
# PARAMETRIC
# z = 1.0 / (x**2 + y**2 + math.sin(x)**2 + math.cos(y)**2)
number_slider_2 = Slider(10, range=0..10)
number_slider_3 = Slider(100, range=0..100)  # disabled
infinite_limits = Script()  # -> out, A, B; disabled
# ---------- infinite_limits: Python ----------
import Rhino
import Rhino.Geometry as rg
import math

def create_infinite_limit_surface(x_range, y_range, num_points):
    points = []
    for i in range(num_points):
        for j in range(num_points):
            x = i * x_range / (num_points - 1) - x_range / 2.0
            y = j * y_range / (num_points - 1) - y_range / 2.0
            
            if x == 0 and y == 0:
                continue  # Avoid the center point to prevent division by zero
            
            z = 1.0 / (x**2 + y**2)
            
            point = rg.Point3d(x, y, z)
            points.append(point)
            
    return points

# Parameters for the surface
x_range = 10.0
y_range = 10.0
num_points = 100

# Create the points
points = create_infinite_limit_surface(x_range, y_range, num_points)

# Create a mesh from the points (for better visualization)
mesh = rg.Mesh()

for point in points:
    mesh.Vertices.Add(point)

# Output
A = points
B = mesh
# ---------- end infinite_limits ----------
# gpt-4 Text Prompt
# Learn Single-Variable Calculus
# with Python in Grasshopper
# at Wickerson Studios
# Create a geometric 3D model with
# 
# Single-Variable Calculus
# Functions, Limits, and Continuity
# Extension of the Limit Concept
# 
# to create a 3D model specifically about
# 
# Infinite Limits
# 
# 
# in python 3 code for the python 3 script
# node in grasshopper for Rhino8WIP using the
# 
# Rhino Common API to create some geometry as well.
# 
# Output the parts of the model in different
# variable outputs in the python 3 node in
# grasshopper.
# 001 Functions, Limits,
# and Continuity
# 006 Extention of the Limit Concept
# 2nd gpt-4 Text Prompt
# 010 Infinite Limits
# Great, now make the script much more complex model
# with complex trigonometric polynomials and the
# NUMPY python library. Be sure to incorporate the previous code logic.
# ensure that this script produces 3d geometry as
# well for Data visualization purposes.
# gpt-4 Initial Response
infinite_limits_2 = Script()  # -> out, A; disabled
# ---------- infinite_limits_2: Python ----------
import Rhino
import math

def create_infinite_spiral(a, b, c, num_points):
    points = []
    for i in range(num_points):
        theta = i * math.pi / 180
        x = a * math.cos(theta)
        y = b * math.sin(theta)
        z = c * theta
        points.append(Rhino.Geometry.Point3d(x, y, z))
    return points

# Parameters
a = 1  # x coefficient
b = 1  # y coefficient
c = 0.1  # z coefficient
num_points = 1000  # number of points

points = create_infinite_spiral(a, b, c, num_points)

# Output
A = points
# ---------- end infinite_limits_2 ----------
panel_3 = Panel(infinite_limits.out)  # disabled
geometry = Geometry(infinite_limits.A)  # disabled
geometry_2 = Geometry(infinite_limits.B)  # disabled
geometry_3 = Geometry(infinite_limits_2.A)  # disabled
panel_4 = Panel(infinite_limits_2.out)  # disabled
infinite_limits_3 = Script(
    x_range=number_slider_2,
    y_range=Slider(10, range=0..10),
    num_points=Slider(100, range=0..100),
    sin_coeff=Slider(1, range=0..1),
    cos_coeff=Slider(0.34, range=0..1),
    power_x=Slider(3, range=0..10),
    power_y=Slider(2, range=0..10))  # -> out, A, B; inputs x_range: Double, y_range: Double, num_points: Int32, sin_coeff: Double, cos_coeff: Double, power_x: Double, power_y: Double
# ---------- infinite_limits_3: Python ----------
import Rhino.Geometry as rg
import numpy as np
import math

def create_parametric_infinite_limit_surface(x_range, y_range, num_points, sin_coeff, cos_coeff, power_x, power_y):
    points = []
    mesh = rg.Mesh()
    
    x_vals = np.linspace(-x_range / 2, x_range / 2, num_points)
    y_vals = np.linspace(-y_range / 2, y_range / 2, num_points)
    
    for x in x_vals:
        for y in y_vals:
            if x == 0 and y == 0:
                continue  # Avoid the center point to prevent division by zero
            
            z = 1.0 / (x ** power_x + y ** power_y + sin_coeff * math.sin(x) ** 2 + cos_coeff * math.cos(y) ** 2)
            
            point = rg.Point3d(x, y, z)
            points.append(point)
            mesh.Vertices.Add(point)
            
    # Create mesh faces
    for i in range(num_points - 1):
        for j in range(num_points - 1):
            if i == num_points // 2 or j == num_points // 2:
                continue  # Skip the center row and column
            idx1 = i * num_points + j
            idx2 = (i + 1) * num_points + j
            idx3 = (i + 1) * num_points + (j + 1)
            idx4 = i * num_points + (j + 1)
            mesh.Faces.AddFace(idx1, idx2, idx3, idx4)
            
    return points, mesh

# Suggested input values
"""
x_range = 10.0  # float
y_range = 10.0  # float
num_points = 100  # int
sin_coeff = 1.0  # float
cos_coeff = 1.0  # float
power_x = 2.0  # float
power_y = 2.0  # float
"""

# Create the points and mesh
points, mesh = create_parametric_infinite_limit_surface(x_range, y_range, num_points, sin_coeff, cos_coeff, power_x, power_y)

# Output
A = points
B = mesh
# ---------- end infinite_limits_3 ----------
mesh_frompoints = MeshFromPoints(Points=geometry, UDirection=number_slider_3, VDirection=number_slider_3)  # disabled
entwine = Entwine(Branch00=geometry, Branch01=geometry_2, FlattenInputs=True)  # disabled
entwine_2 = Entwine(Branch00=geometry_3, FlattenInputs=True)  # disabled
panel_5 = Panel(entwine)  # disabled
panel_6 = Panel(entwine_2)  # disabled
geometry_4 = Geometry(infinite_limits_3.A)
panel_7 = Panel(infinite_limits_3.out)
geometry_5 = Geometry(infinite_limits_3.B)
entwine_3 = Entwine(Branch00=geometry_4, Branch01=geometry_5, FlattenInputs=True)
panel_8 = Panel(entwine_3)
