# Grasshopper definition 011_Continuity.gh (Grasshopper 1.0.7)
# plug-ins: RhinoCodePluginGH

# ----
# Oscillation Algorithm
# The oscillation algorithm can be use to animate
# any geometry that is driven by a number sliders.
# Simply swap out the number sliders at the
# multiplication node in the oscillation script.
trigger = Trigger(Interval=20, TimerInterval=20, Target=data_recorder)  # disabled
# 2nd gpt-4 Text Prompt
# Great, now make the script much more complex model
# with complex trigonometric polynomials and the
# NUMPY python library. Be sure to incorporate the previous code logic.
# ensure that this script produces 3d geometry as
# well for Data visualization purposes.
panel = Panel("1")  # disabled
data_recorder = DataRecorder(panel, DataLimit=-10, RecordData=False)  # disabled
number_slider = Slider(56, range=0..1000)  # disabled
# gpt-4 Initial Response
# Creating a 3D model using the Rhino Common
# API in Grasshopper to illustrate the concept of
# "Continuity" can be an interesting project. Let's
# consider a simple case of generating two
# continuous curves in 3D space to exemplify the
# concept of continuity. These curves will join
# smoothly at a single point, demonstrating
# geometric continuity.
list_length = ListLength(List=data_recorder)  # disabled
division = Division(A=list_length, B=number_slider)  # disabled
cosine = Cosine(Value=division)  # disabled
sine = Sine(Value=division)  # disabled
panel_2 = Panel([sine, cosine])  # disabled

# ----
# ADVANCED
# PARAMETRIC
# A * np.sin(B * x + C) + D * np.cos(E * x + F)
number_slider_2 = Slider(20, range=5..20)
# gpt-4 Text Prompt
# Create a geometric 3D model with
# 
# Single-Variable Calculus
# Functions, Limits, and Continuity
# Continuity
# 
# to create a 3D model specifically about
# 
# Continuity
# 
# 
# in python 3 code for the python 3 script
# node in grasshopper for Rhino8WIP using the
# 
# Rhino Common API to create some geometry as well.
# 
# Output the parts of the model in different
# variable outputs in the python 3 node in
# grasshopper.
# 001 Functions, Limits,
# and Continuity
# 007 Continuity
# 011 Continuity
continuity = Script()  # -> out, a, b, c; disabled
# ---------- continuity: Python ----------
import Rhino.Geometry as rg
import math

def create_curve(start_point, end_point, control_points):
    points = [start_point] + control_points + [end_point]
    curve = rg.Curve.CreateInterpolatedCurve(points, 3)
    return curve

def main():
    # Define start and end points for the first curve
    start1 = rg.Point3d(0, 0, 0)
    end1 = rg.Point3d(10, 0, 0)

    # Define some control points for curve 1
    control_points1 = [rg.Point3d(x, math.sin(x), math.cos(x)) for x in range(1, 10)]

    curve1 = create_curve(start1, end1, control_points1)

    # Define start and end points for the second curve
    start2 = end1  # This ensures G0 continuity (Positional)
    end2 = rg.Point3d(20, 0, 0)

    # Define some control points for curve 2
    control_points2 = [rg.Point3d(x + 10, 2*math.sin(x), 2*math.cos(x)) for x in range(1, 10)]

    curve2 = create_curve(start2, end2, control_points2)

    # Attempt to make the transition smooth to get G1 continuity
    joined_curves = rg.Curve.JoinCurves([curve1, curve2])

    # Check if the curves were joined
    if len(joined_curves) > 0:
        joined_curve = joined_curves[0]
    else:
        joined_curve = None

    return curve1, curve2, joined_curve

# Call main function and assign outputs
curve1, curve2, joined_curve = main()

# Output the parts of the model in different variable outputs in Grasshopper
a = curve1
b = curve2
c = joined_curve
# ---------- end continuity ----------
geometry = Geometry(continuity.a)  # disabled
geometry_2 = Geometry(continuity.b)  # disabled
geometry_3 = Geometry(continuity.c)  # disabled
# Learn Single-Variable Calculus
# with Python in Grasshopper
# at Wickerson Studios
panel_3 = Panel(continuity.out)
continuity_2 = Script(
    num_points=Slider(50, range=50..200),
    curve_length=number_slider_2,
    params1=[Slider(-0.1, range=-5..5), Slider(1.87, range=-5..5), Slider(5, range=-5..5), Slider(-0.65, range=-5..5), Slider(1.46, range=-5..5), Slider(-1.53, range=-5..5)],
    params2=[Slider(0.98, range=-5..5), Slider(-1.06, range=-5..5), Slider(-0.58, range=-5..5), Slider(-1.36, range=-5..5), Slider(-1.6, range=-5..5), Slider(-0.72, range=-5..5)])  # -> out, a, b, c; inputs num_points: Int32, curve_length: Double, params1: list of Double, params2: list of Double
# ---------- continuity_2: Python ----------
import Rhino.Geometry as rg
import numpy as np

def complex_trig_poly(x, params):
    A, B, C, D, E, F = params
    return A * np.sin(B * x + C) + D * np.cos(E * x + F)

def create_curve(start_point, end_point, control_points_func, num_points=100):
    points = [start_point]
    for i in np.linspace(start_point.X, end_point.X, num_points):
        x = i
        y, z = control_points_func(x)
        points.append(rg.Point3d(x, y, z))
    points.append(end_point)
    curve = rg.Curve.CreateInterpolatedCurve(points, 3)
    return curve

def main(num_points, curve_length, params1, params2):
    # Curve 1
    start1 = rg.Point3d(0, 0, 0)
    end1 = rg.Point3d(curve_length, 0, 0)
    control_func1 = lambda x: (complex_trig_poly(x, params1), complex_trig_poly(x, [p*0.5 for p in params1]))
    curve1 = create_curve(start1, end1, control_func1, num_points)
    
    # Curve 2
    start2 = end1
    end2 = rg.Point3d(2 * curve_length, 0, 0)
    control_func2 = lambda x: (complex_trig_poly(x-curve_length, params2), complex_trig_poly(x-curve_length, [p*0.5 for p in params2]))
    curve2 = create_curve(start2, end2, control_func2, num_points)

    # Join curves to aim for G1 continuity
    joined_curves = rg.Curve.JoinCurves([curve1, curve2])

    # Check if the curves were successfully joined
    if len(joined_curves) > 0:
        joined_curve = joined_curves[0]
    else:
        joined_curve = None

    return curve1, curve2, joined_curve

# Define your parametric inputs here
"""
num_points = 100  # int
curve_length = 10.0  # float
params1 = [1, 0.5, 0, 1, 0.5, 0]  # list of floats
params2 = [1, 1.5, 0, 1, 1.5, 0]  # list of floats
"""

# Call main function and assign outputs
curve1, curve2, joined_curve = main(num_points, curve_length, params1, params2)

# Output the parts of the model in different variable outputs in Grasshopper
a = curve1
b = curve2
c = joined_curve
# ---------- end continuity_2 ----------
entwine = Entwine(Branch00=geometry, Branch01=geometry_2, Branch02=geometry_3, FlattenInputs=True)  # disabled
panel_4 = Panel(continuity_2.out)
geometry_4 = Geometry(continuity_2.a)
geometry_5 = Geometry(continuity_2.b)
geometry_6 = Geometry(continuity_2.c)
panel_5 = Panel(entwine)  # disabled
entwine_2 = Entwine(Branch00=geometry_4, Branch01=geometry_5, Branch02=geometry_6, FlattenInputs=True)
panel_6 = Panel(entwine_2)
