# Grasshopper definition 012_Normals.gh (Grasshopper 1.0.7)
# plug-ins: RhinoCodePluginGH

# ----
# Oscillation Algorithm
# The oscillation algorithm can be use to animate
# any geometry that is driven by a number sliders.
# Simply swap out the number sliders at the
# multiplication node in the oscillation script.
trigger = Trigger(Interval=20, TimerInterval=20, Target=data_recorder)  # disabled
panel = Panel("1")  # disabled
data_recorder = DataRecorder(panel, DataLimit=-10, RecordData=False)  # disabled
number_slider = Slider(47, range=0..1000)  # disabled
list_length = ListLength(List=data_recorder)  # disabled
division = Division(A=list_length, B=number_slider)  # disabled
cosine = Cosine(Value=division)  # disabled
sine = Sine(Value=division)  # disabled
panel_2 = Panel([sine, cosine])  # disabled

# ----
# gpt-4 Text Prompt
# Create a geometric 3D model with
# 
# Single-Variable Calculus
# Differentiation
# Tangent Lines and Slope
# 
# to create a 3D model specifically about
# 
# Normals
# 
# 
# in python 3 code for the python 3 script
# node in grasshopper for Rhino8WIP using the
# 
# Rhino Common API to create some geometry as well.
# 
# Output the parts of the model in different
# variable outputs in the python 3 node in
# grasshopper.
# 002 DIFFERENTIATION
# 001 Tangent Line and Slope
# 012 Tangents
# 2nd gpt-4 Text Prompt
# ADVANCED
# Great, now make the script much more complex model
# with complex trigonometric polynomials and the
# NUMPY python library. Be sure to incorporate the previous code logic.
# ensure that this script produces 3d geometry as
# well for Data visualization purposes.
# gpt-4 Initial Response
# Creating a Python script that integrates with
# Grasshopper for Rhino 8WIP requires a detailed
#  understanding of both Python and Rhino's
# Common API. The example below demonstrates
#  how to create a 3D geometric model that
# focuses on the normal vectors of a surface
# described by a function
# 
# z=f(x,y). Here, the function
# 
# f(x,y)=x ^2+y^2
# is used as an example. The script will:
# 
# Create a mesh to represent the surface
# z=f(x,y)
# Compute the tangent planes and normal
# vectors at a few sample points
# Output the geometry using Rhino's Common API
normals = Script()  # -> out, outMesh, outNormals, outPlanes; disabled
# ---------- normals: Python ----------
import Rhino
import Rhino.Geometry as rg
import math

# Function to compute z based on x and y
def f(x, y):
    return x**2 + y**2

# Function to compute the partial derivatives and normal vector at point (x, y)
def derivatives_and_normal(x, y):
    # Partial derivatives (using the formulas for df/dx and df/dy)
    df_dx = 2 * x
    df_dy = 2 * y
    
    # Normal vector (formula derived from the gradient)
    normal = rg.Vector3d(-df_dx, -df_dy, 1)
    normal.Unitize()  # make it a unit vector
    
    return df_dx, df_dy, normal

# Create mesh to represent the surface z = f(x, y)
mesh = rg.Mesh()
for i in range(-10, 11):
    for j in range(-10, 11):
        x, y = 0.1 * i, 0.1 * j
        z = f(x, y)
        mesh.Vertices.Add(x, y, z)

# Compute mesh faces
for i in range(20):
    for j in range(20):
        mesh.Faces.AddFace(i + j*21, i + 1 + j*21, i + 1 + (j+1)*21, i + (j+1)*21)

# Compute normals and tangent planes at some sample points
normals = []
planes = []
sample_points = [(0.5, 0.5), (-0.5, -0.5), (0.5, -0.5), (-0.5, 0.5)]
for x, y in sample_points:
    df_dx, df_dy, normal = derivatives_and_normal(x, y)
    point = rg.Point3d(x, y, f(x, y))
    plane = rg.Plane(point, normal)
    
    normals.append(normal)
    planes.append(plane)

# Outputs for Grasshopper
outMesh = mesh
outNormals = normals
outPlanes = planes
# ---------- end normals ----------
# PARAMETRIC
# a * np.sin(b * x**2 - c * y**2) + d * np.cos(x*y)
number_slider_2 = Slider(6.7, range=0..10)
geometry = Geometry(normals.outMesh)  # disabled
vector = Vector(normals.outNormals)  # disabled
# Learn Single-Variable Calculus
# with Python in Grasshopper
# at Wickerson Studios
panel_3 = Panel(normals.out)  # disabled
geometry_2 = Geometry(normals.outPlanes)  # disabled
entwine = Entwine(Branch00=geometry, Branch02=geometry_2, FlattenInputs=True)  # disabled
vector_display = VectorDisplay(Anchor=geometry_2, Vector=vector)  # disabled
panel_4 = Panel(entwine)  # disabled
normals_2 = Script(
    x_range=number_slider_2,
    y_range=Slider(4.2, range=0..10),
    grid_density=Slider(43, range=0..100),
    a=Slider(-0.18, range=-2..2),
    b=Slider(1.05, range=-2..2),
    c=Slider(0.78, range=-2..2),
    d=Slider(-0.47, range=-2..2),
    test_x=Slider(3.57, range=-10..10),
    test_y=Slider(-1.25, range=-10..10))  # -> out, outMesh, outNormals, outPlanes; inputs x_range: Double, y_range: Double, grid_density: Int32, a: Double, b: Double, c: Double, d: Double, test_x: Double, test_y: Double
# ---------- normals_2: Python ----------
import Rhino
import Rhino.Geometry as rg
import math
import numpy as np

def main(x_range, y_range, grid_density, a, b, c, d):
    # Function to compute z based on x and y
    def f(x, y):
        return a * np.sin(b * x**2 - c * y**2) + d * np.cos(x*y)

    # Function to compute the partial derivatives and normal vector at point (x, y)
    def derivatives_and_normal(x, y):
        df_dx = 2*b*x*a*np.cos(b*x**2 - c*y**2) - y*d*np.sin(x*y)
        df_dy = -2*c*y*a*np.cos(b*x**2 - c*y**2) - x*d*np.sin(x*y)
        normal = rg.Vector3d(-df_dx, -df_dy, 1)
        normal.Unitize()
        return df_dx, df_dy, normal

    # Create a mesh to represent the surface z = f(x, y)
    mesh = rg.Mesh()

    # Using numpy to create a mesh grid
    x_vals = np.linspace(-x_range, x_range, grid_density)
    y_vals = np.linspace(-y_range, y_range, grid_density)
    X, Y = np.meshgrid(x_vals, y_vals)
    Z = f(X, Y)

    for i in range(len(x_vals)):
        for j in range(len(y_vals)):
            x, y, z = X[i, j], Y[i, j], Z[i, j]
            mesh.Vertices.Add(x, y, z)

    # Compute mesh faces
    for i in range(len(x_vals)-1):
        for j in range(len(y_vals)-1):
            mesh.Faces.AddFace(i + j*grid_density, i + 1 + j*grid_density, i + 1 + (j+1)*grid_density, i + (j+1)*grid_density)

    # Compute normals and tangent planes at some sample points
    normals = []
    planes = []
    sample_points = [(test_x, test_y), (-0.5, -0.5), (0.5, -0.5), (-0.5, 0.5)]
    for x, y in sample_points:
        df_dx, df_dy, normal = derivatives_and_normal(x, y)
        point = rg.Point3d(x, y, f(x, y))
        plane = rg.Plane(point, normal)
        
        normals.append(normal)
        planes.append(plane)

    return mesh, normals, planes

# Inputs for Grasshopper
"""
x_range = 10.0  # float
y_range = 10.0  # float
grid_density = 50  # integer
a = 1.0  # float
b = 1.0  # float
c = 1.0  # float
d = 1.0  # float
"""

# Outputs for Grasshopper
outMesh, outNormals, outPlanes = main(x_range, y_range, grid_density, a, b, c, d)
# ---------- end normals_2 ----------
geometry_3 = Geometry(normals_2.outMesh)
vector_2 = Vector(normals_2.outNormals)
panel_5 = Panel(normals_2.out)
geometry_4 = Geometry(normals_2.outPlanes)
sphere = Sphere(Base=geometry_4, Radius=1)
entwine_2 = Entwine(Branch00=geometry_3, Branch02=geometry_4, FlattenInputs=True)
vector_display_2 = VectorDisplay(Anchor=geometry_4, Vector=vector_2)
panel_6 = Panel(entwine_2)
