# Grasshopper definition 013_Leibniz_Notation.gh (Grasshopper 1.0.7)
# plug-ins: RhinoCodePluginGH

# ----
# Oscillation Algorithm
# The oscillation algorithm can be use to animate
# any geometry that is driven by a number sliders.
# Simply swap out the number sliders at the
# multiplication node in the oscillation script.
trigger = Trigger(Interval=20, TimerInterval=20, Target=data_recorder)  # disabled
panel = Panel("1")  # disabled
# 2nd gpt-4 Text Prompt
# Great, now make the script much more complex model
# with complex trigonometric polynomials and the
# NUMPY python library. Be sure to incorporate the previous code logic.
# ensure that this script produces 3d geometry as
# well for Data visualization purposes.
data_recorder = DataRecorder(panel, DataLimit=-10, RecordData=False)  # disabled
number_slider = Slider(47, range=0..1000)  # disabled
# gpt-4 Initial Response
# Certainly! You can create a more complex model
#  with trigonometric functions by modifying the
# lambda functions f and df (its derivative). Below
# is a Python 3 script that incorporates NumPy to
# handle more complex trigonometric polynomial
# functions for creating a 3D curve.
list_length = ListLength(List=data_recorder)  # disabled
division = Division(A=list_length, B=number_slider)  # disabled
cosine = Cosine(Value=division)  # disabled
sine = Sine(Value=division)  # disabled
panel_2 = Panel([sine, cosine])  # disabled

# ----
# ADVANCED
# PARAMETRIC
#     f = lambda x: (x, x**2 + 3 * np.cos(x), 0)
#     df = lambda x: (x, 2*x - 3 * np.sin(x), 0)
panel_3 = Panel("x**2 + 3 * np.cos(x)")
# gpt-4 Text Prompt
# Learn Single-Variable Calculus
# with Python in Grasshopper
# at Wickerson Studios
# Create a geometric 3D model with
# 
# Single-Variable Calculus
# Differentiation
# The Derivative
# 
# to create a 3D model specifically about
# 
# Leibniz Notation
# 
# 
# in python 3 code for the python 3 script
# node in grasshopper for Rhino8WIP using the
# 
# Rhino Common API to create some geometry as well.
# 
# Output the parts of the model in different
# variable outputs in the python 3 node in
# grasshopper.
# 002 DIFFERENTIATION
# 002 The derivative
# 013 Leibniz Notation
leibniz_notation = Script()  # -> out, a, b; disabled
# ---------- leibniz_notation: Python ----------
import Rhino
import Rhino.Geometry as rg
import math

def CreateCurve(f, domain_start, domain_end, steps):
    """Create a 3D curve based on a single-variable function f(x)."""
    points = []
    for i in range(steps + 1):
        t = domain_start + (domain_end - domain_start) * i / steps
        points.append(rg.Point3d(t, f(t), 0))
    return rg.PolylineCurve(points)

def main():
    # Define the function f(x) = x^2 and its derivative f'(x) = 2x
    f = lambda x: x**2
    df = lambda x: 2*x  # Derivative in Leibniz notation: df/dx = 2x
    
    # Domain and steps for curve plotting
    domain_start = -10
    domain_end = 10
    steps = 100
    
    # Create the curve for f(x) and its derivative f'(x)
    curve_f = CreateCurve(f, domain_start, domain_end, steps)
    curve_df = CreateCurve(df, domain_start, domain_end, steps)
    
    # Output the curves
    if curve_f and curve_df:
        return curve_f, curve_df
    else:
        return None, None

# Call main function and collect outputs
curve_f, curve_df = main()

# Assuming 'a' and 'b' are output variables in the Grasshopper Python node
a = curve_f
b = curve_df
# ---------- end leibniz_notation ----------
geometry = Geometry(leibniz_notation.a)  # disabled
geometry_2 = Geometry(leibniz_notation.b)  # disabled
panel_4 = Panel(leibniz_notation.out)  # disabled
entwine = Entwine(Branch00=geometry, Branch01=geometry_2, FlattenInputs=True)  # disabled
leibniz_notation_2 = Script(
    f_expr=panel_3,
    df_expr="2*x - 3 * np.sin(x)",
    domain_start=Slider(-10, range=-10..10),
    domain_end=Slider(10, range=-10..10),
    steps=Slider(100, range=0..100))  # -> out, a, b; inputs f_expr: String, df_expr: String, domain_start: Double, domain_end: Double, steps: Int32
# ---------- leibniz_notation_2: Python ----------
import Rhino
import Rhino.Geometry as rg
import numpy as np
import math

def CreateCurve(f_expr, domain_start, domain_end, steps):
    """Create a 3D curve based on a single-variable function f(x)."""
    points = []
    for x in np.linspace(domain_start, domain_end, steps):
        y = eval(f_expr)
        points.append(rg.Point3d(x, y, 0))
    return rg.PolylineCurve(points)

def main(f_expr, df_expr, domain_start=0, domain_end=10, steps=100):
    # Create the curve for f(x) and its derivative f'(x)
    curve_f = CreateCurve(f_expr, domain_start, domain_end, steps)
    curve_df = CreateCurve(df_expr, domain_start, domain_end, steps)
    
    # Output the curves
    if curve_f and curve_df:
        return curve_f, curve_df
    else:
        return None, None

# Sample user input
#f_expr = "x**2 + 3 * np.cos(x)"
#df_expr = "2*x - 3 * np.sin(x)"
#domain_start = -10
#domain_end = 10
#steps = 100

# Call main function and collect outputs
curve_f, curve_df = main(f_expr, df_expr, domain_start, domain_end, steps)

# Assuming 'a' and 'b' are output variables in the Grasshopper Python node
a = curve_f
b = curve_df
# ---------- end leibniz_notation_2 ----------
# gpt-4 Initial Response
panel_5 = Panel(entwine)  # disabled
geometry_3 = Geometry(leibniz_notation_2.a)
geometry_4 = Geometry(leibniz_notation_2.b)
panel_6 = Panel(leibniz_notation_2.out)
entwine_2 = Entwine(Branch00=geometry_3, Branch01=geometry_4, FlattenInputs=True)
# Certainly! Below is a Python 3 script that is
# designed to be used as a custom Python 3
# node in Grasshopper for Rhino 8 WIP. This
# script will create a 3D curve based on the
# function
# 
# f(x)=x ^2
#   and will also plot its derivative
# 
#  (x)=2x alongside it. It utilizes Rhino's Common
# API to create the 3D geometry.
panel_7 = Panel(entwine_2)
