# Grasshopper definition 013_Leibniz_Notation_functions.gh (Grasshopper 1.0.7)
# plug-ins: RhinoCodePluginGH

# ----
# Oscillation Algorithm
# The oscillation algorithm can be use to animate
# any geometry that is driven by a number sliders.
# Simply swap out the number sliders at the
# multiplication node in the oscillation script.
panel = Panel("1")
trigger = Trigger(Interval=20, TimerInterval=20, Target=data_recorder)
data_recorder = DataRecorder(panel, DataLimit=-10, RecordData=True)
list_length = ListLength(List=data_recorder)
division = Division(A=list_length, B=Slider(439, range=0..1000))
cosine = Cosine(Value=division)
sine = Sine(Value=division)
panel_2 = Panel([sine, cosine])

number_slider = Slider(-3, range=-3..3)
number_slider_2 = Slider(3, range=-3..3)
number_slider_3 = Slider(-3, range=-3..3)
number_slider_4 = Slider(3, range=-3..3)
concatenate = Concatenate(FragmentA="x", FragmentB="**")
concatenate_2 = Concatenate(FragmentB="*np.cos(x)*np.sin(")
concatenate_3 = Concatenate(FragmentA="x", FragmentB="**")
concatenate_4 = Concatenate(FragmentA=concatenate, FragmentB=Slider(0, range=0..10))
concatenate_5 = Concatenate(FragmentA=concatenate_2)
concatenate_6 = Concatenate(FragmentA=concatenate_3, FragmentB=Slider(0, range=0..10))
concatenate_7 = Concatenate(FragmentA=concatenate_4, FragmentB="+")
concatenate_8 = Concatenate(FragmentA=concatenate_5, FragmentB="*y)+")
concatenate_9 = Concatenate(FragmentA=concatenate_6, FragmentB="+")
concatenate_10 = Concatenate(FragmentA=concatenate_7, FragmentB=Slider(3, range=0..10))
concatenate_11 = Concatenate(FragmentA=concatenate_8)
concatenate_12 = Concatenate(FragmentA=concatenate_9, FragmentB=Slider(3, range=0..10))
concatenate_13 = Concatenate(FragmentA=concatenate_10, FragmentB="*")
concatenate_14 = Concatenate(FragmentA=concatenate_11, FragmentB="*np.sin(")
concatenate_15 = Concatenate(FragmentA=concatenate_12, FragmentB="*")
concatenate_16 = Concatenate(FragmentA=concatenate_13, FragmentB="np.")
concatenate_17 = Concatenate(FragmentA=concatenate_14)
concatenate_18 = Concatenate(FragmentA=concatenate_15, FragmentB="np.")
concatenate_19 = Concatenate(FragmentA=concatenate_16, FragmentB="sin(x)")
concatenate_20 = Concatenate(FragmentA=concatenate_17, FragmentB="*x)")
concatenate_21 = Concatenate(FragmentA=concatenate_18, FragmentB="sin(x)")

# ----
# 3*np.cos(x)*np.sin(2*y)+2*np.sin(3*x)
# 3*np.sin(x)*np.sin(2*y)+2*np.cos(3*x)
panel_3 = Panel("2*np.cos(2*x)*np.sin(y)+np.sin(2*x)")
panel_4 = Panel("3*np.cos(2*y)+4*np.sin(x+y)")

panel_5 = Panel(concatenate_20)
leibniz_notation = Script(
    f_expr=panel_3,
    g_expr="2*np.sin(2*x)*np.cos(y)+np.cos(3*y)",
    df_expr="np.cos(x)*np.sin(3*y)+2*np.cos(2*x+y)",
    domain_start=Slider(-10, range=-10..10),
    domain_end=Slider(10, range=-10..10),
    steps=Slider(100, range=0..100))  # -> out, a, b; inputs f_expr: String, g_expr: String, df_expr: String, domain_start: Double, domain_end: Double, steps: Int32
# ---------- leibniz_notation: Python ----------
import Rhino
import Rhino.Geometry as rg
import numpy as np
import math

def CreateCurve(f_expr, domain_start, domain_end, steps):
    """Create a 3D curve based on a single-variable function f(x)."""
    points = []
    for x in np.linspace(domain_start, domain_end, steps):
        for y in np.linspace(domain_start, domain_end, steps):
            y = eval(f_expr)
            z = eval(g_expr)
        points.append(rg.Point3d(x, y, z))
    return rg.PolylineCurve(points)

def main(f_expr, df_expr, domain_start=0, domain_end=10, steps=100):
    # Create the curve for f(x) and its derivative f'(x)
    curve_f = CreateCurve(f_expr, domain_start, domain_end, steps)
    curve_df = CreateCurve(df_expr, domain_start, domain_end, steps)
    
    # Output the curves
    if curve_f and curve_df:
        return curve_f, curve_df
    else:
        return None, None

# Sample user input
#f_expr = "x**2 + 3 * np.cos(x)"
#df_expr = "2*x - 3 * np.sin(x)"
#g_expr = "x**2 + 3 * np.sin(x)"
#domain_start = -10
#domain_end = 10
#steps = 100

# Call main function and collect outputs
curve_f, curve_df = main(f_expr, df_expr, domain_start, domain_end, steps)

# Assuming 'a' and 'b' are output variables in the Grasshopper Python node
a = curve_f
b = curve_df
# ---------- end leibniz_notation ----------
leibniz_notation_2 = Script(
    f_expr="x**2 + 3 * np.cos(x)",
    g_expr="x**2 + 3 * np.sin(x)",
    df_expr="2*x - 3 * np.sin(x)",
    domain_start=Slider(-10, range=-10..10),
    domain_end=Slider(10, range=-10..10),
    steps=Slider(100, range=0..100))  # -> out, a, b; inputs f_expr: String, g_expr: String, df_expr: String, domain_start: Double, domain_end: Double, steps: Int32
# ---------- leibniz_notation_2: Python ----------
import Rhino
import Rhino.Geometry as rg
import numpy as np
import math

def CreateCurve(f_expr, domain_start, domain_end, steps):
    """Create a 3D curve based on a single-variable function f(x)."""
    points = []
    for x in np.linspace(domain_start, domain_end, steps):
        y = eval(f_expr)
        z = eval(g_expr)
        points.append(rg.Point3d(x, y, z))
    return rg.PolylineCurve(points)

def main(f_expr, df_expr, domain_start=0, domain_end=10, steps=100):
    # Create the curve for f(x) and its derivative f'(x)
    curve_f = CreateCurve(f_expr, domain_start, domain_end, steps)
    curve_df = CreateCurve(df_expr, domain_start, domain_end, steps)
    
    # Output the curves
    if curve_f and curve_df:
        return curve_f, curve_df
    else:
        return None, None

# Sample user input
#f_expr = "x**2 + 3 * np.cos(x)"
#df_expr = "2*x - 3 * np.sin(x)"
#g_expr = "x**2 + 3 * np.sin(x)"
#domain_start = -10
#domain_end = 10
#steps = 100

# Call main function and collect outputs
curve_f, curve_df = main(f_expr, df_expr, domain_start, domain_end, steps)

# Assuming 'a' and 'b' are output variables in the Grasshopper Python node
a = curve_f
b = curve_df
# ---------- end leibniz_notation_2 ----------
geometry = Geometry(leibniz_notation.a)
geometry_2 = Geometry(leibniz_notation.b)
panel_6 = Panel(leibniz_notation.out)
panel_7 = Panel(leibniz_notation_2.out)
geometry_3 = Geometry(leibniz_notation_2.a)
geometry_4 = Geometry(leibniz_notation_2.b)
loft = Loft(
    Curves=[geometry, geometry_2],
    Options={Adjust=False, Closed=False, LoftEnds=0, LoftSimp=0, LoftType=0, Rebuild=10, Refit=0.01})
entwine = Entwine(Branch00=geometry, Branch01=geometry_2, FlattenInputs=True)
loft_2 = Loft(
    Curves=[geometry_3, geometry_4],
    Options={Adjust=False, Closed=False, LoftEnds=0, LoftSimp=0, LoftType=0, Rebuild=10, Refit=0.01})
entwine_2 = Entwine(Branch00=geometry_3, Branch01=geometry_4, FlattenInputs=True)
panel_8 = Panel(entwine_2)
panel_9 = Panel(entwine)
