# Grasshopper definition 013b_Leibniz_Notation_functions.gh (Grasshopper 1.0.7)
# plug-ins: RhinoCodePluginGH, Pufferfish

# ----
# Oscillation Algorithm
# The oscillation algorithm can be use to animate
# any geometry that is driven by a number sliders.
# Simply swap out the number sliders at the
# multiplication node in the oscillation script.
panel = Panel("1")
trigger = Trigger(Interval=20, TimerInterval=20, Target=data_recorder)
data_recorder = DataRecorder(panel, DataLimit=-10, RecordData=True)
list_length = ListLength(List=data_recorder)
division = Division(A=list_length, B=Slider(439, range=0..1000))
cosine = Cosine(Value=division)
sine = Sine(Value=division)
panel_2 = Panel([sine, cosine])

number_slider = Slider(-3, range=-3..3)
number_slider_2 = Slider(3, range=-3..3)
number_slider_3 = Slider(-3, range=-3..3)
number_slider_4 = Slider(3, range=-3..3)
concatenate = Concatenate(FragmentB="*np.cos(x)*np.sin(")
concatenate_2 = Concatenate(FragmentA=concatenate)
concatenate_3 = Concatenate(FragmentA=concatenate_2, FragmentB="*y)+")
concatenate_4 = Concatenate(FragmentA=concatenate_3)
concatenate_5 = Concatenate(FragmentA=concatenate_4, FragmentB="*np.sin(")
concatenate_6 = Concatenate(FragmentA=concatenate_5)
concatenate_7 = Concatenate(FragmentA=concatenate_6, FragmentB="*x)")

# ----
# 1*np.cos(2*x)*np.sin(y)+np.sin(2*x)
# np.cos(x)*np.sin(3*y)+2*np.cos(2*x+y)
panel_3 = Panel("1*np.sin(.3*x + y)+np.cos(x*y)")
panel_4 = Panel("1*np.sin(.3*x)")

number_slider_5 = Slider(-2.11, range=-3..3)
negative = Negative(Value=number_slider_5)
leibniz_notation = Script(
    f_expr=panel_3,
    g_expr="2*np.sin(2*x)*np.cos(y)+np.cos(3*y)",
    df_expr="1*np.cos(.4*x + y) + np.cos(y)",
    domain_start=number_slider_5,
    domain_end=negative,
    steps=Slider(100, range=0..100))  # -> out, a, b; inputs f_expr: String, g_expr: String, df_expr: String, domain_start: Double, domain_end: Double, steps: Int32
# ---------- leibniz_notation: Python ----------
import Rhino
import Rhino.Geometry as rg
import numpy as np
import math

def CreateCurve(f_expr, domain_start, domain_end, steps):
    """Create a 3D curve based on a single-variable function f(x)."""
    points = []
    for x in np.linspace(domain_start, domain_end, steps):
        for y in np.linspace(domain_start, domain_end, steps):
            y = eval(f_expr)
            z = eval(g_expr)
        points.append(rg.Point3d(x, y, z))
    return rg.PolylineCurve(points)

def main(f_expr, df_expr, domain_start=0, domain_end=10, steps=100):
    # Create the curve for f(x) and its derivative f'(x)
    curve_f = CreateCurve(f_expr, domain_start, domain_end, steps)
    curve_df = CreateCurve(df_expr, domain_start, domain_end, steps)
    
    # Output the curves
    if curve_f and curve_df:
        return curve_f, curve_df
    else:
        return None, None

# Sample user input
#f_expr = "x**2 + 3 * np.cos(x)"
#df_expr = "2*x - 3 * np.sin(x)"
#g_expr = "x**2 + 3 * np.sin(x)"
#domain_start = -10
#domain_end = 10
#steps = 100

# Call main function and collect outputs
curve_f, curve_df = main(f_expr, df_expr, domain_start, domain_end, steps)

# Assuming 'a' and 'b' are output variables in the Grasshopper Python node
a = curve_f
b = curve_df
# ---------- end leibniz_notation ----------
leibniz_notation_2 = Script(
    f_expr="x**2 + 3 * np.cos(x)",
    g_expr="x**2 + 3 * np.sin(x)",
    df_expr="2*x - 3 * np.sin(x)",
    domain_start=Slider(-10, range=-10..10),
    domain_end=Slider(10, range=-10..10),
    steps=Slider(100, range=0..100))  # -> out, a, b; inputs f_expr: String, g_expr: String, df_expr: String, domain_start: Double, domain_end: Double, steps: Int32
# ---------- leibniz_notation_2: Python ----------
import Rhino
import Rhino.Geometry as rg
import numpy as np
import math

def CreateCurve(f_expr, domain_start, domain_end, steps):
    """Create a 3D curve based on a single-variable function f(x)."""
    points = []
    for x in np.linspace(domain_start, domain_end, steps):
        y = eval(f_expr)
        z = eval(g_expr)
        points.append(rg.Point3d(x, y, z))
    return rg.PolylineCurve(points)

def main(f_expr, df_expr, domain_start=0, domain_end=10, steps=100):
    # Create the curve for f(x) and its derivative f'(x)
    curve_f = CreateCurve(f_expr, domain_start, domain_end, steps)
    curve_df = CreateCurve(df_expr, domain_start, domain_end, steps)
    
    # Output the curves
    if curve_f and curve_df:
        return curve_f, curve_df
    else:
        return None, None

# Sample user input
#f_expr = "x**2 + 3 * np.cos(x)"
#df_expr = "2*x - 3 * np.sin(x)"
#g_expr = "x**2 + 3 * np.sin(x)"
#domain_start = -10
#domain_end = 10
#steps = 100

# Call main function and collect outputs
curve_f, curve_df = main(f_expr, df_expr, domain_start, domain_end, steps)

# Assuming 'a' and 'b' are output variables in the Grasshopper Python node
a = curve_f
b = curve_df
# ---------- end leibniz_notation_2 ----------
geometry = Geometry(leibniz_notation.b)
geometry_2 = Geometry(leibniz_notation.a)
panel_5 = Panel(leibniz_notation.out)
panel_6 = Panel(leibniz_notation_2.out)
geometry_3 = Geometry(leibniz_notation_2.a)
geometry_4 = Geometry(leibniz_notation_2.b)
entwine = Entwine(Branch00=geometry_2, Branch01=geometry, FlattenInputs=True)
loft = Loft(
    Curves=[geometry_3, geometry_4],
    Options={Adjust=False, Closed=False, LoftEnds=0, LoftSimp=0, LoftType=0, Rebuild=10, Refit=0.01})
join_curves = JoinCurves(Curves=geometry_2, Preserve=False)
join_curves_2 = JoinCurves(Curves=geometry, Preserve=False)
entwine_2 = Entwine(Branch00=geometry_3, Branch01=geometry_4, FlattenInputs=True)
panel_7 = Panel(entwine_2)
panel_8 = Panel(entwine)
rebuild_curve = RebuildCurve(Curve=join_curves, Degree="3", EndTangents=False)
rebuild_curve_2 = RebuildCurve(Curve=join_curves_2, Degree="3", EndTangents=False)
loft_2 = Loft(
    Curves=[rebuild_curve, rebuild_curve_2],
    Options={Adjust=False, Closed=False, LoftEnds=0, LoftSimp=0, LoftType=0, Rebuild=10, Refit=0.01})
number_slider_6 = Slider(10, range=0..100)
deconstruct_brep = DeconstructBrep(Brep=loft_2)  # -> Faces, Edges, Vertices
divide_surface = DivideSurface(Surface=deconstruct_brep.Faces, UCount=number_slider_6, VCount=number_slider_6)  # -> Points, Normals, Parameters
amplitude = Amplitude(Vector=divide_surface.Normals, Amplitude=Slider(1, range=0..1))
move = Move(Geometry=divide_surface.Points, Motion=amplitude)  # -> Geometry, Transform
surface_from_points = SurfaceFromPoints(Points=flatten(move.Geometry), UCount=expr("x+1", number_slider_6), Interpolate=False)
deconstruct_brep_2 = DeconstructBrep(Brep=surface_from_points)  # -> Faces, Edges, Vertices
list_item = ListItem(List=deconstruct_brep.Edges, Index=0, Wrap=True)  # -> Item, Item1, Item2, Item3
list_item_2 = ListItem(List=deconstruct_brep_2.Edges, Index=0, Wrap=True)  # -> Item, Item1, Item2, Item3
curve = Curve(list_item.Item)
loft_3 = Loft(
    Curves=flatten([list_item.Item, list_item_2.Item]),
    Options={Adjust=False, Closed=False, LoftEnds=0, LoftSimp=0, LoftType=0, Rebuild=10, Refit=0.01})
loft_4 = Loft(
    Curves=flatten([list_item_2.Item1, list_item.Item1]),
    Options={Adjust=False, Closed=False, LoftEnds=0, LoftSimp=0, LoftType=0, Rebuild=10, Refit=0.01})
loft_5 = Loft(
    Curves=flatten([list_item_2.Item2, list_item.Item2]),
    Options={Adjust=False, Closed=False, LoftEnds=0, LoftSimp=0, LoftType=0, Rebuild=10, Refit=0.01})
loft_6 = Loft(
    Curves=flatten([list_item_2.Item3, list_item.Item3]),
    Options={Adjust=False, Closed=False, LoftEnds=0, LoftSimp=0, LoftType=0, Rebuild=10, Refit=0.01})
merge = Merge(Data1=loft_3, Data2=loft_4, Data3=loft_5, Data4=loft_6, Data5=deconstruct_brep_2.Faces, Data6=deconstruct_brep.Faces)
