# Grasshopper definition 014_Differentials.gh (Grasshopper 1.0.7)
# plug-ins: RhinoCodePluginGH

# ----
# Oscillation Algorithm
# The oscillation algorithm can be use to animate
# any geometry that is driven by a number sliders.
# Simply swap out the number sliders at the
# multiplication node in the oscillation script.
trigger = Trigger(Interval=20, TimerInterval=20, Target=data_recorder)  # disabled
panel = Panel("1")  # disabled
# 2nd gpt-4 Text Prompt
# Great, now make the script much more complex model
# with complex trigonometric polynomials and the
# NUMPY python library. Be sure to incorporate the previous code logic.
# ensure that this script produces 3d geometry as
# well for Data visualization purposes.
data_recorder = DataRecorder(panel, DataLimit=-10, RecordData=False)  # disabled
number_slider = Slider(47, range=0..1000)  # disabled
# gpt-4 Initial Response
# Certainly! Below is an advanced version of the
# previous Python script that uses NumPy for
# matrix operations and a more complex function
# to generate the 3D surface. This function will be
# a complex trigonometric polynomial of the form
# 
# np.sin(x**2 + y**2) + np.cos(x * y) + np.sin(x + y)
list_length = ListLength(List=data_recorder)  # disabled
division = Division(A=list_length, B=number_slider)  # disabled
cosine = Cosine(Value=division)  # disabled
sine = Sine(Value=division)  # disabled
panel_2 = Panel([sine, cosine])  # disabled

# ----
# ADVANCED
# PARAMETRIC
# def function_z(x, y):
#     return np.sin(x**2 + y**2) + np.cos(x * y) + np.sin(x + y)
number_slider_2 = Slider(-10, range=-10..10)
# gpt-4 Text Prompt
# Learn Single-Variable Calculus
# with Python in Grasshopper
# at Wickerson Studios
# Create a geometric 3D model with
# 
# Single-Variable Calculus
# Differentiation
# The Derivative
# 
# to create a 3D model specifically about
# 
# Differentials
# 
# 
# in python 3 code for the python 3 script
# node in grasshopper for Rhino8WIP using the
# 
# Rhino Common API to create some geometry as well.
# 
# Output the parts of the model in different
# variable outputs in the python 3 node in
# grasshopper.
# 002 DIFFERENTIATION
# 002 The derivative
# 014 Differentials
differentials = Script()  # -> out, a, b, c, d; disabled
# ---------- differentials: Python ----------
import Rhino.Geometry as rg
import math

def function_z(x, y):
    return math.sin(math.sqrt(x**2 + y**2))

def dz_dx(x, y, h=1e-5):
    return (function_z(x + h, y) - function_z(x, y)) / h

def dz_dy(x, y, h=1e-5):
    return (function_z(x, y + h) - function_z(x, y)) / h

# Initialize lists to hold points and vectors
surface_points = []
dzdx_vectors = []
dzdy_vectors = []

# Define the domain for x and y
x_range = [i for i in range(-10, 11)]
y_range = [i for i in range(-10, 11)]

# Generate the points and vectors
for x in x_range:
    for y in y_range:
        z = function_z(x, y)
        point = rg.Point3d(x, y, z)
        surface_points.append(point)
        
        dzdx = dz_dx(x, y)
        dzdy = dz_dy(x, y)
        
        dzdx_vector = rg.Vector3d(1, 0, dzdx)
        dzdy_vector = rg.Vector3d(0, 1, dzdy)
        
        dzdx_vectors.append(dzdx_vector)
        dzdy_vectors.append(dzdy_vector)

# Generate the mesh for the surface
mesh = rg.Mesh()

for x in x_range[:-1]:
    for y in y_range[:-1]:
        pt1 = rg.Point3d(x, y, function_z(x, y))
        pt2 = rg.Point3d(x + 1, y, function_z(x + 1, y))
        pt3 = rg.Point3d(x, y + 1, function_z(x, y + 1))
        pt4 = rg.Point3d(x + 1, y + 1, function_z(x + 1, y + 1))
        
        mesh.Vertices.Add(pt1)
        mesh.Vertices.Add(pt2)
        mesh.Vertices.Add(pt3)
        mesh.Vertices.Add(pt4)
        
        mesh.Faces.AddFace(0, 1, 3, 2)

# Outputs
a = surface_points
b = dzdx_vectors
c = dzdy_vectors
d = mesh
# ---------- end differentials ----------
geometry = Geometry(differentials.a)  # disabled
vector = Vector(differentials.b)  # disabled
vector_2 = Vector(differentials.c)  # disabled
geometry_2 = Geometry(differentials.d)  # disabled
panel_3 = Panel(differentials.out)  # disabled
differentials_2 = Script(
    x_start=number_slider_2,
    x_end=Slider(10, range=-10..10),
    y_start=Slider(-10, range=-10..10),
    y_end=Slider(10, range=-10..10),
    resolution=Slider(8, range=0..100),
    h=Slider(-1e-05, range=-5e-05..5e-05))  # -> out, a, b, c, d; inputs x_start: Double, x_end: Double, y_start: Double, y_end: Double, resolution: Int32, h: Double
# ---------- differentials_2: Python ----------
import Rhino.Geometry as rg
import numpy as np

# Input Parameters
# x_start: float, start value of the x-range
# x_end: float, end value of the x-range
# y_start: float, start value of the y-range
# y_end: float, end value of the y-range
# resolution: int, number of points along each axis
# h: float, step size for numerical differentiation

def generate_geometry(x_start, x_end, y_start, y_end, resolution, h):
    def function_z(x, y):
        return np.sin(x**2 + y**2) + np.cos(x * y) + np.sin(x + y)

    def dz_dx(x, y):
        return (function_z(x + h, y) - function_z(x, y)) / h

    def dz_dy(x, y):
        return (function_z(x, y + h) - function_z(x, y)) / h

    surface_points = []
    dzdx_vectors = []
    dzdy_vectors = []

    x_range = np.linspace(x_start, x_end, resolution)
    y_range = np.linspace(y_start, y_end, resolution)

    for x in x_range:
        for y in y_range:
            z = function_z(x, y)
            point = rg.Point3d(float(x), float(y), float(z))
            surface_points.append(point)
            
            dzdx = dz_dx(x, y)
            dzdy = dz_dy(x, y)
            
            dzdx_vector = rg.Vector3d(1, 0, float(dzdx))
            dzdy_vector = rg.Vector3d(0, 1, float(dzdy))
            
            dzdx_vectors.append(dzdx_vector)
            dzdy_vectors.append(dzdy_vector)

    mesh = rg.Mesh()

    num_points_side = len(x_range)

    for i in range(num_points_side - 1):
        for j in range(num_points_side - 1):
            pt1_index = i * num_points_side + j
            pt2_index = i * num_points_side + (j + 1)
            pt3_index = (i + 1) * num_points_side + j
            pt4_index = (i + 1) * num_points_side + (j + 1)
            
            mesh.Vertices.Add(surface_points[pt1_index])
            mesh.Vertices.Add(surface_points[pt2_index])
            mesh.Vertices.Add(surface_points[pt3_index])
            mesh.Vertices.Add(surface_points[pt4_index])
            
            face_start_index = 4 * (i * (num_points_side - 1) + j)
            
            mesh.Faces.AddFace(face_start_index, face_start_index + 1, face_start_index + 3, face_start_index + 2)

    return surface_points, dzdx_vectors, dzdy_vectors, mesh

# Outputs
a, b, c, d = generate_geometry(x_start, x_end, y_start, y_end, resolution, h)
# ---------- end differentials_2 ----------
entwine = Entwine(Branch00=geometry, Branch01=vector, Branch02=vector_2, Branch03=geometry_2, FlattenInputs=True)  # disabled
vector_display = VectorDisplay(Anchor=geometry, Vector=vector)  # disabled
vector_display_2 = VectorDisplay(Anchor=geometry, Vector=vector_2)  # disabled
panel_4 = Panel(differentials_2.out)
geometry_3 = Geometry(differentials_2.a)
vector_3 = Vector(differentials_2.b)
vector_4 = Vector(differentials_2.c)
geometry_4 = Geometry(differentials_2.d)
# gpt-4 Initial Response
# Creating a 3D model with Single-Variable
# Calculus, Differentiation, and the concept of
# Differentials in Grasshopper for Rhino with
# Python 3 and Rhino Common API is an
# interesting task. Below is an example script that
# will plot a 3D surface based on a function
# 
# z=f(x,y) and the differentials
# 
# dz/dx and dz/dy.
panel_5 = Panel(entwine)  # disabled
vector_display_3 = VectorDisplay(Anchor=geometry_3, Vector=vector_4)
vector_display_4 = VectorDisplay(Anchor=geometry_3, Vector=vector_3)
entwine_2 = Entwine(Branch00=geometry_3, Branch01=vector_3, Branch02=vector_4, Branch03=geometry_4, FlattenInputs=True)
panel_6 = Panel(entwine_2)
