# Grasshopper definition 015_ThreeTrigPoly_003.gh (Grasshopper 1.0.7)
# plug-ins: RhinoCodePluginGH, Pufferfish

number_slider = Slider(-3, range=-3..3)
number_slider_2 = Slider(3, range=-3..3)
number_slider_3 = Slider(-3, range=-3..3)
number_slider_4 = Slider(3, range=-3..3)
concatenate = Concatenate(FragmentB="*np.cos(x)*np.sin(")
concatenate_2 = Concatenate(FragmentA=concatenate)

# ----
# Oscillation Algorithm
# The oscillation algorithm can be use to animate
# any geometry that is driven by a number sliders.
# Simply swap out the number sliders at the
# multiplication node in the oscillation script.
panel = Panel("1")  # disabled
trigger = Trigger(Interval=2000, TimerInterval=2000, Target=data_recorder)  # disabled
data_recorder = DataRecorder(panel, DataLimit=-10, RecordData=True)  # disabled
number_slider_5 = Slider(191, range=0..1000)  # disabled
list_length = ListLength(List=data_recorder)  # disabled
division = Division(A=list_length, B=number_slider_5)  # disabled
cosine = Cosine(Value=division)  # disabled
sine = Sine(Value=division)  # disabled
panel_2 = Panel([sine, cosine])  # disabled

concatenate_3 = Concatenate(FragmentA=concatenate_2, FragmentB="*y)+")
concatenate_4 = Concatenate(FragmentA=concatenate_3)
concatenate_5 = Concatenate(FragmentA=concatenate_4, FragmentB="*np.sin(")
panel_3 = Panel("x**2")
# 1*np.cos(2*x)*np.sin(y)+np.sin(2*x)
# 2*np.sin(2*x)*np.cos(y)+np.cos(3*y)
# np.cos(x)*np.sin(3*y)+2*np.cos(2*x+y)
number_slider_6 = Slider(2, range=0..2)
concatenate_6 = Concatenate(FragmentA=concatenate_5)
concatenate_7 = Concatenate(FragmentA=concatenate_6, FragmentB="*x)")
number_slider_7 = Slider(-3, range=-3..3)
negative = Negative(Value=number_slider_7)
leibniz_notation = Script(
    f_expr="np.cos(-x)",
    df_expr="-1*np.sin(x)",
    g_expr=number_slider_6,
    domain_start=number_slider_7,
    domain_end=negative,
    steps=Slider(100, range=0..100))  # -> out, a, b; inputs f_expr: String, df_expr: String, g_expr: String, domain_start: Double, domain_end: Double, steps: Int32
# ---------- leibniz_notation: Python ----------
import Rhino
import Rhino.Geometry as rg
import numpy as np
import math

def CreateCurve(f_expr, domain_start, domain_end, steps):
    """Create a 3D curve based on a single-variable function f(x)."""
    points = []
    for x in np.linspace(domain_start, domain_end, steps):
        for y in np.linspace(domain_start, domain_end, steps):
            #for z in np.linspace(domain_start, domain_end, steps):
            y = eval(f_expr)
            z = eval(g_expr)
        points.append(rg.Point3d(x, y, z))
    return rg.PolylineCurve(points)

def main(f_expr, df_expr, domain_start=0, domain_end=10, steps=100):
    # Create the curve for f(x) and its derivative f'(x)
    curve_f = CreateCurve(f_expr, domain_start, domain_end, steps)
    curve_df = CreateCurve(df_expr, domain_start, domain_end, steps)
    
    # Output the curves
    if curve_f and curve_df:
        return curve_f, curve_df
    else:
        return None, None

# Sample user input
#f_expr = "x**2 + 3 * np.cos(x)"
#df_expr = "2*x - 3 * np.sin(x)"
#g_expr = "x**2 + 3 * np.sin(x)"
#domain_start = -10
#domain_end = 10
#steps = 100

# Call main function and collect outputs
curve_f, curve_df = main(f_expr, df_expr, domain_start, domain_end, steps)

# Assuming 'a' and 'b' are output variables in the Grasshopper Python node
a = curve_f
b = curve_df
# ---------- end leibniz_notation ----------
geometry = Geometry(leibniz_notation.b)
geometry_2 = Geometry(leibniz_notation.a)
join_curves = JoinCurves(Curves=geometry_2, Preserve=False)
join_curves_2 = JoinCurves(Curves=geometry, Preserve=False)
entwine = Entwine(Branch00=geometry_2, Branch01=geometry, FlattenInputs=True)
panel_4 = Panel(entwine)
rebuild_curve = RebuildCurve(Curve=join_curves, Degree="3", EndTangents=False)
rebuild_curve_2 = RebuildCurve(Curve=join_curves_2, Degree="3", EndTangents=False)
loft = Loft(
    Curves=[rebuild_curve, rebuild_curve_2],
    Options={Adjust=False, Closed=False, LoftEnds=0, LoftSimp=0, LoftType=0, Rebuild=10, Refit=0.01})
number_slider_8 = Slider(10, range=0..100)
deconstruct_brep = DeconstructBrep(Brep=loft)  # -> Faces, Edges, Vertices
divide_surface = DivideSurface(Surface=deconstruct_brep.Faces, UCount=number_slider_8, VCount=number_slider_8)  # -> Points, Normals, Parameters
amplitude = Amplitude(Vector=divide_surface.Normals, Amplitude=number_slider_6)
move = Move(Geometry=divide_surface.Points, Motion=amplitude)  # -> Geometry, Transform
surface_from_points = SurfaceFromPoints(Points=flatten(move.Geometry), UCount=expr("x+1", number_slider_8), Interpolate=False)
deconstruct_brep_2 = DeconstructBrep(Brep=surface_from_points)  # -> Faces, Edges, Vertices
list_item = ListItem(List=deconstruct_brep.Edges, Index=0, Wrap=True)  # -> Item, Item1, Item2, Item3
list_item_2 = ListItem(List=deconstruct_brep_2.Edges, Index=0, Wrap=True)  # -> Item, Item1, Item2, Item3
curve = Curve(list_item.Item)
loft_2 = Loft(
    Curves=flatten([list_item.Item, list_item_2.Item]),
    Options={Adjust=False, Closed=False, LoftEnds=0, LoftSimp=0, LoftType=0, Rebuild=10, Refit=0.01})
loft_3 = Loft(
    Curves=flatten([list_item_2.Item1, list_item.Item1]),
    Options={Adjust=False, Closed=False, LoftEnds=0, LoftSimp=0, LoftType=0, Rebuild=10, Refit=0.01})
loft_4 = Loft(
    Curves=flatten([list_item_2.Item2, list_item.Item2]),
    Options={Adjust=False, Closed=False, LoftEnds=0, LoftSimp=0, LoftType=0, Rebuild=10, Refit=0.01})
loft_5 = Loft(
    Curves=flatten([list_item_2.Item3, list_item.Item3]),
    Options={Adjust=False, Closed=False, LoftEnds=0, LoftSimp=0, LoftType=0, Rebuild=10, Refit=0.01})
merge = Merge(Data1=loft_2, Data2=loft_3, Data3=loft_4, Data4=loft_5, Data5=deconstruct_brep_2.Faces, Data6=deconstruct_brep.Faces)
geometry_3 = Geometry(merge)
