# Grasshopper definition 016_Sums_Constant_Multiples.gh (Grasshopper 1.0.7)
# plug-ins: RhinoCodePluginGH, MeshEdit Components

# ----
# Oscillation Algorithm
# The oscillation algorithm can be use to animate
# any geometry that is driven by a number sliders.
# Simply swap out the number sliders at the
# multiplication node in the oscillation script.
trigger = Trigger(Interval=20, TimerInterval=20, Target=data_recorder)  # disabled
panel = Panel("1")  # disabled
# Great, now make the script much more complex model
# with complex trigonometric polynomials and the
# NUMPY python library. Be sure to incorporate the previous code logic.
# ensure that this script produces 3d geometry as
# well for Data visualization purposes.
data_recorder = DataRecorder(panel, DataLimit=-10, RecordData=False)  # disabled
number_slider = Slider(47, range=0..1000)  # disabled
# gpt-4 Initial Response
# Certainly! Let's create a more complex 3D model
#  by incorporating complex trigonometric
# polynomials using the numpy library for
# enhanced mathematical calculations. We'll
# create a surface based on a combination of sine
#  and cosine terms to achieve a more intricate
# pattern. The resulting surface will be visualized
# using 3D geometry for data visualization
# purposes.
list_length = ListLength(List=data_recorder)  # disabled
division = Division(A=list_length, B=number_slider)  # disabled
cosine = Cosine(Value=division)  # disabled
sine = Sine(Value=division)  # disabled
panel_2 = Panel([sine, cosine])  # disabled

# ----
# ADVANCED
# PARAMETRIC
number_slider_2 = Slider(10, range=0..10)
# gpt-4 Text Prompt
# Learn Single-Variable Calculus
# with Python in Grasshopper
# at Wickerson Studios
# Create a geometric 3D model with
# 
# Single-Variable Calculus
# Differentiation
# Differentiation Rules
# 
# to create a 3D model specifically about
# 
# Sums and Constant Multiples
# 
# 
# in python 3 code for the python 3 script
# node in grasshopper for Rhino8WIP using the
# 
# Rhino Common API to create some geometry as well.
# 
# Output the parts of the model in different
# variable outputs in the python 3 node in
# grasshopper.
# 002 DIFFERENTIATION
# 003 Differentiation Rules
# 016 Sums and Constant Multiples
# 2nd gpt-4 Text Prompt
sums_and_constant_multiples = Script()  # -> out, u_count, output_points; disabled
# ---------- sums_and_constant_multiples: Python ----------
import Rhino.Geometry as rg
import math

# Parameters for the surface generation
u_count = 50
v_count = 50
amplitude = 1.0
frequency = 2.0
constant_multiple = 0.5

# Generate points for the surface
points = []
for u in range(u_count):
    for v in range(v_count):
        x = u / (u_count - 1)
        y = v / (v_count - 1)
        
        sine_value = amplitude * math.sin(2 * math.pi * frequency * x)
        derivative_value = 2 * math.pi * frequency * amplitude * math.cos(2 * math.pi * frequency * x)
        
        z = constant_multiple * (sine_value + derivative_value)
        
        points.append(rg.Point3d(x, y, z))

# Create a mesh from the points
mesh = rg.Mesh()
mesh.Vertices.AddVertices(points)

# Output the mesh and points to Grasshopper
output_mesh = mesh
output_points = points
# ---------- end sums_and_constant_multiples ----------
geometry = Geometry(sums_and_constant_multiples.output_points)  # disabled
panel_3 = Panel(sums_and_constant_multiples.out)  # disabled
mesh_frompoints = MeshFromPoints(Points=geometry, UDirection=sums_and_constant_multiples.u_count, VDirection=sums_and_constant_multiples.u_count)  # disabled
entwine = Entwine(Branch00=geometry, FlattenInputs=True)  # disabled
sums_and_constant_multiples_2 = Script(
    u_count=number_slider_2,
    v_count=number_slider_2,
    amplitude=Slider(0.11, range=-2..2),
    frequency_u=Slider(-0.97, range=-2..2),
    frequency_v=Slider(-0.77, range=-2..2),
    constant_multiple=Slider(-0.66, range=-2..2))  # -> out, u_count, points; inputs u_count: Int32, v_count: Int32, amplitude: Double, frequency_u: Double, frequency_v: Double, constant_multiple: Double
# ---------- sums_and_constant_multiples_2: Python ----------
import Rhino.Geometry as rg
import numpy as np

# Parameters for the surface generation
"""
u_count = 10
v_count = 10
amplitude = 1.0
frequency_u = 1.0
frequency_v = 1.0
constant_multiple = 0.5
"""

# Generate points for the surface using numpy
u_values = np.linspace(0, 1, u_count)
v_values = np.linspace(0, 1, v_count)
U, V = np.meshgrid(u_values, v_values)

sine_term = amplitude * np.sin(2 * np.pi * frequency_u * U)
cosine_term = amplitude * np.cos(2 * np.pi * frequency_v * V)
polynomial = sine_term + cosine_term

# Partial derivatives
dp_du = 2 * np.pi * amplitude * frequency_u * np.cos(2 * np.pi * frequency_u * U)
dp_dv = -2 * np.pi * amplitude * frequency_v * np.sin(2 * np.pi * frequency_v * V)

# Combine the partial derivatives with rules of sums and constant multiples
du_dv_sum = dp_du + dp_dv
surface_values = constant_multiple * du_dv_sum

# Create a mesh from the surface values
points = []
for u_idx in range(u_count):
    for v_idx in range(v_count):
        u = u_values[u_idx]
        v = v_values[v_idx]
        z = surface_values[u_idx, v_idx]
        points.append(rg.Point3d(u, v, z))
# ---------- end sums_and_constant_multiples_2 ----------
# gpt-4 Initial Response
# Certainly! Let's create a 3D model in
# Grasshopper using the Rhino Common API in
# Python. We'll use calculus concepts to generate
# a surface based on the idea of sums and
# constant multiples. In this example, we'll create
# a surface using the sum of a sine wave and its
# derivative, with a constant multiple applied. The
# resulting surface will be output as separate
# components using Grasshopper's Python script node.
panel_4 = Panel(entwine)  # disabled
geometry_2 = Geometry(sums_and_constant_multiples_2.points)
panel_5 = Panel(sums_and_constant_multiples_2.out)
mesh_frompoints_2 = MeshFromPoints(Points=geometry_2, UDirection=sums_and_constant_multiples_2.u_count, VDirection=sums_and_constant_multiples_2.u_count)
entwine_2 = Entwine(Branch00=geometry_2, FlattenInputs=True)
panel_6 = Panel(entwine_2)
