# Grasshopper definition 017_The_Product_Rule.gh (Grasshopper 1.0.7)
# plug-ins: RhinoCodePluginGH

# ----
# Oscillation Algorithm
# The oscillation algorithm can be use to animate
# any geometry that is driven by a number sliders.
# Simply swap out the number sliders at the
# multiplication node in the oscillation script.
trigger = Trigger(Interval=20, TimerInterval=20, Target=data_recorder)  # disabled
panel = Panel("1")  # disabled
data_recorder = DataRecorder(panel, DataLimit=-10, RecordData=False)  # disabled
number_slider = Slider(47, range=0..1000)  # disabled
# gpt-4 Initial Response
# Certainly! Let's create a more complex 3D model
#  by incorporating complex trigonometric
# polynomials using the numpy library for
# enhanced mathematical calculations. We'll
# create a surface based on a combination of sine
#  and cosine terms to achieve a more intricate
# pattern. The resulting surface will be visualized
# using 3D geometry for data visualization
# purposes.
list_length = ListLength(List=data_recorder)  # disabled
division = Division(A=list_length, B=number_slider)  # disabled
cosine = Cosine(Value=division)  # disabled
sine = Sine(Value=division)  # disabled
panel_2 = Panel([sine, cosine])  # disabled

# ----
# gpt-4 Text Prompt
# Create a geometric 3D model with
# 
# Single-Variable Calculus
# Differentiation
# Differentiation Rules
# 
# to create a 3D model specifically about
# 
# The Product Rule
# 
# 
# in python 3 code for the python 3 script
# node in grasshopper for Rhino8WIP using the
# 
# Rhino Common API to create some geometry as well.
# 
# Output the parts of the model in different
# variable outputs in the python 3 node in
# grasshopper.
# 003 Differentiation Rules
# 017 The Product Rule
# 2nd gpt-4 Text Prompt
# ADVANCED
# Great, now make the script much more complex model
# with complex trigonometric polynomials and the
# NUMPY python library. Be sure to incorporate the previous code logic.
# ensure that this script produces 3d geometry as
# well for Data visualization purposes.
the_product_rule = Script()  # -> out, out_f_curve, out_g_curve, out_product_curve
# ---------- the_product_rule: Python ----------
import rhinoscriptsyntax as rs
import Rhino.Geometry as rg

# Create two curves (e.g., circles) to represent functions f(x) and g(x)
f_curve = rs.AddCircle((0, 0, 0), 5)
g_curve = rs.AddCircle((0, 0, 0), 8)

# Define the range of x values
x_range = range(-10, 11)

# Lists to store points for f(x), g(x), and f(x) * g(x)
f_points = []
g_points = []
product_points = []

# Calculate points for f(x), g(x), and f(x) * g(x)
for x in x_range:
    f_value = rs.EvaluateCurve(f_curve, x)[1]
    g_value = rs.EvaluateCurve(g_curve, x)[1]
    product_value = f_value * g_value
    
    f_points.append(rg.Point3d(x, f_value, 0))
    g_points.append(rg.Point3d(x, g_value, 0))
    product_points.append(rg.Point3d(x, product_value, 0))

# Create lines to connect the points
f_curve = rs.AddInterpCurve(f_points)
g_curve = rs.AddInterpCurve(g_points)
product_curve = rs.AddInterpCurve(product_points)

# Convert the curves to Rhino geometry
f_curve_geometry = rs.coercecurve(f_curve)
g_curve_geometry = rs.coercecurve(g_curve)
product_curve_geometry = rs.coercecurve(product_curve)

# Output the curves to Grasshopper
out_f_curve = f_curve_geometry
out_g_curve = g_curve_geometry
out_product_curve = product_curve_geometry
# ---------- end the_product_rule ----------
geometry = Geometry(the_product_rule.out_f_curve)
# PARAMETRIC
geometry_2 = Geometry(the_product_rule.out_product_curve)
geometry_3 = Geometry(the_product_rule.out_g_curve)
# Learn Single-Variable Calculus
# with Python in Grasshopper
# at Wickerson Studios
# 002 DIFFERENTIATION
panel_3 = Panel(the_product_rule.out)
entwine = Entwine(Branch00=geometry, Branch01=geometry_3, Branch02=geometry_2, FlattenInputs=True)
the_product_rule_2 = Script()  # -> out, out_f_curve, out_g_curve, out_product_curve; same code as the_product_rule
# gpt-4 Initial Response
# Creating a 3D model to visualize the Product
# Rule using Python and Rhino Common API
# involves a few steps. We'll start by creating a
# parametric surface using Rhino Common, and
# then we'll implement the Product Rule using
# calculus to manipulate the surface.
panel_4 = Panel(entwine)
geometry_4 = Geometry(the_product_rule_2.out_f_curve)
geometry_5 = Geometry(the_product_rule_2.out_product_curve)
geometry_6 = Geometry(the_product_rule_2.out_g_curve)
panel_5 = Panel(the_product_rule_2.out)
entwine_2 = Entwine(Branch00=geometry_4, Branch01=geometry_6, Branch02=geometry_5, FlattenInputs=True)
panel_6 = Panel(entwine_2)
