# Grasshopper definition 018_The_Reciprocal_Rule.gh (Grasshopper 1.0.7)
# plug-ins: RhinoCodePluginGH

# ----
# Oscillation Algorithm
# The oscillation algorithm can be use to animate
# any geometry that is driven by a number sliders.
# Simply swap out the number sliders at the
# multiplication node in the oscillation script.
panel = Panel("1")
trigger = Trigger(Interval=20, TimerInterval=20, Target=data_recorder)
# 2nd gpt-4 Text Prompt
# Great, now make the script much more complex model
# with complex trigonometric polynomials and the
# NUMPY python library. Be sure to incorporate the previous code logic.
# ensure that this script produces 3d geometry as
# well for Data visualization purposes.
data_recorder = DataRecorder(panel, DataLimit=-10, RecordData=False)
# gpt-4 Initial Response
# Certainly! Let's create a more complex example
# using trigonometric polynomials and the NumPy
# library for calculations. We'll create a script that
# represents a trigonometric polynomial function
# and its reciprocal, visualize their derivatives, and
# incorporate the previous logic for creating 3D
# geometry.
list_length = ListLength(List=data_recorder)
division = Division(A=list_length, B=Slider(70, range=0..1000))
cosine = Cosine(Value=division)
sine = Sine(Value=division)
panel_2 = Panel([sine, cosine])

# ----
# ADVANCED
# PARAMETRIC
number_slider = Slider(2, range=0..2)
# gpt-4 Text Prompt
# Learn Single-Variable Calculus
# with Python in Grasshopper
# at Wickerson Studios
# Create a geometric 3D model with
# 
# Single-Variable Calculus
# Differentiation
# Differentiation Rules
# 
# to create a 3D model specifically about
# 
# The Reciprocal Rule
# 
# 
# in python 3 code for the python 3 script
# node in grasshopper for Rhino8WIP using the
# 
# Rhino Common API to create some geometry as well.
# 
# Output the parts of the model in different
# variable outputs in the python 3 node in
# grasshopper.
# 002 DIFFERENTIATION
# 003 Differentiation Rules
# 018The Reciprocal Rule
the_reciprocal_rule = Script()  # -> out, out_f_curve, out_reciprocal_curve
# ---------- the_reciprocal_rule: Python ----------
import rhinoscriptsyntax as rs
import Rhino.Geometry as rg
import math

# Create a curve to represent the function f(x)
f_curve = rs.AddCurve([(0, 0, 0), (5, 5, 0), (10, 3, 0), (15, 7, 0)], degree=3)

# Define the range of x values
x_range = range(1, 16)

# Lists to store points for f(x) and 1/f(x)
f_points = []
reciprocal_points = []

# Calculate points for f(x) and 1/f(x)
for x in x_range:
    f_value = rs.EvaluateCurve(f_curve, x)[1]
    reciprocal_value = 1 / f_value
    
    f_points.append(rg.Point3d(x, f_value, 0))
    reciprocal_points.append(rg.Point3d(x, reciprocal_value, 0))

# Create lines to connect the points
f_curve = rs.AddInterpCurve(f_points)
reciprocal_curve = rs.AddInterpCurve(reciprocal_points)

# Convert the curves to Rhino geometry
f_curve_geometry = rs.coercecurve(f_curve)
reciprocal_curve_geometry = rs.coercecurve(reciprocal_curve)

# Output the curves to Grasshopper
out_f_curve = f_curve_geometry
out_reciprocal_curve = reciprocal_curve_geometry
# ---------- end the_reciprocal_rule ----------
multiplication = Multiplication(A=sine, B=Slider(2, range=-2..2))
multiplication_2 = Multiplication(A=cosine, B=Slider(-0.57, range=-2..2))
multiplication_3 = Multiplication(A=sine, B=Slider(-2, range=-2..2))
multiplication_4 = Multiplication(A=cosine, B=Slider(0.71, range=-2..2))
geometry = Geometry(the_reciprocal_rule.out_f_curve)
geometry_2 = Geometry(the_reciprocal_rule.out_reciprocal_curve)
pi = Pi(Factor=Slider(0, range=0..2))
pi_2 = Pi(Factor=number_slider)
panel_3 = Panel(the_reciprocal_rule.out)
entwine = Entwine(Branch00=geometry, Branch01=geometry_2, FlattenInputs=True)
the_reciprocal_rule_2 = Script(
    coefficients=[multiplication, multiplication_2, multiplication_3, multiplication_4],
    start_angle=pi,
    end_angle=pi_2,
    point_count=Slider(100, range=0..100))  # -> out, out_f_curve, out_reciprocal_curve; inputs coefficients: list of Double, start_angle: Double, end_angle: Double, point_count: Int32
# ---------- the_reciprocal_rule_2: Python ----------
import rhinoscriptsyntax as rs
import Rhino.Geometry as rg
import numpy as np
import math

# Input parameters
#coefficients = []  # List of coefficients for the trigonometric polynomial
#start_angle = 0
#end_angle = 2 * math.pi
# = 100

# Check if input coefficients are provided
if not coefficients:
    coefficients = [2, -1.5, 1, 0.5]  # Default coefficients if none provided

# Calculate the values of the trigonometric polynomial and its reciprocal
x_range = np.linspace(start_angle, end_angle, point_count)
f_values = np.polyval(coefficients, np.sin(x_range))
reciprocal_values = 1 / f_values

# Lists to store points for f(x) and 1/f(x)
f_points = []
reciprocal_points = []

for i, x in enumerate(x_range):
    f_points.append(rg.Point3d(x, f_values[i], 0))
    reciprocal_points.append(rg.Point3d(x, reciprocal_values[i], 0))

# Create lines to connect the points
f_curve = rs.AddInterpCurve(f_points)
reciprocal_curve = rs.AddInterpCurve(reciprocal_points)

# Convert the curves to Rhino geometry
f_curve_geometry = rs.coercecurve(f_curve)
reciprocal_curve_geometry = rs.coercecurve(reciprocal_curve)

# Output the curves to Grasshopper
out_f_curve = f_curve_geometry
out_reciprocal_curve = reciprocal_curve_geometry
# ---------- end the_reciprocal_rule_2 ----------
# gpt-4 Initial Response
# Certainly! Let's create a script in Rhino and
# Grasshopper to demonstrate the Reciprocal
# Rule in Calculus. We'll represent the Reciprocal
# Rule by considering a curve and its reciprocal,
# and then visualize their derivatives.
panel_4 = Panel(entwine)
geometry_3 = Geometry(the_reciprocal_rule_2.out_f_curve)
geometry_4 = Geometry(the_reciprocal_rule_2.out_reciprocal_curve)
panel_5 = Panel(the_reciprocal_rule_2.out)
entwine_2 = Entwine(Branch00=geometry_3, Branch01=geometry_4, FlattenInputs=True)
panel_6 = Panel(entwine_2)
