# Grasshopper definition 019_The_Quotient_Rule.gh (Grasshopper 1.0.7)
# plug-ins: RhinoCodePluginGH

# ----
# Oscillation Algorithm
# The oscillation algorithm can be use to animate
# any geometry that is driven by a number sliders.
# Simply swap out the number sliders at the
# multiplication node in the oscillation script.
panel = Panel("1")  # disabled
trigger = Trigger(Interval=10, TimerInterval=10, Target=data_recorder)  # disabled
# 2nd gpt-4 Text Prompt
# Great, now make the script much more complex model
# with complex trigonometric polynomials and the
# NUMPY python library. Be sure to incorporate the previous code logic.
# ensure that this script produces 3d geometry as
# well for Data visualization purposes.
data_recorder = DataRecorder(panel, DataLimit=-10, RecordData=False)  # disabled
number_slider = Slider(100, range=0..1000)  # disabled
# gpt-4 Initial Response
# Certainly! Let's create a more complex example
# using trigonometric polynomials and the NumPy
# library for calculations. We'll create a script that
# represents a trigonometric polynomial function
# and its reciprocal, visualize their derivatives, and
# incorporate the previous logic for creating 3D
# geometry.
list_length = ListLength(List=data_recorder)  # disabled
division = Division(A=list_length, B=number_slider)  # disabled
cosine = Cosine(Value=division)  # disabled
sine = Sine(Value=division)  # disabled
panel_2 = Panel([sine, cosine])  # disabled

# ----
# gpt-4 Text Prompt
# Learn Single-Variable Calculus
# with Python in Grasshopper
# at Wickerson Studios
# Create a geometric 3D model with
# 
# Single-Variable Calculus
# Differentiation
# Differentiation Rules
# 
# to create a 3D model specifically about
# 
# The Quotient Rule
# 
# 
# in python 3 code for the python 3 script
# node in grasshopper for Rhino8WIP using the
# 
# Rhino Common API to create some geometry as well.
# 
# Output the parts of the model in different
# variable outputs in the python 3 node in
# grasshopper.
# 002 DIFFERENTIATION
# 003 Differentiation Rules
# 019 The Quotient Rule
# ADVANCED
# PARAMETRIC
the_quotient_rule = Script()  # -> out, out_f_curve, out_g_curve, out_quotient_curve; disabled
# ---------- the_quotient_rule: Python ----------
import rhinoscriptsyntax as rs
import Rhino.Geometry as rg

# Create spheres to represent functions f(x) and g(x)
f_sphere = rs.AddSphere(rg.Point3d(0, 0, 0), 5)
g_sphere = rs.AddSphere(rg.Point3d(10, 0, 0), 5)

# Define the range of x values
x_range = range(-5, 6)

# Lists to store points for f(x), g(x), and f(x) / g(x)
f_points = []
g_points = []
quotient_points = []

for x in x_range:
    f_value = x ** 2 + 10
    g_value = x + 3
    
    f_points.append(rg.Point3d(x, f_value, 0))
    g_points.append(rg.Point3d(x, g_value, 0))
    
    if g_value != 0:
        quotient_value = f_value / g_value
        quotient_points.append(rg.Point3d(x, quotient_value, 0))

# Create curves to represent f(x), g(x), and f(x) / g(x)
f_curve = rs.AddInterpCurve(f_points)
g_curve = rs.AddInterpCurve(g_points)
quotient_curve = rs.AddInterpCurve(quotient_points)

# Convert the curves to Rhino geometry
f_curve_geometry = rs.coercecurve(f_curve)
g_curve_geometry = rs.coercecurve(g_curve)
quotient_curve_geometry = rs.coercecurve(quotient_curve)

# Output the curves to Grasshopper
out_f_curve = f_curve_geometry
out_g_curve = g_curve_geometry
out_quotient_curve = quotient_curve_geometry
# ---------- end the_quotient_rule ----------
geometry = Geometry(the_quotient_rule.out_f_curve)  # disabled
geometry_2 = Geometry(the_quotient_rule.out_g_curve)  # disabled
geometry_3 = Geometry(the_quotient_rule.out_quotient_curve)  # disabled
panel_3 = Panel(the_quotient_rule.out)  # disabled
the_quotient_rule_2 = Script(
    xMin=Slider(0, range=0..10),
    xMax=Slider(10, range=0..10),
    coeff_f=[Slider(-2, range=-2..2), Slider(-1, range=-2..2)],
    coeff_g=[Slider(1, range=-2..2), Slider(2, range=-2..2)])  # -> out, out_f_curve, out_g_curve, out_quotient_curve; inputs xMin: Int32, xMax: Int32, coeff_f: list of Double, coeff_g: list of Double
# ---------- the_quotient_rule_2: Python ----------
import Rhino.Geometry as rg
import math
import numpy as np

# Input parameters

x_range = rg.Interval(xMin, xMax)
#coeff_f = [1, 1]  # Coefficients for f(x)
#coeff_g = [1, 1]  # Coefficients for g(x)

# Generate x values within the specified range
x_values = np.linspace(x_range.T0, x_range.T1, 100)

# Create two curves to represent functions f(x) and g(x)
f_curve_points = []
g_curve_points = []

for x in x_values:
    f_value = sum(coeff * x ** i for i, coeff in enumerate(coeff_f))
    g_value = sum(coeff * x ** i for i, coeff in enumerate(coeff_g))
    
    f_curve_points.append(rg.Point3d(x, f_value, 0))
    g_curve_points.append(rg.Point3d(x, g_value, 0))

# Create curves using interpolated points
f_curve = rg.Curve.CreateInterpolatedCurve(f_curve_points, 3)
g_curve = rg.Curve.CreateInterpolatedCurve(g_curve_points, 3)

# Calculate the quotient of f(x) / g(x)
quotient_curve = f_curve.Duplicate()
quotient_curve.ChangeDimension(3)

for i, x in enumerate(x_values):
    f_value = sum(coeff * x ** i for i, coeff in enumerate(coeff_f))
    g_value = sum(coeff * x ** i for i, coeff in enumerate(coeff_g))
    quotient_value = f_value / g_value
    quotient_curve.Points.SetPoint(i, rg.Point3d(x, quotient_value, 0))

# Output the curves to Grasshopper
out_f_curve = f_curve
out_g_curve = g_curve
out_quotient_curve = quotient_curve
# ---------- end the_quotient_rule_2 ----------
entwine = Entwine(Branch00=geometry, Branch01=geometry_2, Branch02=geometry_3, FlattenInputs=True)  # disabled
# gpt-4 Initial Response
# Sure! To create a geometric 3D model that
# demonstrates the Quotient Rule using the
# Rhino Common API and Grasshopper, we'll use
# spheres to represent functions and visualize
# their derivatives.
panel_4 = Panel(entwine)  # disabled
geometry_4 = Geometry(the_quotient_rule_2.out_f_curve)
panel_5 = Panel(the_quotient_rule_2.out)
geometry_5 = Geometry(the_quotient_rule_2.out_g_curve)
geometry_6 = Geometry(the_quotient_rule_2.out_quotient_curve)
entwine_2 = Entwine(Branch00=geometry_4, Branch01=geometry_5, Branch02=geometry_6, FlattenInputs=True)
panel_6 = Panel(entwine_2)
