# Grasshopper definition 020_Proof_of_the_Chain_Rule.gh (Grasshopper 1.0.7)
# plug-ins: RhinoCodePluginGH

# ----
# Oscillation Algorithm
# The oscillation algorithm can be use to animate
# any geometry that is driven by a number sliders.
# Simply swap out the number sliders at the
# multiplication node in the oscillation script.
panel = Panel("1")  # disabled
trigger = Trigger(Interval=10, TimerInterval=10, Target=data_recorder)  # disabled
# 2nd gpt-4 Text Prompt
# Great, now make the script much more complex model
# with complex trigonometric polynomials and the
# NUMPY python library. Be sure to incorporate the previous code logic.
# ensure that this script produces 3d geometry as
# well for Data visualization purposes.
data_recorder = DataRecorder(panel, DataLimit=-10, RecordData=False)  # disabled
number_slider = Slider(100, range=0..1000)  # disabled
# gpt-4 Initial Response
# Certainly! Let's create a more complex script
# that uses the numpy library to work with complex
#  trigonometric polynomials. We'll incorporate the
#  previous code logic and use numpy to create
# more intricate functions. We'll visualize the
# composition of functions and the Chain Rule in
# 3D geometry for data visualization purposes.
list_length = ListLength(List=data_recorder)  # disabled
division = Division(A=list_length, B=number_slider)  # disabled
cosine = Cosine(Value=division)  # disabled
sine = Sine(Value=division)  # disabled
panel_2 = Panel([sine, cosine])  # disabled

# ----
# gpt-4 Text Prompt
# Learn Single-Variable Calculus
# with Python in Grasshopper
# at Wickerson Studios
# Create a geometric 3D model with
# 
# Single-Variable Calculus
# Differentiation
# The Chain Rule
# 
# to create a 3D model specifically about
# 
# Proof of the Chain Rule
# 
# 
# in python 3 code for the python 3 script
# node in grasshopper for Rhino8WIP using the
# 
# Rhino Common API to create some geometry as well.
# 
# Output the parts of the model in different
# variable outputs in the python 3 node in
# grasshopper.
# 002 DIFFERENTIATION
# 004 The Chain Rule
# 020 Proof of the Chain Rule
# ADVANCED
# PARAMETRIC
proof_of_the_chain_rule = Script()  # -> out, f_curve, g_curve, h_curve; disabled
# ---------- proof_of_the_chain_rule: Python ----------
import Rhino.Geometry as rg
import math

# Define the functions
def f(x):
    return x**2

def g(x):
    return math.sin(x)

def f_prime(x):
    return 2 * x

def g_prime(x):
    return math.cos(x)

# Define the composite function h(x) = f(g(x))
def h(x):
    return f(g(x))

def h_prime(x):
    return f_prime(g(x)) * g_prime(x)  # Chain Rule: (f(g(x)))' = f'(g(x)) * g'(x)

# Create a range of x values
x_values = [float(x) for x in range(-20, 21)]  # Adjust the range as needed

# Calculate y values for f(x), g(x), and h(x)
f_values = [f(x) for x in x_values]
g_values = [g(x) for x in x_values]
h_values = [h(x) for x in x_values]

# Grasshopper Output Variables
x_output = x_values
f_output = f_values
g_output = g_values
h_output = h_values

# Visualization
f_curve = rg.PolylineCurve([rg.Point3d(x, f(x), 0) for x in x_values])
g_curve = rg.PolylineCurve([rg.Point3d(x, g(x), 0) for x in x_values])
h_curve = rg.PolylineCurve([rg.Point3d(x, h(x), 0) for x in x_values])
# ---------- end proof_of_the_chain_rule ----------
proof_of_the_chain_rule_2 = Script()  # -> out, f_curve, g_curve, h_curve
# ---------- proof_of_the_chain_rule_2: Python ----------
import Rhino.Geometry as rg
import math
import numpy as np

# Define the functions using numpy
def f(x):
    return np.sin(x) + np.cos(2 * x)

def g(x):
    return np.exp(1j * x)  # Complex exponential function

# Define the composite function h(x) = f(g(x))
def h(x):
    return f(g(x))

# Create a range of x values
x_values = np.linspace(-2 * math.pi, 2 * math.pi, 100)

# Calculate y values for f(x), g(x), and h(x)
f_values = f(x_values)
g_values = np.real(g(x_values))  # Take the real part for visualization
h_values = h(x_values)

# Grasshopper Output Variables
x_output = x_values.tolist()  # Convert numpy arrays to Python lists
f_output = f_values.tolist()
g_output = g_values.tolist()
h_output = h_values.tolist()

# Visualization
f_curve = rg.PolylineCurve([rg.Point3d(x, float(f(x)), 0) for x in x_values])
g_curve = rg.PolylineCurve([rg.Point3d(x, float(np.real(g(x))), 0) for x in x_values])
h_curve = rg.PolylineCurve([rg.Point3d(x, float(h(x)), 0) for x in x_values])
# ---------- end proof_of_the_chain_rule_2 ----------
geometry = Geometry(proof_of_the_chain_rule.f_curve)  # disabled
geometry_2 = Geometry(proof_of_the_chain_rule.g_curve)  # disabled
geometry_3 = Geometry(proof_of_the_chain_rule.h_curve)  # disabled
panel_3 = Panel(proof_of_the_chain_rule_2.out)
geometry_4 = Geometry(proof_of_the_chain_rule_2.f_curve)
geometry_5 = Geometry(proof_of_the_chain_rule_2.g_curve)
geometry_6 = Geometry(proof_of_the_chain_rule_2.h_curve)
panel_4 = Panel(proof_of_the_chain_rule.out)  # disabled
entwine = Entwine(Branch00=geometry, Branch01=geometry_2, Branch02=geometry_3, FlattenInputs=True)  # disabled
proof_of_the_chain_rule_3 = Script(
    function_choice=Slider(2, range=0..2),
    xMin=Slider(-6, range=-10..10),
    xMax=Slider(3.117, range=-10..10),
    step_size=Slider(0.017, range=0..0.1),
    visualize_real_part=Toggle(True))  # -> out, x_output, y_output, y_imag_output; inputs function_choice: Int32, xMin: Double, xMax: Double, step_size: Double, visualize_real_part: Boolean
# ---------- proof_of_the_chain_rule_3: Python ----------
import Rhino.Geometry as rg
import math
import numpy as np

# Define the functions using numpy
def f(x):
    return np.sin(x) + np.cos(2 * x)

def g(x):
    return np.exp(1j * x)  # Complex exponential function

# Define the composite function h(x) = f(g(x))
def h(x):
    return f(g(x))

# Grasshopper Inputs
#function_choice = 0  # 0 for f(x), 1 for g(x), 2 for h(x)
x_range = (xMin, 2 * xMax)
#step_size = 0.1
#visualize_real_part = True

# Create a range of x values
x_values = np.arange(x_range[0], x_range[1] + step_size, step_size)

# Calculate y values based on function choice
if function_choice == 0:
    y_values = f(x_values)
elif function_choice == 1:
    y_values = g(x_values)
else:
    y_values = h(x_values)

# Grasshopper Output Variables
x_output = x_values.tolist()
y_output = y_values.real.tolist() if visualize_real_part else y_values.tolist()
y_imag_output = y_values.imag.tolist()

# Visualization
curve_points = [rg.Point3d(x, y_values[i].real if visualize_real_part else y_values[i], y_values[i].imag) for i, x in enumerate(x_values)]
output_curve = rg.PolylineCurve(curve_points)
# ---------- end proof_of_the_chain_rule_3 ----------
entwine_2 = Entwine(Branch00=geometry_4, Branch01=geometry_5, Branch02=geometry_6, FlattenInputs=True)
# gpt-4 Initial Response
# Certainly! Let's create a script that
# demonstrates the proof of the Chain Rule in
# calculus using Rhino and Grasshopper. We'll do
#  this by visualizing the composition of two
# functions and their derivatives.
# 
# In this example, we'll consider two functions:
#  f(x)= x^2 and g(x) = sin(x). We'll calculate their
# derivatives separately and then use the Chain
# Rule to calculate the derivative of the
# composition h(x) = f(g(x)).
panel_5 = Panel(entwine)  # disabled
panel_6 = Panel(entwine_2)
panel_7 = Panel(proof_of_the_chain_rule_3.out)
construct_point = ConstructPoint(
    XCoordinate=proof_of_the_chain_rule_3.x_output,
    YCoordinate=proof_of_the_chain_rule_3.y_output,
    ZCoordinate=proof_of_the_chain_rule_3.y_imag_output)
entwine_3 = Entwine(
    Branch00=proof_of_the_chain_rule_3.x_output,
    Branch01=proof_of_the_chain_rule_3.y_output,
    Branch02=proof_of_the_chain_rule_3.y_imag_output,
    FlattenInputs=True)
panel_8 = Panel(entwine_3)
