# Grasshopper definition 021_Derivatives_of_Inverse_Functions.gh (Grasshopper 1.0.7)
# plug-ins: RhinoCodePluginGH

# ----
# Oscillation Algorithm
# The oscillation algorithm can be use to animate
# any geometry that is driven by a number sliders.
# Simply swap out the number sliders at the
# multiplication node in the oscillation script.
panel = Panel("1")  # disabled
trigger = Trigger(Interval=10, TimerInterval=10, Target=data_recorder)  # disabled
# 2nd gpt-4 Text Prompt
# Great, now make the script much more complex model
# with complex trigonometric polynomials and the
# NUMPY python library. Be sure to incorporate the previous code logic.
# ensure that this script produces 3d geometry as
# well for Data visualization purposes.
data_recorder = DataRecorder(panel, DataLimit=-10, RecordData=False)  # disabled
number_slider = Slider(100, range=0..1000)  # disabled
# gpt-4 Initial Response
# Certainly! Here's an example of a more complex
# script that involves trigonometric polynomials
# and utilizes the NumPy library for calculations.
# This script builds upon the previous logic and
# includes the creation of 3D geometry using the
# Rhino Common API for data visualization
# purposes.
list_length = ListLength(List=data_recorder)  # disabled
division = Division(A=list_length, B=number_slider)  # disabled
cosine = Cosine(Value=division)  # disabled
sine = Sine(Value=division)  # disabled
panel_2 = Panel([sine, cosine])

# ----
# gpt-4 Text Prompt
# Learn Single-Variable Calculus
# with Python in Grasshopper
# at Wickerson Studios
# Create a geometric 3D model with
# 
# Single-Variable Calculus
# Differentiation
# Implicit Differentiation
# 
# to create a 3D model specifically about
# 
# Derivatives of Inverse Functions
# 
# 
# in python 3 code for the python 3 script
# node in grasshopper for Rhino8WIP using the
# 
# Rhino Common API to create some geometry as well.
# 
# Output the parts of the model in different
# variable outputs in the python 3 node in
# grasshopper.
# 002 DIFFERENTIATION
# 005 Implicit Differentiation
# 021 Derivatives of Inverse Functions
# ADVANCED
# PARAMETRIC
proof_of_the_chain_rule = Script()  # -> out, f_curve, g_curve, h_curve; disabled
# ---------- proof_of_the_chain_rule: Python ----------
import Rhino.Geometry as rg
import math

# Define the functions
def f(x):
    return x**2

def g(x):
    return math.sin(x)

def f_prime(x):
    return 2 * x

def g_prime(x):
    return math.cos(x)

# Define the composite function h(x) = f(g(x))
def h(x):
    return f(g(x))

def h_prime(x):
    return f_prime(g(x)) * g_prime(x)  # Chain Rule: (f(g(x)))' = f'(g(x)) * g'(x)

# Create a range of x values
x_values = [float(x) for x in range(-20, 21)]  # Adjust the range as needed

# Calculate y values for f(x), g(x), and h(x)
f_values = [f(x) for x in x_values]
g_values = [g(x) for x in x_values]
h_values = [h(x) for x in x_values]

# Grasshopper Output Variables
x_output = x_values
f_output = f_values
g_output = g_values
h_output = h_values

# Visualization
f_curve = rg.PolylineCurve([rg.Point3d(x, f(x), 0) for x in x_values])
g_curve = rg.PolylineCurve([rg.Point3d(x, g(x), 0) for x in x_values])
h_curve = rg.PolylineCurve([rg.Point3d(x, h(x), 0) for x in x_values])
# ---------- end proof_of_the_chain_rule ----------
number_slider_2 = Slider(2, range=0..2)
proof_of_the_chain_rule_2 = Script()  # -> out, f_curve, g_curve, h_curve; disabled
# ---------- proof_of_the_chain_rule_2: Python ----------
import Rhino.Geometry as rg
import math
import numpy as np

# Define the functions using numpy
def f(x):
    return np.sin(x) + np.cos(2 * x)

def g(x):
    return np.exp(1j * x)  # Complex exponential function

# Define the composite function h(x) = f(g(x))
def h(x):
    return f(g(x))

# Create a range of x values
x_values = np.linspace(-2 * math.pi, 2 * math.pi, 100)

# Calculate y values for f(x), g(x), and h(x)
f_values = f(x_values)
g_values = np.real(g(x_values))  # Take the real part for visualization
h_values = h(x_values)

# Grasshopper Output Variables
x_output = x_values.tolist()  # Convert numpy arrays to Python lists
f_output = f_values.tolist()
g_output = g_values.tolist()
h_output = h_values.tolist()

# Visualization
f_curve = rg.PolylineCurve([rg.Point3d(x, float(f(x)), 0) for x in x_values])
g_curve = rg.PolylineCurve([rg.Point3d(x, float(np.real(g(x))), 0) for x in x_values])
h_curve = rg.PolylineCurve([rg.Point3d(x, float(h(x)), 0) for x in x_values])
# ---------- end proof_of_the_chain_rule_2 ----------
geometry = Geometry(proof_of_the_chain_rule.f_curve)  # disabled
geometry_2 = Geometry(proof_of_the_chain_rule.g_curve)  # disabled
geometry_3 = Geometry(proof_of_the_chain_rule.h_curve)  # disabled
panel_3 = Panel(proof_of_the_chain_rule_2.out)  # disabled
geometry_4 = Geometry(proof_of_the_chain_rule_2.f_curve)  # disabled
geometry_5 = Geometry(proof_of_the_chain_rule_2.g_curve)  # disabled
geometry_6 = Geometry(proof_of_the_chain_rule_2.h_curve)  # disabled
panel_4 = Panel(proof_of_the_chain_rule.out)  # disabled
entwine = Entwine(Branch00=geometry, Branch01=geometry_2, Branch02=geometry_3, FlattenInputs=True)  # disabled
proof_of_the_chain_rule_3 = Script(
    xMin=Slider(-10, range=-10..10),
    xMax=Slider(10, range=-10..10),
    num_points=Slider(100, range=0..100),
    derivative_scale=Slider(1, range=0..10))  # -> out, output_points_x, output_points_y, output_curves_x, output_curves_y; inputs xMin: Double, xMax: Double, num_points: Int32, derivative_scale: Double
# ---------- proof_of_the_chain_rule_3: Python ----------
import Rhino.Geometry as rg
import numpy as np

# Define a simple function and its inverse
def f(x):
    return x**2

def f_inverse(y):
    return np.sqrt(y)

# Define input parameters and their suggested types
x_range = (xMin, xMax)  # Tuple of minimum and maximum x values
#num_points = 50    # Number of data points for calculations
#derivative_scale = 0.2  # Scale factor for derivative visualization

# Generate x values based on input parameters
x_values = np.linspace(x_range[0], x_range[1], num_points)
y_values = f(x_values)

# Calculate derivatives using NumPy
derivatives_at_x = np.gradient(y_values, x_values)
derivatives_at_y = 1.0 / derivatives_at_x

# Create Rhino geometry points and lines
points_x = [rg.Point3d(x, f(x), 0) for x in x_values]
points_y = [rg.Point3d(f_inverse(y), y, 0) for y in y_values]
curves_x = [rg.Line(points_x[i], rg.Point3d(x_values[i] + 1, f(x_values[i]) + derivative_scale * derivatives_at_x[i], 0)) for i in range(len(x_values))]
curves_y = [rg.Line(rg.Point3d(f_inverse(y_values[i]) - derivative_scale * derivatives_at_y[i], y_values[i], 0), points_y[i]) for i in range(len(y_values))]

# Output the geometry
output_points_x = points_x
output_points_y = points_y
output_curves_x = curves_x
output_curves_y = curves_y
# ---------- end proof_of_the_chain_rule_3 ----------
entwine_2 = Entwine(Branch00=geometry_4, Branch01=geometry_5, Branch02=geometry_6, FlattenInputs=True)  # disabled
# gpt-4 Initial Response
# Creating a complete 3D model and integration
# with the Rhino Common API is quite an involved
# process that goes beyond the scope of a simple
#  response. However, I can provide you with a
# Python code snippet that demonstrates how to
# calculate derivatives of inverse functions using
# differentiation and implicit differentiation. You
# can use this code as a starting point to integrate
#  with Grasshopper and the Rhino Common API.
panel_5 = Panel(entwine)  # disabled
panel_6 = Panel(entwine_2)  # disabled
panel_7 = Panel(proof_of_the_chain_rule_3.out)

geometry_7 = Geometry(proof_of_the_chain_rule_3.output_points_x)
geometry_8 = Geometry(proof_of_the_chain_rule_3.output_points_y)
geometry_9 = Geometry(proof_of_the_chain_rule_3.output_curves_x)
geometry_10 = Geometry(proof_of_the_chain_rule_3.output_curves_y)

entwine_3 = Entwine(Branch00=geometry_7, Branch01=geometry_8, Branch02=geometry_9, Branch03=geometry_10, FlattenInputs=True)
panel_8 = Panel(entwine_3)
