# Grasshopper definition 022_Velocity_and_Acceleration.gh (Grasshopper 1.0.7)
# plug-ins: RhinoCodePluginGH

# ----
# Oscillation Algorithm
# The oscillation algorithm can be use to animate
# any geometry that is driven by a number sliders.
# Simply swap out the number sliders at the
# multiplication node in the oscillation script.
panel = Panel("1")  # disabled
trigger = Trigger(Interval=10, TimerInterval=10, Target=data_recorder)  # disabled
# 2nd gpt-4 Text Prompt
# Great, now make the script much more complex model
# with complex trigonometric polynomials and the
# NUMPY python library. Be sure to incorporate the previous code logic.
# ensure that this script produces 3d geometry as
# well for Data visualization purposes.
data_recorder = DataRecorder(panel, DataLimit=-10, RecordData=True)  # disabled
number_slider = Slider(100, range=0..1000)  # disabled
# gpt-4 Initial Response
# Sure, let's create a more complex model that
# involves trigonometric polynomials and utilizes
# the numpy library for calculations. In this
# example, we'll create a helical path in 3D space
# and visualize the position, velocity, and
# acceleration vectors along that path. We'll also
# incorporate the previous code logic for creating
# geometry and outputting to Grasshopper.
list_length = ListLength(List=data_recorder)  # disabled
division = Division(A=list_length, B=number_slider)  # disabled
cosine = Cosine(Value=division)  # disabled
sine = Sine(Value=division)  # disabled
panel_2 = Panel([sine, cosine])  # disabled

# ----
# ADVANCED
# PARAMETRIC
number_slider_2 = Slider(-2, range=-2..2)
multiplication = Multiplication(A=sine, B=number_slider_2)
multiplication_2 = Multiplication(A=cosine, B=Slider(2, range=-2..2))
multiplication_3 = Multiplication(A=sine, B=Slider(-2, range=-2..2))
multiplication_4 = Multiplication(A=cosine, B=Slider(2, range=-2..2))
# gpt-4 Text Prompt
# Learn Single-Variable Calculus
# with Python in Grasshopper
# at Wickerson Studios
# Create a geometric 3D model with
# 
# Single-Variable Calculus
# Differentiation
# Interpretations of the Derivatives
# 
# to create a 3D model specifically about
# 
#  Velocity and Acceleration
# 
# 
# in python 3 code for the python 3 script
# node in grasshopper for Rhino8WIP using the
# 
# Rhino Common API to create some geometry as well.
# 
# Output the parts of the model in different
# variable outputs in the python 3 node in
# grasshopper.
# 002 DIFFERENTIATION
# 006 Interpretations of the Derivatives
# 022 Velocity and Acceleration
velocity_and_acceleration = Script()  # -> out, a, b, c; disabled
# ---------- velocity_and_acceleration: Python ----------
import Rhino.Geometry as rg
import rhinoscriptsyntax as rs
import numpy as np

# Function to calculate position, velocity, and acceleration at a given time t
def calculate_motion(t):
    position = rg.Point3d(np.cos(t), np.sin(t), t)
    velocity = rg.Vector3d(-np.sin(t), np.cos(t), 1)
    acceleration = rg.Vector3d(-np.cos(t), -np.sin(t), 0)
    return position, velocity, acceleration

# Main function to create geometry and output to Grasshopper
def main(time_values):
    positions = []
    velocities = []
    accelerations = []

    for t in time_values:
        position, velocity, acceleration = calculate_motion(t)
        positions.append(position)
        velocities.append(velocity)
        accelerations.append(acceleration)

        # Create geometry in Rhino
        point = rs.AddPoint(position.X, position.Y, position.Z)
        arrow_v = rs.AddLine((position.X, position.Y, position.Z), (position.X + velocity.X, position.Y + velocity.Y, position.Z + velocity.Z))
        arrow_a = rs.AddLine((position.X, position.Y, position.Z), (position.X + acceleration.X, position.Y + acceleration.Y, position.Z + acceleration.Z))

    return positions, velocities, accelerations

# Input time values from Grasshopper
time_values = [t for t in range(0, 10)]

# Call the main function
positions, velocities, accelerations = main(time_values)

# Output results to Grasshopper
a = positions
b = velocities
c = accelerations
# ---------- end velocity_and_acceleration ----------
geometry = Geometry(velocity_and_acceleration.a)  # disabled
vector = Vector(velocity_and_acceleration.b)  # disabled
vector_2 = Vector(velocity_and_acceleration.c)  # disabled
panel_3 = Panel(velocity_and_acceleration.out)  # disabled
velocity_and_acceleration_2 = Script(a_input=multiplication, b_input=multiplication_2, c_input=multiplication_3, d_input=multiplication_4)  # -> out, a_output, b_output, c_output; inputs a_input: Double, b_input: Double, c_input: Double, d_input: Double
# ---------- velocity_and_acceleration_2: Python ----------
import Rhino.Geometry as rg
import rhinoscriptsyntax as rs
import numpy as np

# Function to calculate position, velocity, and acceleration at a given time t
def calculate_motion(t, a, b, c, d):
    x = np.real(np.exp(1j * t) * (a + b * np.cos(c * t)))
    y = np.real(np.exp(1j * t) * (a + d * np.sin(c * t)))
    z = t
    
    position = rg.Point3d(x, y, z)
    
    dx_dt = np.real(1j * np.exp(1j * t) * (a + b * np.cos(c * t)) - c * np.exp(1j * t) * d * np.sin(c * t))
    dy_dt = np.real(1j * np.exp(1j * t) * (a + d * np.sin(c * t)) + c * np.exp(1j * t) * b * np.cos(c * t))
    dz_dt = 1
    
    velocity = rg.Vector3d(dx_dt, dy_dt, dz_dt)
    
    d2x_dt2 = np.real(-c**2 * np.exp(1j * t) * d * np.cos(c * t) - c * np.exp(1j * t) * b * np.sin(c * t))
    d2y_dt2 = np.real(-c**2 * np.exp(1j * t) * b * np.sin(c * t) + c * np.exp(1j * t) * d * np.cos(c * t))
    d2z_dt2 = 0
    
    acceleration = rg.Vector3d(d2x_dt2, d2y_dt2, d2z_dt2)
    
    return position, velocity, acceleration

# Main function to create geometry and output to Grasshopper
def main(time_values, a, b, c, d):
    positions = []
    velocities = []
    accelerations = []

    for t in time_values:
        position, velocity, acceleration = calculate_motion(t, a, b, c, d)
        positions.append(position)
        velocities.append(velocity)
        accelerations.append(acceleration)

        # Create geometry in Rhino
        point = rs.AddPoint(position.X, position.Y, position.Z)
        arrow_v = rs.AddLine((position.X, position.Y, position.Z), (position.X + velocity.X, position.Y + velocity.Y, position.Z + velocity.Z))
        arrow_a = rs.AddLine((position.X, position.Y, position.Z), (position.X + acceleration.X, position.Y + acceleration.Y, position.Z + acceleration.Z))

    return positions, velocities, accelerations

# Input parameters from Grasshopper
time_values = np.linspace(0, 10, 100)
a = float(a_input)  # Replace 'a_input' with the actual input parameter name
b = float(b_input)  # Replace 'b_input' with the actual input parameter name
c = float(c_input)  # Replace 'c_input' with the actual input parameter name
d = float(d_input)  # Replace 'd_input' with the actual input parameter name

# Call the main function
positions, velocities, accelerations = main(time_values, a, b, c, d)

# Output results to Grasshopper
a_output = positions
b_output = velocities
c_output = accelerations
# ---------- end velocity_and_acceleration_2 ----------
entwine = Entwine(Branch00=geometry, Branch01=vector, Branch02=vector_2, FlattenInputs=True)  # disabled
vector_display = VectorDisplay(Anchor=geometry, Vector=vector_2)  # disabled
vector_display_2 = VectorDisplay(Anchor=geometry, Vector=vector)  # disabled
geometry_2 = Geometry(velocity_and_acceleration_2.a_output)
vector_3 = Vector(velocity_and_acceleration_2.b_output)
vector_4 = Vector(velocity_and_acceleration_2.c_output)
# gpt-4 Initial Response
# Creating a 3D model of velocity and acceleration
#  using Single-Variable Calculus involves
# visualizing the motion of an object in 3D space
# and understanding how its position, velocity, and
#  acceleration are related. In this example, I'll
# provide you with Python 3 code to create a
# simple animation of a particle's motion,
# calculating its position, velocity, and
# acceleration, and outputting the results to
# Grasshopper using the Rhino Common API.
panel_4 = Panel(entwine)  # disabled
panel_5 = Panel(velocity_and_acceleration_2.out)
entwine_2 = Entwine(Branch00=geometry_2, Branch01=vector_3, Branch02=vector_4, FlattenInputs=True)
vector_display_3 = VectorDisplay(Anchor=geometry_2, Vector=vector_4)
vector_display_4 = VectorDisplay(Anchor=geometry_2, Vector=vector_3)
panel_6 = Panel(entwine_2)
