# Grasshopper definition 023_Higher-Order_Derivatives.gh (Grasshopper 1.0.7)
# plug-ins: RhinoCodePluginGH

# ----
# Oscillation Algorithm
# The oscillation algorithm can be use to animate
# any geometry that is driven by a number sliders.
# Simply swap out the number sliders at the
# multiplication node in the oscillation script.
panel = Panel("1")  # disabled
trigger = Trigger(Interval=10, TimerInterval=10, Target=data_recorder)  # disabled
# 2nd gpt-4 Text Prompt
# Great, now make the script much more complex model
# with complex trigonometric polynomials and the
# NUMPY python library. Be sure to incorporate the previous code logic.
# ensure that this script produces 3d geometry as
# well for Data visualization purposes.
data_recorder = DataRecorder(panel, DataLimit=-10, RecordData=True)  # disabled
number_slider = Slider(100, range=0..1000)  # disabled
# gpt-4 Initial Response
# Alright! We'll create a more complex model using
#  trigonometric polynomials. Specifically, let's
# consider a function with both sine and cosine
# components, augmented by some polynomial
# terms to add complexity. I will utilize numpy for
# more efficient calculations and array operations.
list_length = ListLength(List=data_recorder)  # disabled
division = Division(A=list_length, B=number_slider)  # disabled
cosine = Cosine(Value=division)  # disabled
sine = Sine(Value=division)  # disabled
panel_2 = Panel([sine, cosine])  # disabled

# ----
# ADVANCED
# PARAMETRIC
#     f_values = a * np.sin(b * x_values) + c * np.cos(d * x_values) + e * x_values**2
#     df_values = a * b * np.cos(b * x_values) - c * d * np.sin(d * x_values) + 2 * e * x_values
#     d2f_values = -a * b**2 * np.sin(b * x_values) - c * d**2 * np.cos(d * x_values) + 2 * e
number_slider_2 = Slider(0, range=0..2)
# gpt-4 Text Prompt
# Learn Single-Variable Calculus
# with Python in Grasshopper
# at Wickerson Studios
# Create a geometric 3D model with
# 
# Single-Variable Calculus
# Differentiation
#  Higher-Order Derivatives
# 
# to create a 3D model specifically about
# 
#  Higher-Order Derivatives
# 
# 
# in python 3 code for the python 3 script
# node in grasshopper for Rhino8WIP using the
# 
# Rhino Common API to create some geometry as well.
# 
# Output the parts of the model in different
# variable outputs in the python 3 node in
# grasshopper.
# 002 DIFFERENTIATION
# 007 Higher-Order Derivatives
# 023 Higher-Order Derivatives
higher_order_derivatives = Script()  # -> out, a, b, c; disabled
# ---------- higher_order_derivatives: Python ----------
import Rhino.Geometry as rg
import math

def main_function(interval_start, interval_end, step):
    # Define the function, its first derivative, and its second derivative
    # Let's take the function as y = sin(x) for demonstration.
    
    f = lambda x: math.sin(x)
    df = lambda x: math.cos(x)  # first derivative
    d2f = lambda x: -math.sin(x)  # second derivative
    
    points = []
    derivative_points = []
    second_derivative_points = []
    
    x = interval_start
    while x <= interval_end:
        y = f(x)
        dy = df(x)
        d2y = d2f(x)
        
        points.append(rg.Point3d(x, y, 0))
        derivative_points.append(rg.Point3d(x, dy, 2))  # Displaced by 2 units in Z-axis
        second_derivative_points.append(rg.Point3d(x, d2y, 4))  # Displaced by 4 units in Z-axis
        
        x += step
    
    curve = rg.Curve.CreateInterpolatedCurve(points, 3)
    derivative_curve = rg.Curve.CreateInterpolatedCurve(derivative_points, 3)
    second_derivative_curve = rg.Curve.CreateInterpolatedCurve(second_derivative_points, 3)
    
    return curve, derivative_curve, second_derivative_curve

# Call the function
curve, derivative_curve, second_derivative_curve = main_function(0, 10, 0.1)

# The following output variables should be connected to Grasshopper output nodes
a = curve
b = derivative_curve
c = second_derivative_curve
# ---------- end higher_order_derivatives ----------
higher_order_derivatives_2 = Script(
    a=number_slider_2,
    b=Slider(2.388, range=0..10),
    c=Slider(0.15, range=0..2),
    d=Slider(3.068, range=0..10),
    e=Slider(0.214, range=0..1),
    interval_start=Slider(0, range=0..10),
    interval_end=Slider(19, range=0..100),
    step=Slider(0.052, range=0..1))  # -> out, a, b, c; inputs a: Double, b: Double, c: Double, d: Double, e: Double, interval_start: Double, interval_end: Double, step: Double
# ---------- higher_order_derivatives_2: Python ----------
import Rhino.Geometry as rg
import numpy as np

def main_function(a, b, c, d, e, interval_start, interval_end, step):
    # Define the function using numpy operations
    x_values = np.arange(interval_start, interval_end + step, step)
    
    f_values = a * np.sin(b * x_values) + c * np.cos(d * x_values) + e * x_values**2
    df_values = a * b * np.cos(b * x_values) - c * d * np.sin(d * x_values) + 2 * e * x_values
    d2f_values = -a * b**2 * np.sin(b * x_values) - c * d**2 * np.cos(d * x_values) + 2 * e
    
    points = [rg.Point3d(x, y, 0) for x, y in zip(x_values, f_values)]
    derivative_points = [rg.Point3d(x, y, 2) for x, y in zip(x_values, df_values)]  # Displaced by 2 units in Z-axis
    second_derivative_points = [rg.Point3d(x, y, 4) for x, y in zip(x_values, d2f_values)]  # Displaced by 4 units in Z-axis
    
    curve = rg.Curve.CreateInterpolatedCurve(points, 3)
    derivative_curve = rg.Curve.CreateInterpolatedCurve(derivative_points, 3)
    second_derivative_curve = rg.Curve.CreateInterpolatedCurve(second_derivative_points, 3)
    
    return curve, derivative_curve, second_derivative_curve

# Sample call
curve, derivative_curve, second_derivative_curve = main_function(a, b, c, d, e, interval_start, interval_end, step)

# The following output variables should be connected to Grasshopper output nodes
a = curve
b = derivative_curve
c = second_derivative_curve
# ---------- end higher_order_derivatives_2 ----------
geometry = Geometry(higher_order_derivatives.a)  # disabled
geometry_2 = Geometry(higher_order_derivatives.b)  # disabled
geometry_3 = Geometry(higher_order_derivatives.c)  # disabled
panel_3 = Panel(higher_order_derivatives.out)  # disabled
entwine = Entwine(Branch00=geometry, Branch01=geometry_2, Branch02=geometry_3, FlattenInputs=True)  # disabled
loft = Loft(
    Curves=flatten(entwine),
    Options={Adjust=False, Closed=False, LoftEnds=0, LoftSimp=0, LoftType=0, Rebuild=10, Refit=0.01})  # disabled
# gpt-4 Initial Response
# Using the Rhino Common API with the
# Grasshopper plugin for Rhino 8 WIP can indeed
#  allow us to create a 3D model based on the
# calculus concepts you've described. In this
# scenario, let's imagine a curve
# 
# y=f(x) in 3D space, defined over some interval
# 
# [a,b].
# 
# Our 3D model will represent:
# 
# The original curve.
# Its first derivative.
# Its second derivative.
panel_4 = Panel(entwine)  # disabled
geometry_4 = Geometry(higher_order_derivatives_2.b)
geometry_5 = Geometry(higher_order_derivatives_2.a)
geometry_6 = Geometry(higher_order_derivatives_2.c)
panel_5 = Panel(higher_order_derivatives_2.out)
entwine_2 = Entwine(Branch00=geometry_5, Branch01=geometry_4, Branch02=geometry_6, FlattenInputs=True)
loft_2 = Loft(
    Curves=flatten(entwine_2),
    Options={Adjust=False, Closed=False, LoftEnds=0, LoftSimp=0, LoftType=0, Rebuild=10, Refit=0.01})
panel_6 = Panel(entwine_2)
