# Grasshopper definition 024_Differential_Equations_Initial-Value_Problems.gh (Grasshopper 1.0.7)
# plug-ins: RhinoCodePluginGH

# ----
# Oscillation Algorithm
# The oscillation algorithm can be use to animate
# any geometry that is driven by a number sliders.
# Simply swap out the number sliders at the
# multiplication node in the oscillation script.
trigger = Trigger(Interval=10, TimerInterval=10, Target=data_recorder)  # disabled
panel = Panel("1")  # disabled
data_recorder = DataRecorder(panel, DataLimit=-10, RecordData=True)  # disabled
number_slider = Slider(288, range=0..1000)  # disabled
list_length = ListLength(List=data_recorder)  # disabled
division = Division(A=list_length, B=number_slider)  # disabled
cosine = Cosine(Value=division)  # disabled
sine = Sine(Value=division)  # disabled
# Ah, this is a common issue. The error suggests
# that the SciPy library isn't installed in the
# environment Rhino is using.
# 
# However, even if you could install SciPy, it's not
# guaranteed that Rhino's embedded IronPython
#  interpreter would support it, as IronPython often
# has issues with libraries that have C extensions,
# like SciPy.
# 
# So, let's solve the differential equations without
# relying on external libraries like SciPy. We'll
# implement a simple Euler's method for
# integration. It's not as accurate as the methods
#  in SciPy, but it's illustrative and should be good
#  enough for visualization purposes.
panel_2 = Panel([sine, cosine])  # disabled

multiplication = Multiplication()  # disabled
number_slider_2 = Slider(2.174, range=0..10)
multiplication_2 = Multiplication(A=number_slider_2, B=sine)  # disabled

# ---- group: Initial values [x0, y0, z0] for the Lorenz system.
number_slider_3 = Slider(1, range=0..1)
number_slider_4 = Slider(1, range=0..1)
number_slider_5 = Slider(1, range=0..1)

# ----
# PARAMETRIC
# Let's make the script parametric by allowing
# users to input various parameters that define
# the behavior of the Lorenz system and the
# visualization.
number_slider_6 = Slider(10, range=0..10)
# gpt-4 Text Prompt
# Learn Single-Variable Calculus
# with Python in Grasshopper
# at Wickerson Studios
# Create a geometric 3D model with
# 
# Single-Variable Calculus
# Differentiation
# Antiderivatives and Indefinite Integrals
# 
# to create a 3D model specifically about
# 
# Differential Equations and Initial-Value Problems
# 
# 
# in python 3 code for the python 3 script
# node in grasshopper for Rhino8WIP using the
# 
# Rhino Common API to create some geometry as well.
# 
# Output the parts of the model in different
# variable outputs in the python 3 node in
# grasshopper.
# 002 DIFFERENTIATION
# 008 Antiderivatives and Indefinite Integrals
# 024 Differential Equations and Initial-Value Problems
# ADVANCED
# 2nd gpt-4 Text Prompt
# Great, now make the script much more complex model
# with complex trigonometric polynomials and the
# NUMPY python library. Be sure to incorporate the previous code logic.
# ensure that this script produces 3d geometry as
# well for Data visualization purposes.
# gpt-4 Initial Response
differential_equations_and_initial_value = Script()  # -> out, curve_output; "Differential Equations and Initial-Value Problems"; disabled
# ---------- differential_equations_and_initial_value: Python ----------
import Rhino
import math
import rhinoscriptsyntax as rs

def differential_equation(t, c=0.1, a=0.1):
    # dx/dt = cos(t)
    # dy/dt = sin(t)
    # dz/dt = c * t
    x = a * t * math.cos(t)
    y = a * t * math.sin(t)
    z = c * t
    return x, y, z

def create_spiral_curve(steps=1000, t_increment=0.1):
    points = []
    for i in range(steps):
        t = i * t_increment
        x, y, z = differential_equation(t)
        points.append(Rhino.Geometry.Point3d(x, y, z))
    return Rhino.Geometry.Curve.CreateInterpolatedCurve(points, 3)

def main():
    spiral_curve = create_spiral_curve()
    if spiral_curve:
        return spiral_curve
    else:
        print("Failed to create the curve.")
        return None

# Call the main function
curve_output = main()
# ---------- end differential_equations_and_initial_value ----------
division_2 = Division(A=Slider(8, range=0..10), B=number_slider_2)
geometry = Geometry(differential_equations_and_initial_value.curve_output)  # disabled
panel_3 = Panel(differential_equations_and_initial_value.out)  # disabled
differential_equations_and_initial_value_2 = Script(
    σ=number_slider_6,
    ρ=Slider(25.76, range=0..100),
    β=division_2,
    initial_values=[number_slider_3, number_slider_4, number_slider_5],
    t_end=Slider(2.51, range=0..10),
    num_steps=Slider(100, range=0..100))  # -> out, curve_output; "Differential Equations and Initial-Value Problems"; inputs σ: Double, ρ: Double, β: Double, initial_values: list of Double, t_end: Double, num_steps: Int32
# ---------- differential_equations_and_initial_value_2: Python ----------
import Rhino
import numpy as np
import rhinoscriptsyntax as rs

def lorenz_system(Y, σ, ρ, β):
    """Compute the right-hand side of the Lorenz system."""
    x, y, z = Y
    dx = σ * (y - x)
    dy = x * (ρ - z) - y
    dz = x * y - β * z
    return np.array([dx, dy, dz])

def euler_method(func, y0, t, σ, ρ, β):
    """Simple Euler integration method."""
    dt = t[1] - t[0]
    y = np.zeros((len(t), len(y0)))
    y[0] = y0

    for i in range(1, len(t)):
        y[i] = y[i-1] + func(y[i-1], σ, ρ, β) * dt
        
    return y

def create_curve_from_solution(solution):
    points = [Rhino.Geometry.Point3d(x, y, z) for x, y, z in solution]
    return Rhino.Geometry.Curve.CreateInterpolatedCurve(points, 3)

def main(σ=σ, ρ=ρ, β=β, initial_values=initial_values, t_end=t_end, num_steps=num_steps):
    t = np.linspace(0, t_end, num_steps)  # Time values

    solution = euler_method(lorenz_system, initial_values, t, σ, ρ, β)
    curve = create_curve_from_solution(solution)
    
    if curve:
        return curve
    else:
        print("Failed to create the curve.")
        return None

# Call the main function with default values (can be replaced with user input in Grasshopper)
curve_output = main()
# ---------- end differential_equations_and_initial_value_2 ----------
entwine = Entwine(Branch00=geometry, FlattenInputs=True)  # disabled
# gpt-4 Initial Response
# Creating a 3D geometric model using differential
#  equations in Python requires a few steps. For
# the sake of this example, I will consider a simple
# differential equation representing a spiraling
# curve in 3D space. The geometry will then be
# constructed in Rhino using the Rhino Common
# API and the output will be parsed for Grasshopper.
panel_4 = Panel(entwine)  # disabled
geometry_2 = Geometry(differential_equations_and_initial_value_2.curve_output)
panel_5 = Panel(differential_equations_and_initial_value_2.out)
entwine_2 = Entwine(Branch00=geometry_2, FlattenInputs=True)
panel_6 = Panel(entwine_2)
