# Grasshopper definition 025_Cosine_Sine_Special_Angles.gh (Grasshopper 1.0.7)
# plug-ins: RhinoCodePluginGH

# ----
# Oscillation Algorithm
# The oscillation algorithm can be use to animate
# any geometry that is driven by a number sliders.
# Simply swap out the number sliders at the
# multiplication node in the oscillation script.
trigger = Trigger(Interval=10, TimerInterval=10, Target=data_recorder)  # disabled
panel = Panel("1")  # disabled
# 2nd gpt-4 Text Prompt
# Great, now make the script much more complex model
# with complex trigonometric polynomials and the
# NUMPY python library. Be sure to incorporate the previous code logic.
# ensure that this script produces 3d geometry as
# well for Data visualization purposes.
data_recorder = DataRecorder(panel, DataLimit=-10, RecordData=True)  # disabled
number_slider = Slider(288, range=0..1000)  # disabled
# Alright! We'll create a complex model using
# trigonometric polynomials, taking advantage of
# the numpy library for our mathematical
# operations. To make the model more intricate,
# we can generate a surface where the u direction
#  is based on the angle (like before) and the v
# direction is based on another parameter that will
#  vary the frequency of our sine and cosine
# functions.
# 
# To visualize the complex behavior of these
# trigonometric polynomials, let's generate a
# surface where the height (Z-direction)
# represents the value of our polynomial.
list_length = ListLength(List=data_recorder)  # disabled
division = Division(A=list_length, B=number_slider)  # disabled
cosine = Cosine(Value=division)  # disabled
sine = Sine(Value=division)  # disabled
# gpt-4 Initial Response
panel_2 = Panel([sine, cosine])  # disabled
multiplication = Multiplication()  # disabled
multiplication_2 = Multiplication(B=sine)  # disabled

# ----
# gpt-4 Text Prompt
# Learn Single-Variable Calculus
# with Python in Grasshopper
# at Wickerson Studios
# Create a geometric 3D model with
# 
# Single-Variable Calculus
#  THE ELEMENTARY
# TRANSCENDENTAL FUNCTIONS
# The Circular (Trigonometric) Functions
# 
# to create a 3D model specifically about
# 
# Cosine and Sine of Special Angles
# 
# 
# in python 3 code for the python 3 script
# node in grasshopper for Rhino8WIP using the
# 
# Rhino Common API to create some geometry as well.
# 
# Output the parts of the model in different
# variable outputs in the python 3 node in
# grasshopper.
# 003 THE ELEMENTARY
# TRANSCENDENTAL FUNCTIONS
# 001 The Circular (Trigonometric) Functions
# 025 Cosine and Sine of Special Angles
# ADVANCED
# PARAMETRIC
# Let's make the script parametric by allowing
# users to input various parameters that define
# the behavior of the Lorenz system and the
# visualization.
cosine_and_sine_of_special_angles = Script()  # -> out, a; disabled
# ---------- cosine_and_sine_of_special_angles: Python ----------
import Rhino.Geometry as rg
import math

def create_trigonometric_spiral():
    """Generates a 3D helix-like curve based on the sine and cosine functions"""
    points = []  # list to store the points of our curve

    # Start at 0 degrees (0 radians) and go up to, say, 720 degrees (4*pi radians)
    # This gives us two full circles.
    for x in range(0, 720, 5):  # 5-degree increments
        radians = math.radians(x)
        
        y = math.sin(radians)  # compute the sine of the angle
        z = math.cos(radians)  # compute the cosine of the angle
        
        point = rg.Point3d(x/10.0, y*10, z*10)  # create a 3D point
        points.append(point)  # add the point to our list

    curve = rg.Curve.CreateInterpolatedCurve(points, 3)  # interpolate a curve through the points with degree 3
    return curve

# Call the function
curve = create_trigonometric_spiral()

# Outputs for Grasshopper
a = curve
# ---------- end cosine_and_sine_of_special_angles ----------
geometry = Geometry(cosine_and_sine_of_special_angles.a)  # disabled
panel_3 = Panel(cosine_and_sine_of_special_angles.out)  # disabled
cosine_and_sine_of_special_angles_2 = Script()  # -> out, a; disabled
# ---------- cosine_and_sine_of_special_angles_2: Python ----------
import Rhino.Geometry as rg
import numpy as np
import math

def create_complex_trigonometric_surface():
    """Generates a 3D surface based on complex trigonometric polynomials"""
    
    # Define the range for our u and v parameters
    u_count = 100  # number of divisions in the u direction
    v_count = 100  # number of divisions in the v direction
    u_range = np.linspace(0, 4 * np.pi, u_count)  # angle
    v_range = np.linspace(1, 10, v_count)        # frequency

    curves = []  # list to store our curves

    for i, u in enumerate(u_range):
        points = []  # list to store points for the current curve
        
        for j, v in enumerate(v_range):
            # Calculate the trigonometric polynomial value
            z = math.sin(v * u) + math.cos(v * u) + np.sin(2 * v * u) + np.cos(2 * v * u)
            
            # Create the point and add it to the points list
            point = rg.Point3d(u, v, z)
            points.append(point)
        
        # Create a curve through the points and add it to the curves list
        curve = rg.Curve.CreateInterpolatedCurve(points, 3)
        curves.append(curve)

    # Loft between the curves to create our surface
    lofts = rg.Brep.CreateFromLoft(curves, rg.Point3d.Unset, rg.Point3d.Unset, rg.LoftType.Normal, False)
    
    # For simplicity, we'll return just the first lofted surface (assuming successful lofting)
    return lofts[0] if len(lofts) > 0 else None

# Call our function
surface = create_complex_trigonometric_surface()

# Outputs for Grasshopper
a = surface
# ---------- end cosine_and_sine_of_special_angles_2 ----------
entwine = Entwine(Branch00=geometry, FlattenInputs=True)  # disabled
geometry_2 = Geometry(cosine_and_sine_of_special_angles_2.a)  # disabled
# gpt-4 Initial Response
# To create a 3D geometric model based on the
#  sine and cosine functions, we'll:
# 
# Generate a helix-like curve where the x position
# represents the angle and the y and z positions
# represent the sine and cosine values,
# respectively. This gives us a good visual
# representation of how these functions behave.
# Use the Rhino Common API to create this curve
#  and define it as a geometry.
panel_4 = Panel(entwine)  # disabled
panel_5 = Panel(cosine_and_sine_of_special_angles_2.out)  # disabled
entwine_2 = Entwine(Branch00=geometry_2, FlattenInputs=True)  # disabled
panel_6 = Panel(entwine_2)  # disabled
