# Grasshopper definition 026_The_Addition_Formulas.gh (Grasshopper 1.0.7)
# plug-ins: RhinoCodePluginGH

# ----
# Oscillation Algorithm
# The oscillation algorithm can be use to animate
# any geometry that is driven by a number sliders.
# Simply swap out the number sliders at the
# multiplication node in the oscillation script.
trigger = Trigger(Interval=10, TimerInterval=10, Target=data_recorder)  # disabled
panel = Panel("1")  # disabled
# 2nd gpt-4 Text Prompt
# Great, now make the script much more complex model
# with complex trigonometric polynomials and the
# NUMPY python library. Be sure to incorporate the previous code logic.
# ensure that this script produces 3d geometry as
# well for Data visualization purposes.
data_recorder = DataRecorder(panel, DataLimit=-10, RecordData=False)  # disabled
number_slider = Slider(288, range=0..1000)  # disabled
# gpt-4 Initial Response
# Alright! I'll create a 3D parametric model that
# showcases the addition and subtraction
# formulas for sine and cosine. Let's use these
# formulas to create a pattern of points in 3D
# space:
list_length = ListLength(List=data_recorder)  # disabled
division = Division(A=list_length, B=number_slider)  # disabled
cosine = Cosine(Value=division)  # disabled
sine = Sine(Value=division)  # disabled
panel_2 = Panel([sine, cosine])  # disabled
multiplication = Multiplication(A=cosine)  # disabled
multiplication_2 = Multiplication(B=sine)  # disabled

# ----
# ADVANCED
# PARAMETRIC
#             z_sin_add = origin.Z + math.sin(s + t)
#             z_cos_add = origin.Z + math.cos(s + t)
#             z_sin_sub = origin.Z + math.sin(s - t)
#             z_cos_sub = origin.Z + math.cos(s - t)
gene_pool = GenePool(Decimals=2, Maximum=3, Minimum=0, Value=[1.7, 1.51, 0.4])
number_slider_2 = Slider(50, range=0..100)
gene_pool_2 = GenePool(Decimals=2, Maximum=3, Minimum=0, Value=[2.32, 1.3, 0.32])
# gpt-4 Text Prompt
# Learn Single-Variable Calculus
# with Python in Grasshopper
# at Wickerson Studios
# Create a geometric 3D model with
# 
# Single-Variable Calculus
#  THE ELEMENTARY
# TRANSCENDENTAL FUNCTIONS
# The Circular (Trigonometric) Functions
# 
# to create a 3D model specifically about
# 
# Cosine and Sine: the Addition Formulas
# 
# 
# in python 3 code for the python 3 script
# node in grasshopper for Rhino8WIP using the
# 
# Rhino Common API to create some geometry as well.
# 
# Output the parts of the model in different
# variable outputs in the python 3 node in
# grasshopper.
# 003 THE ELEMENTARY
# TRANSCENDENTAL FUNCTIONS
# 001 The Circular (Trigonometric) Functions
# 025 Cosine and Sine: the Addition Formulas
cosine_and_sine_the_additon_formulas = Script()  # -> out, a; disabled
# ---------- cosine_and_sine_the_additon_formulas: Python ----------
import Rhino.Geometry as rg
import math

def create_spiral(origin, start_angle, revolutions, delta_angle, z_increment):
    points = []
    
    for i in range(int(revolutions*360/delta_angle)):
        theta = math.radians(i*delta_angle)
        x = math.cos(theta + start_angle) * (math.cos(theta) - math.sin(theta))
        y = math.sin(theta + start_angle) * (math.cos(theta) + math.sin(theta))
        z = i * z_increment
        points.append(origin + rg.Point3d(x, y, z))
    
    return rg.Polyline(points)

# Variables
origin = rg.Point3d(0, 0, 0)
start_angle = 0
revolutions = 10
delta_angle = 5
z_increment = 0.05

# Call the function
spiral = create_spiral(origin, start_angle, revolutions, delta_angle, z_increment)

# Outputs
a = spiral
# ---------- end cosine_and_sine_the_additon_formulas ----------
gene_pool_3 = GenePool(Decimals=2, Maximum=3, Minimum=0, Value=[0, 1.757734699, 2.34])
gene_pool_4 = GenePool(Decimals=2, Maximum=3, Minimum=0, Value=[3, 3, 0.47])
geometry = Geometry(cosine_and_sine_the_additon_formulas.a)  # disabled
panel_3 = Panel(cosine_and_sine_the_additon_formulas.out)  # disabled
entwine = Entwine(Branch00=geometry, FlattenInputs=True)  # disabled
cosine_and_sine_the_additon_formulas_2 = Script(
    count_s=number_slider_2,
    count_t=Slider(50, range=0..100),
    step_s=Slider(0.5, range=0..1),
    step_t=Slider(0.5, range=0..1),
    coefA=gene_pool,
    coefB=gene_pool_2,
    coefC=gene_pool_3,
    coefD=gene_pool_4)  # -> out, a; inputs count_s: Int32, count_t: Int32, step_s: Double, step_t: Double, coefA: list of Double, coefB: list of Double, coefC: list of Double, coefD: list of Double
# ---------- cosine_and_sine_the_additon_formulas_2: Python ----------
import Rhino.Geometry as rg
import numpy as np

def generate_complex_pattern(origin, count_s, count_t, step_s, step_t, coefficients):
    points_complex = []

    for i in range(count_s):
        for j in range(count_t):
            s = i * step_s
            t = j * step_t

            x = origin.X + s
            y = origin.Y + t

            # Complex trigonometric polynomial using Fourier series approach
            complex_value = sum([coeff * np.exp(1j * (n * s + m * t)) for n, m, coeff in coefficients])
            z_complex = origin.Z + complex_value.real

            points_complex.append(rg.Point3d(x, y, z_complex))
    
    return points_complex

# Variables
origin = rg.Point3d(0, 0, 0)
"""
count_s = 50
count_t = 50
step_s = 0.1
step_t = 0.1
"""

# Coefficients for the Fourier series (n, m, coefficient)
coefficients = [(coefA), (coefB), (coefC), (coefD)]

# Call the function
points_complex = generate_complex_pattern(origin, count_s, count_t, step_s, step_t, coefficients)

# Outputs
a = points_complex
# ---------- end cosine_and_sine_the_additon_formulas_2 ----------
geometry_2 = Geometry(cosine_and_sine_the_additon_formulas_2.a)
# gpt-4 Initial Response
# Certainly! The Addition Formulas for Sine and Cosine are:
# 
# sin(A+B)=sin(A)cos(B)+cos(A)sin(B)
# 
# cos(A+B)=cos(A)cos(B)−sin(A)sin(B)
panel_4 = Panel(entwine)  # disabled
surface_from_points = SurfaceFromPoints(Points=geometry_2, UCount=number_slider_2, Interpolate=False)
panel_5 = Panel(cosine_and_sine_the_additon_formulas_2.out)
entwine_2 = Entwine(Branch00=geometry_2, FlattenInputs=True)
panel_6 = Panel(entwine_2)
