# Grasshopper definition 027_Other_Trigonometric_Functions.gh (Grasshopper 1.0.7)
# plug-ins: RhinoCodePluginGH

# ----
# Oscillation Algorithm
# The oscillation algorithm can be use to animate
# any geometry that is driven by a number sliders.
# Simply swap out the number sliders at the
# multiplication node in the oscillation script.
trigger = Trigger(Interval=10, TimerInterval=10, Target=data_recorder)  # disabled
panel = Panel("1")  # disabled
# 2nd gpt-4 Text Prompt
# Great, now make the script much more complex model
# with complex trigonometric polynomials and the
# NUMPY python library. Be sure to incorporate the previous code logic.
# ensure that this script produces 3d geometry as
# well for Data visualization purposes.
data_recorder = DataRecorder(panel, DataLimit=-10, RecordData=False)  # disabled
number_slider = Slider(288, range=0..1000)  # disabled
# gpt-4 Initial Response
# Sure, let's build on the previous code by
# introducing more complex trigonometric
# polynomials using the numpy library and
# incorporating some advanced 3D visualization
# concepts.
list_length = ListLength(List=data_recorder)  # disabled
division = Division(A=list_length, B=number_slider)  # disabled
cosine = Cosine(Value=division)  # disabled
sine = Sine(Value=division)  # disabled
panel_2 = Panel([sine, cosine])  # disabled
multiplication = Multiplication(A=cosine)  # disabled
multiplication_2 = Multiplication(B=sine)  # disabled

# ---- group: z_offsets
number_slider_2 = Slider(1.05, range=0..10)
number_slider_3 = Slider(2.54, range=0..10)
number_slider_4 = Slider(3.56, range=0..10)
number_slider_5 = Slider(6.83, range=0..10)
number_slider_6 = Slider(10, range=0..10)
number_slider_7 = Slider(7.58, range=0..10)

# ----
# ADVANCED
# PARAMETRIC
number_slider_8 = Slider(-2, range=-2..2)
# gpt-4 Text Prompt
# Create a geometric 3D model with
# 
# Single-Variable Calculus
#  THE ELEMENTARY
# TRANSCENDENTAL FUNCTIONS
# The Circular (Trigonometric) Functions
# 
# to create a 3D model specifically about
# 
# Other Trigonometric Functions
# tan, cot, sec, csc
# 
# 
# in python 3 code for the python 3 script
# node in grasshopper for Rhino8WIP using the
# 
# Rhino Common API to create some geometry as well.
# 
# Output the parts of the model in different
# variable outputs in the python 3 node in
# grasshopper.
# 001 The Circular (Trigonometric) Functions
# 026 Other Trigonometric Functions
# tan, cot, sec, csc
tan_cot_sec_csc = Script()  # -> out, tanOutput, cotOutput, secOutput, cscOutput
# ---------- tan_cot_sec_csc: Python ----------
import Rhino.Geometry as rg
import math

def create3DModel():
    # Definitions
    step = 0.05
    domain = [(i*step) for i in range(int(-math.pi/2/step)+1, int(math.pi/2/step))]
    
    # 1. Model for tan function
    tan_points = []
    for x in domain:
        try:
            y = math.tan(x)
            if abs(y) < 10: # Filter out very large values to avoid extreme geometry
                tan_points.append(rg.Point3d(x, y, 0))
        except:
            pass
    tan_curve = rg.Curve.CreateInterpolatedCurve(tan_points, 3)
    
    # 2. Model for cot function (cotangent is the reciprocal of tangent)
    cot_points = []
    for x in domain:
        try:
            y = 1/math.tan(x)
            if abs(y) < 10: # Filter out very large values to avoid extreme geometry
                cot_points.append(rg.Point3d(x, y, 1)) # Z offset for visual distinction
        except:
            pass
    cot_curve = rg.Curve.CreateInterpolatedCurve(cot_points, 3)
    
    # 3. Model for sec function (secant is the reciprocal of cosine)
    sec_points = []
    for x in domain:
        try:
            y = 1/math.cos(x)
            if abs(y) < 10: # Filter out very large values to avoid extreme geometry
                sec_points.append(rg.Point3d(x, y, 2)) # Z offset for visual distinction
        except:
            pass
    sec_curve = rg.Curve.CreateInterpolatedCurve(sec_points, 3)
    
    # 4. Model for csc function (cosecant is the reciprocal of sine)
    csc_points = []
    for x in domain:
        try:
            y = 1/math.sin(x)
            if abs(y) < 10: # Filter out very large values to avoid extreme geometry
                csc_points.append(rg.Point3d(x, y, 3)) # Z offset for visual distinction
        except:
            pass
    csc_curve = rg.Curve.CreateInterpolatedCurve(csc_points, 3)
    
    return tan_curve, cot_curve, sec_curve, csc_curve

# Outputs for Grasshopper node
tanOutput, cotOutput, secOutput, cscOutput = create3DModel()
# ---------- end tan_cot_sec_csc ----------
pi = Pi(Factor=number_slider_8)
pi_2 = Pi(Factor=Slider(2, range=-2..2))
geometry = Geometry(tan_cot_sec_csc.tanOutput)
geometry_2 = Geometry(tan_cot_sec_csc.cotOutput)
geometry_3 = Geometry(tan_cot_sec_csc.secOutput)
geometry_4 = Geometry(tan_cot_sec_csc.cscOutput)
# Learn Single-Variable Calculus
# with Python in Grasshopper
# at Wickerson Studios
# 003 THE ELEMENTARY
# TRANSCENDENTAL FUNCTIONS
panel_3 = Panel(tan_cot_sec_csc.out)  # disabled
entwine = Entwine(Branch00=geometry, Branch01=geometry_2, Branch02=geometry_3, Branch03=geometry_4, FlattenInputs=True)
tan_cot_sec_csc_2 = Script(
    domain_start=pi,
    domain_end=pi_2,
    step=Slider(1.82, range=0..2),
    A=number_slider_2,
    B=number_slider_3,
    C=number_slider_4,
    D=number_slider_5,
    E=number_slider_7,
    F=number_slider_6)  # -> out, tanOutput, cotOutput, secOutput, cscOutput; inputs domain_start: Double, domain_end: Double, step: Double, A: Double, B: Double, C: Double, D: Double, E: Double, F: Double
# ---------- tan_cot_sec_csc_2: Python ----------
import Rhino.Geometry as rg
import math
import numpy as np

def trig_poly(x, coefficients):
    '''Trigonometric Polynomial'''
    num_terms = len(coefficients)
    z = 0
    for i in range(num_terms):
        if i % 2 == 0:  # Even index, sin function
            z += coefficients[i] * math.sin((i//2 + 1) * x)
        else:  # Odd index, cos function
            z += coefficients[i] * math.cos((i//2 + 1) * x)
    return z

def create3DModel(domain_start=-domain_start, domain_end=domain_end*math.pi, step=step,
                  z_offsets={"tan":A, "cot":B, "sec":C, "csc":D, "poly":E},
                  poly_coefficients=[0, 3, 1, 0.5]):
    
    domain = [i*step for i in range(int(domain_start/step), int(domain_end/step))]
    
    tan_points = []
    cot_points = []
    sec_points = []
    csc_points = []
    poly_points = []

    for x in domain:
        # Basic Trigonometric Functions
        try:
            y_tan = math.tan(x)
            if abs(y_tan) < 10: 
                tan_points.append(rg.Point3d(x, y_tan, z_offsets["tan"]))
        except:
            pass
        
        try:
            y_cot = 1/math.tan(x)
            if abs(y_cot) < 10: 
                cot_points.append(rg.Point3d(x, y_cot, z_offsets["cot"]))
        except:
            pass
        
        try:
            y_sec = 1/math.cos(x)
            if abs(y_sec) < 10: 
                sec_points.append(rg.Point3d(x, y_sec, z_offsets["sec"]))
        except:
            pass
        
        try:
            y_csc = 1/math.sin(x)
            if abs(y_csc) < 10: 
                csc_points.append(rg.Point3d(x, y_csc, z_offsets["csc"]))
        except:
            pass

        # Trigonometric Polynomial
        y_poly = trig_poly(x, poly_coefficients)
        poly_points.append(rg.Point3d(x, y_poly, z_offsets["poly"]))

    # Create Curves
    tan_curve = rg.Curve.CreateInterpolatedCurve(tan_points, 3)
    cot_curve = rg.Curve.CreateInterpolatedCurve(cot_points, 3)
    sec_curve = rg.Curve.CreateInterpolatedCurve(sec_points, 3)
    csc_curve = rg.Curve.CreateInterpolatedCurve(csc_points, 3)
    poly_curve = rg.Curve.CreateInterpolatedCurve(poly_points, 3)
    
    return tan_curve, cot_curve, sec_curve, csc_curve, poly_curve

# To call the function with default values and get outputs for Grasshopper node:
tanOutput, cotOutput, secOutput, cscOutput, polyOutput = create3DModel()
# ---------- end tan_cot_sec_csc_2 ----------
# gpt-4 Initial Response
# Sure, I'll help you craft a simple 3D model using
# the additional trigonometric functions with the
# help of Python 3 for the Grasshopper Python
# script node in Rhino8WIP.
panel_4 = Panel(entwine)  # disabled
geometry_5 = Geometry(tan_cot_sec_csc_2.tanOutput)
geometry_6 = Geometry(tan_cot_sec_csc_2.cotOutput)
geometry_7 = Geometry(tan_cot_sec_csc_2.secOutput)
geometry_8 = Geometry(tan_cot_sec_csc_2.cscOutput)
panel_5 = Panel(tan_cot_sec_csc_2.out)
entwine_2 = Entwine(Branch00=geometry_5, Branch01=geometry_6, Branch02=geometry_7, Branch03=geometry_8, FlattenInputs=True)
loft = Loft(
    Curves=flatten(entwine_2),
    Options={Adjust=False, Closed=False, LoftEnds=0, LoftSimp=0, LoftType=0, Rebuild=10, Refit=0.01})
panel_6 = Panel(entwine_2)
