# Grasshopper definition 028_Sine_Law_and_Cosine_Law.gh (Grasshopper 1.0.7)
# plug-ins: RhinoCodePluginGH

# ----
# Oscillation Algorithm
# The oscillation algorithm can be use to animate
# any geometry that is driven by a number sliders.
# Simply swap out the number sliders at the
# multiplication node in the oscillation script.
trigger = Trigger(Interval=10, TimerInterval=10, Target=data_recorder)  # disabled
panel = Panel("1")  # disabled
# 2nd gpt-4 Text Prompt
# Great, now make the script much more complex model
# with complex trigonometric polynomials and the
# NUMPY python library. Be sure to incorporate the previous code logic.
# ensure that this script produces 3d geometry as
# well for Data visualization purposes.
data_recorder = DataRecorder(panel, DataLimit=-10, RecordData=False)  # disabled
number_slider = Slider(288, range=0..1000)  # disabled
# gpt-4 Initial Response
# Certainly! Let's create a more complex 3D
# visualization using numpy and trigonometric
# polynomials, incorporating the logic from the
# previous script:
list_length = ListLength(List=data_recorder)  # disabled
division = Division(A=list_length, B=number_slider)  # disabled
cosine = Cosine(Value=division)  # disabled
sine = Sine(Value=division)  # disabled
panel_2 = Panel([sine, cosine])  # disabled
multiplication = Multiplication(A=cosine)  # disabled
multiplication_2 = Multiplication(B=sine)  # disabled

# ----
# ADVANCED
# PARAMETRIC
sine_law_and_cosine_law = Script()  # -> out, triangle_pline, outArcs, output3, output4, output5; inputs A: Double, B: Double, C: Double; disabled
# ---------- sine_law_and_cosine_law: Python ----------
import Rhino.Geometry as rg
import math

# Generate a triangle given two sides (a, b) and an included angle (C)
def generate_triangle(a, b, C):
    A_pt = rg.Point3d(0, 0, 0)
    B_pt = rg.Point3d(a, 0, 0)
    c = math.sqrt(a**2 + b**2 - 2*a*b*math.cos(C))
    C_angle = math.asin(b * math.sin(C) / c)
    C_pt = rg.Point3d(b * math.cos(C_angle), b * math.sin(C_angle), 0)
    return rg.Polyline([A_pt, B_pt, C_pt, A_pt])

# Parameters
a = 5
b = 7
C = math.radians(50)  # Angle in radians

triangle = generate_triangle(a, b, C)

# Sine Law Arcs
A_angle = math.asin(a * math.sin(C) / b)
arc_A = rg.Arc(triangle[0], triangle[0] + rg.Vector3d(0, a / math.sin(A_angle), 0), triangle[1])
arc_B = rg.Arc(triangle[1], triangle[1] + rg.Vector3d(0, b / math.sin(C), 0), triangle[2])

# Outputs
triangle_pline = triangle.ToNurbsCurve()
outArcs = [arc_A, arc_B]
# ---------- end sine_law_and_cosine_law ----------
sine_law_and_cosine_law_2 = Script()  # -> out, triangle_pline, outMesh; inputs A: Double, B: Double, C: Double; disabled
# ---------- sine_law_and_cosine_law_2: Python ----------
import Rhino.Geometry as rg
import numpy as np
import math

def generate_triangle(a, b, C):
    A_pt = rg.Point3d(0, 0, 0)
    B_pt = rg.Point3d(a, 0, 0)
    c = math.sqrt(a**2 + b**2 - 2*a*b*math.cos(C))
    C_angle = math.asin(b * math.sin(C) / c)
    C_pt = rg.Point3d(b * math.cos(C_angle), b * math.sin(C_angle), 0)
    return rg.Polyline([A_pt, B_pt, C_pt, A_pt])

# Trigonometric polynomial surface function
def trig_surface(u, v, a, b):
    z = a * np.sin(u) * np.cos(v) + b * np.sin(v) * np.cos(u)
    return z

# Parameters
a = 5
b = 7
C = math.radians(50)  # Angle in radians

triangle = generate_triangle(a, b, C)

# Generate surface
u = np.linspace(0, 2 * np.pi, 100)
v = np.linspace(0, 2 * np.pi, 100)
u, v = np.meshgrid(u, v)
z = trig_surface(u, v, a, b)

# Convert numpy arrays to Rhino mesh
mesh = rg.Mesh()
for i in range(u.shape[0]):
    for j in range(u.shape[1]):
        mesh.Vertices.Add(rg.Point3d(u[i, j], v[i, j], z[i, j]))

for i in range(u.shape[0] - 1):
    for j in range(u.shape[1] - 1):
        mesh.Faces.AddFace(i * u.shape[1] + j, i * u.shape[1] + j + 1, (i + 1) * u.shape[1] + j + 1, (i + 1) * u.shape[1] + j)

# Outputs
outTriangle = triangle.ToNurbsCurve()
outMesh = mesh
# ---------- end sine_law_and_cosine_law_2 ----------
# gpt-4 Text Prompt
# Learn Single-Variable Calculus
# with Python in Grasshopper
# at Wickerson Studios
# Create a geometric 3D model with
# 
# Single-Variable Calculus
#  THE ELEMENTARY
# TRANSCENDENTAL FUNCTIONS
# The Circular (Trigonometric) Functions
# 
# to create a 3D model specifically about
# 
# The Sine Law and the Cosine Law
# 
# 
# in python 3 code for the python 3 script
# node in grasshopper for Rhino8WIP using the
# 
# Rhino Common API to create some geometry as well.
# 
# Output the parts of the model in different
# variable outputs in the python 3 node in
# grasshopper.
# 003 THE ELEMENTARY
# TRANSCENDENTAL FUNCTIONS
# 001 The Circular (Trigonometric) Functions
# 028 Sine Law and Cosine Law
sine_law_and_cosine_law_3 = Script()  # -> out, triangle_out, arcs_out, plane_out; inputs A: Double, B: Double, C: Double; disabled
# ---------- sine_law_and_cosine_law_3: Python ----------
import Rhino.Geometry as rg
import math

def triangle_angles(A, B, C):
    """Calculate the angles of the triangle."""
    a = B.DistanceTo(C)
    b = A.DistanceTo(C)
    c = A.DistanceTo(B)
    
    alpha = math.acos((b**2 + c**2 - a**2) / (2*b*c))
    beta = math.acos((a**2 + c**2 - b**2) / (2*a*c))
    gamma = math.acos((a**2 + b**2 - c**2) / (2*a*b))
    
    return alpha, beta, gamma

def sine_law_arcs(A, B, C):
    """Function to create arcs based on the sine law."""
    alpha, beta, gamma = triangle_angles(A, B, C)
    a = B.DistanceTo(C)
    b = A.DistanceTo(C)
    c = A.DistanceTo(B)
    
    arc_A = rg.Circle(A, b * math.sin(alpha)).ToNurbsCurve()
    arc_B = rg.Circle(B, c * math.sin(beta)).ToNurbsCurve()
    arc_C = rg.Circle(C, a * math.sin(gamma)).ToNurbsCurve()

    return arc_A, arc_B, arc_C

def cosine_law_plane(A, B, C):
    """Function to create a plane based on the cosine law."""
    centroid = rg.Point3d((A.X + B.X + C.X) / 3, (A.Y + B.Y + C.Y) / 3, (A.Z + B.Z + C.Z) / 3)
    normal = rg.Vector3d.CrossProduct(B-A, C-A)
    plane = rg.Plane(centroid, normal)
    return plane

# Hard-coded Points
A = rg.Point3d(0, 0, 0)
B = rg.Point3d(10, 0, 0)
C = rg.Point3d(5, 8, 0)

# Creation of Geometries
triangle = rg.Polyline([A, B, C, A]).ToNurbsCurve()
arc_A, arc_B, arc_C = sine_law_arcs(A, B, C)
plane = cosine_law_plane(A, B, C)

# Output Variables
triangle_out = triangle
arcs_out = [arc_A, arc_B, arc_C]
plane_out = plane
# ---------- end sine_law_and_cosine_law_3 ----------
geometry = Geometry(sine_law_and_cosine_law.outArcs)  # disabled
geometry_2 = Geometry(sine_law_and_cosine_law.output3)  # disabled
geometry_3 = Geometry(sine_law_and_cosine_law.triangle_pline)  # disabled
geometry_4 = Geometry(sine_law_and_cosine_law.output4)  # disabled
geometry_5 = Geometry(sine_law_and_cosine_law.output5)  # disabled
geometry_6 = Geometry(sine_law_and_cosine_law_2.triangle_pline)  # disabled
panel_3 = Panel(sine_law_and_cosine_law.out)  # disabled
geometry_7 = Geometry(sine_law_and_cosine_law_2.outMesh)  # disabled
panel_4 = Panel(sine_law_and_cosine_law_2.out)  # disabled
geometry_8 = Geometry(sine_law_and_cosine_law_3.arcs_out)  # disabled
geometry_9 = Geometry(sine_law_and_cosine_law_3.plane_out)  # disabled
geometry_10 = Geometry(sine_law_and_cosine_law_3.triangle_out)  # disabled
panel_5 = Panel(sine_law_and_cosine_law_3.out)  # disabled
entwine = Entwine(
    Branch00=geometry_3,
    Branch01=geometry,
    Branch02=geometry_2,
    Branch03=geometry_4,
    Branch04=geometry_5,
    FlattenInputs=True)  # disabled
entwine_2 = Entwine(Branch00=geometry_6, Branch01=geometry_7, FlattenInputs=True)  # disabled
sine_law_and_cosine_law_4 = Script(
    a=Slider(0.5, range=0..1),
    b=Slider(1, range=0..1),
    C_deg=Slider(22.866, range=0..100),
    u_div=Slider(100, range=0..100),
    v_div=Slider(100, range=0..100))  # -> out, outTriangle, outMesh; inputs a: Double, b: Double, C_deg: Double, u_div: Int32, v_div: Int32
# ---------- sine_law_and_cosine_law_4: Python ----------
import Rhino.Geometry as rg
import numpy as np
import math

def generate_triangle(a, b, C):
    A_pt = rg.Point3d(0, 0, 0)
    B_pt = rg.Point3d(a, 0, 0)
    c = math.sqrt(a**2 + b**2 - 2*a*b*math.cos(C))
    C_angle = math.asin(b * math.sin(C) / c)
    C_pt = rg.Point3d(b * math.cos(C_angle), b * math.sin(C_angle), 0)
    return rg.Polyline([A_pt, B_pt, C_pt, A_pt])

# Trigonometric polynomial surface function
def trig_surface(u, v, a, b):
    z = a * np.sin(u) * np.cos(v) + b * np.sin(v) * np.cos(u)
    return z

# Convert degree to radians
C = math.radians(C_deg)

triangle = generate_triangle(a, b, C)

# Generate surface
u = np.linspace(0, 2 * np.pi, u_div)
v = np.linspace(0, 2 * np.pi, v_div)
u, v = np.meshgrid(u, v)
z = trig_surface(u, v, a, b)

# Convert numpy arrays to Rhino mesh
mesh = rg.Mesh()
for i in range(u.shape[0]):
    for j in range(u.shape[1]):
        mesh.Vertices.Add(rg.Point3d(u[i, j], v[i, j], z[i, j]))

for i in range(u.shape[0] - 1):
    for j in range(u.shape[1] - 1):
        mesh.Faces.AddFace(i * u.shape[1] + j, i * u.shape[1] + j + 1, (i + 1) * u.shape[1] + j + 1, (i + 1) * u.shape[1] + j)

# Outputs
outTriangle = triangle.ToNurbsCurve()
outMesh = mesh
# ---------- end sine_law_and_cosine_law_4 ----------
entwine_3 = Entwine(Branch00=geometry_10, Branch01=geometry_8, Branch02=geometry_9, FlattenInputs=True)  # disabled
panel_6 = Panel(entwine)  # disabled
panel_7 = Panel(entwine_2)  # disabled
# gpt-4 Initial Response
# Certainly! Let's outline what we're going to do:
# 
# Concept: We're going to visualize the Sine Law and the Cosine Law
# using a triangle (non-right) in a 3D space. For a given triangle ABC:
# 
# Sine Law:
# a/sin(A) = b/sin(B) = c/sin(C)
# 
# Cosine Law:
# c^2 = a^2 + b^2 - 2ac*cos(C)
# 
# Approach: We will:
# 
# Create a triangle in 3D space with vertices A, B, and C.
# Using the Sine Law, we will draw arcs (representing sine of angles)
#  at each corner with radii equal to the sides.
# Using the Cosine Law, we will create a plane perpendicular to the
# triangle at C, projecting the triangle to show the relationship.
panel_8 = Panel(entwine_3)  # disabled
geometry_11 = Geometry(sine_law_and_cosine_law_4.outTriangle)
geometry_12 = Geometry(sine_law_and_cosine_law_4.outMesh)
panel_9 = Panel(sine_law_and_cosine_law_4.out)
entwine_4 = Entwine(Branch00=geometry_11, Branch01=geometry_12, FlattenInputs=True)
panel_10 = Panel(entwine_4)
