# Grasshopper definition 029_The_Derivatives_of_sin_cos.gh (Grasshopper 1.0.7)
# plug-ins: RhinoCodePluginGH

# ----
# Oscillation Algorithm
# The oscillation algorithm can be use to animate
# any geometry that is driven by a number sliders.
# Simply swap out the number sliders at the
# multiplication node in the oscillation script.
trigger = Trigger(Interval=10, TimerInterval=10, Target=data_recorder)  # disabled
panel = Panel("1")  # disabled
data_recorder = DataRecorder(panel, DataLimit=-10, RecordData=False)  # disabled
number_slider = Slider(288, range=0..1000)  # disabled
# Great, now make the script much more complex model
# with complex trigonometric polynomials and the
# NUMPY python library. Be sure to incorporate the previous code logic.
# ensure that this script produces 3d geometry as
# well for Data visualization purposes.
list_length = ListLength(List=data_recorder)  # disabled
division = Division(A=list_length, B=number_slider)  # disabled
cosine = Cosine(Value=division)  # disabled
sine = Sine(Value=division)  # disabled
# gpt-4 Initial Response
# Certainly! Let's create a more complex
# visualization based on complex trigonometric
# polynomials and incorporate the numpy library
# for numerical computations. We'll also generate
# 3D geometry for enhanced data visualization.
panel_2 = Panel([sine, cosine])  # disabled
multiplication = Multiplication(A=cosine)  # disabled
multiplication_2 = Multiplication(B=sine)  # disabled

# ----
# ADVANCED
# PARAMETRIC
# We'll consider the following complex
# trigonometric polynomial:
# f(x)=asin(x)+bcos(x)+csin(2x)+dcos(2x)
# And its derivative:
# f ′ (x)=acos(x)−bsin(x)+2ccos(2x)−2dsin(2x)
# PARAMETRIC
# f(x,y)=asin(x)cos(y)+bcos(x)sin(y)+csin(2x)cos(2y)+dcos(2x)sin(2y)
# PARAMETRIC
# Sure! Let's enhance the 3D visualization by
# introducing a parametric complex trigonometric
# polynomial model, using colors to denote the
# magnitude, and vectors to show the direction of
# change (gradient).
calculating_the_derivatives_of_sin_and_c = Script()  # -> out, e, f; "Calculating the Derivatives of sin and cos"; inputs A: Double, B: Double, C: Double; disabled
# ---------- calculating_the_derivatives_of_sin_and_c: Python ----------
import Rhino
import numpy as np

def create_trigonometric_curve(interval, steps, a, b, c, d):
    """Create a curve representing the complex trigonometric polynomial."""
    x = np.linspace(0, interval, steps+1)
    y = a * np.sin(x) + b * np.cos(x) + c * np.sin(2*x) + d * np.cos(2*x)
    points = [Rhino.Geometry.Point3d(x[i], y[i], 0) for i in range(steps+1)]
    return Rhino.Geometry.Curve.CreateInterpolatedCurve(points, 3)

def create_derivative_curve(interval, steps, a, b, c, d):
    """Create a curve representing the derivative of the complex trigonometric polynomial."""
    x = np.linspace(0, interval, steps+1)
    y_prime = a * np.cos(x) - b * np.sin(x) + 2 * c * np.cos(2*x) - 2 * d * np.sin(2*x)
    points = [Rhino.Geometry.Point3d(x[i], 0, y_prime[i]) for i in range(steps+1)]
    return Rhino.Geometry.Curve.CreateInterpolatedCurve(points, 3)

# Parameters
interval = 4 * np.pi  # from 0 to 4π for a more extended view
steps = 100  # number of steps
a, b, c, d = 1, 2, 1, 3  # polynomial coefficients

trig_curve = create_trigonometric_curve(interval, steps, a, b, c, d)
derivative_curve = create_derivative_curve(interval, steps, a, b, c, d)

# Outputs
e = trig_curve
f = derivative_curve
# ---------- end calculating_the_derivatives_of_sin_and_c ----------
calculating_the_derivatives_of_sin_and_c_2 = Script()  # -> out, g; "Calculating the Derivatives of sin and cos"; inputs A: Double, B: Double, C: Double; disabled
# ---------- calculating_the_derivatives_of_sin_and_c_2: Python ----------
import Rhino
import numpy as np

def create_trigonometric_mesh(interval_x, interval_y, steps, a, b, c, d):
    """Create a mesh representing the complex trigonometric polynomial."""
    x = np.linspace(0, interval_x, steps+1)
    y = np.linspace(0, interval_y, steps+1)
    
    X, Y = np.meshgrid(x, y)
    Z = a * np.sin(X) * np.cos(Y) + b * np.cos(X) * np.sin(Y) + c * np.sin(2*X) * np.cos(2*Y) + d * np.cos(2*X) * np.sin(2*Y)

    mesh = Rhino.Geometry.Mesh()

    # Add vertices to the mesh
    for i in range(steps+1):
        for j in range(steps+1):
            mesh.Vertices.Add(X[i, j], Y[i, j], Z[i, j])

    # Create faces
    for i in range(steps):
        for j in range(steps):
            mesh.Faces.AddFace(i + j*(steps+1), i + 1 + j*(steps+1), (i + 1) + (j + 1)*(steps+1), i + (j + 1)*(steps+1))

    return mesh

# Parameters
interval_x = 4 * np.pi  # from 0 to 4π
interval_y = 4 * np.pi  # from 0 to 4π
steps = 50  # number of steps
a, b, c, d = 1, 2, 1, 3  # polynomial coefficients

trig_mesh = create_trigonometric_mesh(interval_x, interval_y, steps, a, b, c, d)

# Outputs
g = trig_mesh
# ---------- end calculating_the_derivatives_of_sin_and_c_2 ----------
calculating_the_derivatives_of_sin_and_c_3 = Script()  # -> out, g, h, i; "Calculating the Derivatives of sin and cos"; inputs A: Double, B: Double, C: Double; disabled
# ---------- calculating_the_derivatives_of_sin_and_c_3: Python ----------
import Rhino
import numpy as np

def create_trigonometric_mesh(interval_x, interval_y, steps, a, b, c, d):
    """Create a mesh representing the complex trigonometric polynomial."""
    x = np.linspace(0, interval_x, steps+1)
    y = np.linspace(0, interval_y, steps+1)
    
    X, Y = np.meshgrid(x, y)
    Z = a * np.sin(X) * np.cos(Y) + b * np.cos(X) * np.sin(Y) + c * np.sin(2*X) * np.cos(2*Y) + d * np.cos(2*X) * np.sin(2*Y)

    mesh = Rhino.Geometry.Mesh()

    # Add vertices to the mesh
    for i in range(steps+1):
        for j in range(steps+1):
            mesh.Vertices.Add(X[i, j], Y[i, j], Z[i, j])

    # Create faces
    for i in range(steps):
        for j in range(steps):
            mesh.Faces.AddFace(i + j*(steps+1), i + 1 + j*(steps+1), (i + 1) + (j + 1)*(steps+1), i + (j + 1)*(steps+1))

    return mesh, Z

def calculate_gradient(Z, interval_x, interval_y, steps):
    """Calculate the gradient (approximate) of the mesh using finite differences."""
    dx = interval_x / steps
    dy = interval_y / steps
    gradient_x = (Z[:-1, 1:] - Z[:-1, :-1]) / dx
    gradient_y = (Z[1:, :-1] - Z[:-1, :-1]) / dy
    return gradient_x, gradient_y

# Parameters
interval_x = 4 * np.pi  # from 0 to 4π
interval_y = 4 * np.pi  # from 0 to 4π
steps = 50  # number of steps
a, b, c, d = 1, 2, 1, 3  # polynomial coefficients

trig_mesh, Z_values = create_trigonometric_mesh(interval_x, interval_y, steps, a, b, c, d)

# Compute gradient vectors for visualization
gradient_x, gradient_y = calculate_gradient(Z_values, interval_x, interval_y, steps)
x = np.linspace(0, interval_x, steps)
y = np.linspace(0, interval_y, steps)
X, Y = np.meshgrid(x, y)
gradient_vectors = [Rhino.Geometry.Vector3d(gradient_x[i, j], gradient_y[i, j], 0) for i in range(steps) for j in range(steps)]
base_points = [Rhino.Geometry.Point3d(X[i, j], Y[i, j], Z_values[i, j]) for i in range(steps) for j in range(steps)]

# Color the mesh based on Z-values for visualization
colors = [Rhino.Display.ColorHSL(0.6 * (1 - (z - Z_values.min()) / (Z_values.max() - Z_values.min())), 1, 0.5).ToArgbColor() for z in Z_values.ravel()]
for i, color in enumerate(colors):
    trig_mesh.VertexColors.SetColor(i, color)

# Outputs
g = trig_mesh
h = base_points
i = gradient_vectors
# ---------- end calculating_the_derivatives_of_sin_and_c_3 ----------
# gpt-4 Text Prompt
# Learn Single-Variable Calculus
# with Python in Grasshopper
# at Wickerson Studios
# Create a geometric 3D model with
# 
# Single-Variable Calculus
#  THE ELEMENTARY
# TRANSCENDENTAL FUNCTIONS
# Derivatives of the Trigonometric Functions
# 
# to create a 3D model specifically about
# 
#  Calculating the Derivatives of sin and cos
# 
# 
# in python 3 code for the python 3 script
# node in grasshopper for Rhino8WIP using the
# 
# Rhino Common API to create some geometry as well.
# 
# Output the parts of the model in different
# variable outputs in the python 3 node in
# grasshopper.
# 003 THE ELEMENTARY
# TRANSCENDENTAL FUNCTIONS
# 002 Derivatives of the Trigonometric Functions
# 2nd gpt-4 Text Prompt
# 029 Calculating the Derivatives of sin and cos
calculating_the_derivatives_of_sin_and_c_4 = Script()  # -> out, a, b, c, d; "Calculating the Derivatives of sin and cos"; inputs A: Double, B: Double, C: Double; disabled
# ---------- calculating_the_derivatives_of_sin_and_c_4: Python ----------
import Rhino
import math

def create_sine_curve(interval, steps):
    """Create a curve representing the function y = sin(x)."""
    points = [Rhino.Geometry.Point3d(i*interval/steps, math.sin(i*interval/steps), 0) for i in range(steps+1)]
    return Rhino.Geometry.Curve.CreateInterpolatedCurve(points, 3)

def create_cosine_curve(interval, steps):
    """Create a curve representing the function y = cos(x)."""
    points = [Rhino.Geometry.Point3d(i*interval/steps, math.cos(i*interval/steps), 0) for i in range(steps+1)]
    return Rhino.Geometry.Curve.CreateInterpolatedCurve(points, 3)

def create_derivative_of_sine(interval, steps):
    """Create a curve representing the derivative of sin, which is cos."""
    points = [Rhino.Geometry.Point3d(i*interval/steps, math.cos(i*interval/steps), 0) for i in range(steps+1)]
    return Rhino.Geometry.Curve.CreateInterpolatedCurve(points, 3)

def create_derivative_of_cosine(interval, steps):
    """Create a curve representing the derivative of cos, which is -sin."""
    points = [Rhino.Geometry.Point3d(i*interval/steps, -math.sin(i*interval/steps), 0) for i in range(steps+1)]
    return Rhino.Geometry.Curve.CreateInterpolatedCurve(points, 3)

# Parameters
interval = 2 * math.pi  # from 0 to 2π
steps = 100  # number of steps

sine_curve = create_sine_curve(interval, steps)
cosine_curve = create_cosine_curve(interval, steps)
derivative_sine = create_derivative_of_sine(interval, steps)
derivative_cosine = create_derivative_of_cosine(interval, steps)

# Outputs
a = sine_curve
b = cosine_curve
c = derivative_sine
d = derivative_cosine
# ---------- end calculating_the_derivatives_of_sin_and_c_4 ----------
geometry = Geometry(calculating_the_derivatives_of_sin_and_c.f)  # disabled
geometry_2 = Geometry(calculating_the_derivatives_of_sin_and_c.e)  # disabled
geometry_3 = Geometry(calculating_the_derivatives_of_sin_and_c_2.g)  # disabled
panel_3 = Panel(calculating_the_derivatives_of_sin_and_c_2.out)  # disabled
geometry_4 = Geometry(calculating_the_derivatives_of_sin_and_c_3.g)  # disabled
geometry_5 = Geometry(calculating_the_derivatives_of_sin_and_c_3.h)  # disabled
vector = Vector(calculating_the_derivatives_of_sin_and_c_3.i)  # disabled
panel_4 = Panel(calculating_the_derivatives_of_sin_and_c_3.out)  # disabled
panel_5 = Panel(calculating_the_derivatives_of_sin_and_c.out)  # disabled
entwine = Entwine(Branch00=geometry_2, Branch01=geometry, FlattenInputs=True)  # disabled
entwine_2 = Entwine(Branch00=geometry_3, FlattenInputs=True)  # disabled
entwine_3 = Entwine(Branch00=geometry_4, Branch01=geometry_5, Branch02=vector, FlattenInputs=True)  # disabled
vector_display = VectorDisplay(Anchor=geometry_5, Vector=vector)  # disabled
panel_6 = Panel(calculating_the_derivatives_of_sin_and_c_4.out)  # disabled
geometry_6 = Geometry(calculating_the_derivatives_of_sin_and_c_4.b)  # disabled
geometry_7 = Geometry(calculating_the_derivatives_of_sin_and_c_4.c)  # disabled
geometry_8 = Geometry(calculating_the_derivatives_of_sin_and_c_4.a)  # disabled
geometry_9 = Geometry(calculating_the_derivatives_of_sin_and_c_4.d)  # disabled
entwine_4 = Entwine(Branch00=geometry_8, Branch01=geometry_6, Branch02=geometry_7, Branch03=geometry_9, FlattenInputs=True)  # disabled
panel_7 = Panel(entwine)  # disabled
panel_8 = Panel(entwine_2)  # disabled
panel_9 = Panel(entwine_3)  # disabled
calculating_the_derivatives_of_sin_and_c_5 = Script(
    x=Slider(20, range=0..20),
    y=Slider(9.02, range=0..20),
    s=Slider(30, range=0..100),
    a=Slider(0.867, range=-10..10),
    b=Slider(0.867, range=-10..10),
    c=Slider(-0.405, range=-10..10),
    d=Slider(-0.983, range=-10..10))  # -> out, g, h, i; "Calculating the Derivatives of sin and cos"; inputs x: Double, y: Double, s: Int32, a: Double, b: Double, c: Double, d: Double
# ---------- calculating_the_derivatives_of_sin_and_c_5: Python ----------
import Rhino
import numpy as np

def create_trigonometric_mesh(interval_x, interval_y, steps, a, b, c, d):
    x = np.linspace(0, interval_x, steps+1)
    y = np.linspace(0, interval_y, steps+1)
    
    X, Y = np.meshgrid(x, y)
    Z = a * np.sin(X) * np.cos(Y) + b * np.cos(X) * np.sin(Y) + c * np.sin(2*X) * np.cos(2*Y) + d * np.cos(2*X) * np.sin(2*Y)

    mesh = Rhino.Geometry.Mesh()

    # Add vertices to the mesh
    for i in range(steps+1):
        for j in range(steps+1):
            mesh.Vertices.Add(X[i, j], Y[i, j], Z[i, j])

    # Create faces
    for i in range(steps):
        for j in range(steps):
            mesh.Faces.AddFace(i + j*(steps+1), i + 1 + j*(steps+1), (i + 1) + (j + 1)*(steps+1), i + (j + 1)*(steps+1))

    return mesh, Z

def calculate_gradient(Z, interval_x, interval_y, steps):
    dx = interval_x / steps
    dy = interval_y / steps
    gradient_x = (Z[:-1, 1:] - Z[:-1, :-1]) / dx
    gradient_y = (Z[1:, :-1] - Z[:-1, :-1]) / dy
    return gradient_x, gradient_y

# Parameters from Grasshopper Inputs
interval_x = x  # Input Type: Float
interval_y = y  # Input Type: Float
steps = s  # Input Type: Integer
#a, b, c, d = coeffs  # Input Type: List of Floats

trig_mesh, Z_values = create_trigonometric_mesh(interval_x, interval_y, steps, a, b, c, d)

# Compute gradient vectors for visualization
gradient_x, gradient_y = calculate_gradient(Z_values, interval_x, interval_y, steps)
x_coords = np.linspace(0, interval_x, steps)
y_coords = np.linspace(0, interval_y, steps)
X, Y = np.meshgrid(x_coords, y_coords)
gradient_vectors = [Rhino.Geometry.Vector3d(gradient_x[i, j], gradient_y[i, j], 0) for i in range(steps) for j in range(steps)]
base_points = [Rhino.Geometry.Point3d(X[i, j], Y[i, j], Z_values[i, j]) for i in range(steps) for j in range(steps)]

# Color the mesh based on Z-values for visualization
colors = [Rhino.Display.ColorHSL(0.6 * (1 - (z - Z_values.min()) / (Z_values.max() - Z_values.min())), 1, 0.5).ToArgbColor() for z in Z_values.ravel()]
for i, color in enumerate(colors):
    trig_mesh.VertexColors.SetColor(i, color)

# Outputs for Grasshopper
g = trig_mesh
h = base_points
i = gradient_vectors
# ---------- end calculating_the_derivatives_of_sin_and_c_5 ----------
# gpt-4 Initial Response
# To create a 3D model visualizing the derivatives
# of the trigonometric functions sin and cos using
# Python in a Grasshopper for Rhino 8WIP script
# node, we can use Rhino's RhinoCommon API.
panel_10 = Panel(entwine_4)  # disabled
geometry_10 = Geometry(calculating_the_derivatives_of_sin_and_c_5.g)
geometry_11 = Geometry(calculating_the_derivatives_of_sin_and_c_5.h)
vector_2 = Vector(calculating_the_derivatives_of_sin_and_c_5.i)
panel_11 = Panel(calculating_the_derivatives_of_sin_and_c_5.out)
entwine_5 = Entwine(Branch00=geometry_10, Branch01=geometry_11, Branch02=vector_2, FlattenInputs=True)
vector_display_2 = VectorDisplay(Anchor=geometry_11, Vector=vector_2)
panel_12 = Panel(entwine_5)
