# Grasshopper definition 030_Simple_Harmonic_Motion.gh (Grasshopper 1.0.7)
# plug-ins: RhinoCodePluginGH

# ----
# Oscillation Algorithm
# The oscillation algorithm can be use to animate
# any geometry that is driven by a number sliders.
# Simply swap out the number sliders at the
# multiplication node in the oscillation script.
trigger = Trigger(Interval=10, TimerInterval=10, Target=data_recorder)  # disabled
panel = Panel("1")  # disabled
# 2nd gpt-4 Text Prompt
# Great, now make the script much more complex model
# with complex trigonometric polynomials and the
# NUMPY python library. Be sure to incorporate the previous code logic.
# ensure that this script produces 3d geometry as
# well for Data visualization purposes.
data_recorder = DataRecorder(panel, DataLimit=-10, RecordData=False)  # disabled
number_slider = Slider(288, range=0..1000)  # disabled
# gpt-4 Initial Response
# To make the model more complex using
# trigonometric polynomials and numpy, let's
# consider the Fourier series. A Fourier series
# represents periodic functions as a sum of sines
# and cosines, which are the building blocks of
# complex trigonometric polynomials.
list_length = ListLength(List=data_recorder)  # disabled
division = Division(A=list_length, B=number_slider)  # disabled
cosine = Cosine(Value=division)  # disabled
sine = Sine(Value=division)  # disabled
panel_2 = Panel([sine, cosine])  # disabled
multiplication = Multiplication(A=cosine)  # disabled
multiplication_2 = Multiplication(B=sine)  # disabled

# ----
# ADVANCED
# PARAMETRIC
# def FourierSeries(t, N, omega, a, b, r):
#     # Calculate Fourier polynomial sum
#     y_fourier = a[0]
#     for n in range(1, N+1):
#         y_fourier += a[n] * np.cos(n * omega * t) + b[n] * np.sin(n * omega * t)
# PARAMETRIC
# def ComplexTrigonometricPoly(t, N, omega, c):
#     # Calculate complex trigonometric polynomial sum
#     sum_complex = np.complex(0, 0)
#     for n in range(-N, N+1):
#         sum_complex += c[n+N] * np.exp(1j * n * omega * t)
# PARAMETRIC
# def ComplexTrigonometricPoly(t, N, omega, c):
#     sum_complex = complex(0, 0)  # Use Python's built-in complex type
#     for n in range(-N, N+1):
#         sum_complex += c[n+N] * np.exp(1j * n * omega * t)
# 
#     return sum_complex
# PARAMETRIC
# def ComplexTrigonometricPoly(t, N, omega, c):
#     n_values = np.arange(-N, N+1)
#     harmonics = np.exp(1j * np.outer(n_values, omega * t))
#     sum_complex = np.dot(c, harmonics)
#     return sum_complex
number_slider_2 = Slider(5, range=0..10)
simple_harmonic_motion = Script()  # -> out, a_out, b_out, c_out; inputs A: Double, B: Double, C: Double; disabled
# ---------- simple_harmonic_motion: Python ----------
import Rhino.Geometry as rg
import numpy as np

def ComplexTrigonometricPoly(t, N, omega, c):
    # Calculate complex trigonometric polynomial sum
    sum_complex = complex(0, 0)  # Use Python's built-in complex type
    for n in range(-N, N+1):
        sum_complex += c[n+N] * np.exp(1j * n * omega * t)
    
    x_value = np.real(sum_complex)
    y_value = np.imag(sum_complex)
    
    return x_value, y_value

def CreateComplexSHMGeometry(t, r, omega, N, c):
    x, y = ComplexTrigonometricPoly(t, N, omega, c)
    
    z = r * np.sin(omega * t)  # This was our earlier logic for Z-axis movement
    
    moving_point = rg.Point3d(r*x, r*y, z)
    main_circle = rg.Circle(rg.Plane.WorldXY, r).ToNurbsCurve()
    projection_line = rg.Line(moving_point, rg.Point3d(0, r*y, 0))
    
    return main_circle, moving_point, projection_line

# Test values
t = 1.5
r = 5
omega = 1
N = 2

# For simplicity, we'll just use some random complex coefficients for testing
# c[n] = a_n + i*b_n; where a_n and b_n are the coefficients for cosine and sine respectively
c = [0.3+0.2j, 0.4+0.3j, 0.5+0.4j, 0.4-0.3j, 0.3-0.2j]

if r != 0:
    main_circle, moving_point, projection_line = CreateComplexSHMGeometry(t, r, omega, N, c)
    a_out = main_circle
    b_out = moving_point
    c_out = projection_line
else:
    a_out = "Invalid radius"
    b_out = "Invalid radius"
    c_out = "Invalid radius"
# ---------- end simple_harmonic_motion ----------
simple_harmonic_motion_2 = Script()  # -> out, a_out, b_out, c_out; inputs A: Double, B: Double, C: Double; disabled
# ---------- simple_harmonic_motion_2: Python ----------
import Rhino.Geometry as rg
import numpy as np

def FourierSeries(t, N, omega, a, b, r):
    # Calculate Fourier polynomial sum
    y_fourier = a[0] 
    for n in range(1, N+1):
        y_fourier += a[n] * np.cos(n * omega * t) + b[n] * np.sin(n * omega * t)
    
    # Create the complex trigonometric polynomial geometry
    x = r * np.cos(omega * t)
    z = r * np.sin(omega * t)
    y = r * y_fourier  # Multiplied by r for visualization scaling
    
    return x, y, z

def CreateSHMGeometry(t, r, omega, N, a, b):
    x, y, z = FourierSeries(t, N, omega, a, b, r)
    moving_point = rg.Point3d(x, y, z)
    main_circle = rg.Circle(rg.Plane.WorldXY, r).ToNurbsCurve()
    projection_line = rg.Line(moving_point, rg.Point3d(0, y, 0))
    
    return main_circle, moving_point, projection_line

# Test values
t = 1.5
r = 5
omega = 1
N = 2
a = [1, 0.5, 0.3]
b = [0, 0.4, 0.2]

if r != 0:
    main_circle, moving_point, projection_line = CreateSHMGeometry(t, r, omega, N, a, b)
    a_out = main_circle
    b_out = moving_point
    c_out = projection_line
else:
    a_out = "Invalid radius"
    b_out = "Invalid radius"
    c_out = "Invalid radius"
# ---------- end simple_harmonic_motion_2 ----------
# gpt-4 Text Prompt
# Learn Single-Variable Calculus
# with Python in Grasshopper
# at Wickerson Studios
# Create a geometric 3D model with
# 
# Single-Variable Calculus
#  THE ELEMENTARY
# TRANSCENDENTAL FUNCTIONS
# Derivatives of the Trigonometric Functions
# 
# to create a 3D model specifically about
# 
# Simple Harmonic Motion
# 
# 
# in python 3 code for the python 3 script
# node in grasshopper for Rhino8WIP using the
# 
# Rhino Common API to create some geometry as well.
# 
# Output the parts of the model in different
# variable outputs in the python 3 node in
# grasshopper.
# 003 THE ELEMENTARY
# TRANSCENDENTAL FUNCTIONS
# 002 Derivatives of the Trigonometric Functions
# 030 Simple Harmonic Motion
simple_harmonic_motion_3 = Script()  # -> out, a, b, c; inputs A: Double, B: Double, C: Double; disabled
# ---------- simple_harmonic_motion_3: Python ----------
import Rhino.Geometry as rg
import math

def SimpleHarmonicMotion(t, r, frequency):
    x = r * math.cos(frequency * t)
    y = r * math.sin(frequency * t)
    z = 0
    
    main_circle = rg.Circle(rg.Plane.WorldXY, r).ToNurbsCurve()
    moving_point = rg.Point3d(x, y, z)
    projection_line = rg.Line(moving_point, rg.Point3d(0, y, 0))
    
    return main_circle, moving_point, projection_line

# Test values, but in Grasshopper these will be provided by input sliders or values
t = 1.5
r = 5
frequency = 1

# Ensure r is not 0
if r != 0:
    main_circle, moving_point, projection_line = SimpleHarmonicMotion(t, r, frequency)
    a = main_circle
    b = moving_point
    c = projection_line
else:
    a = "Invalid radius"
    b = "Invalid radius"
    c = "Invalid radius"
# ---------- end simple_harmonic_motion_3 ----------
simple_harmonic_motion_4 = Script()  # -> out, a_out, b_out; inputs A: Double, B: Double, C: Double; disabled
# ---------- simple_harmonic_motion_4: Python ----------
import Rhino.Geometry as rg
import numpy as np

def ComplexTrigonometricPoly(t, N, omega, c):
    sum_complex = complex(0, 0)
    for n in range(-N, N+1):
        sum_complex += c[n+N] * np.exp(1j * n * omega * t)
    return sum_complex

def CreateComplexSHMGeometry(t, r, omega, N, c_x, c_y, c_z):
    x = np.real(ComplexTrigonometricPoly(t, N, omega, c_x))
    y = np.real(ComplexTrigonometricPoly(t, N, omega, c_y))
    z = np.real(ComplexTrigonometricPoly(t, N, omega, c_z))
    moving_point = rg.Point3d(r*x, r*y, r*z)
    return moving_point

# Test values
r = 5
omega = 1
N = 2

c_x = [0.3+0.2j, 0.4+0.3j, 0.5+0.4j, 0.4-0.3j, 0.3-0.2j]
c_y = [0.3+0.1j, 0.2+0.1j, 0.1+0.3j, 0.4-0.1j, 0.3-0.2j]
c_z = [0.2+0.2j, 0.2+0.3j, 0.5-0.1j, 0.1-0.3j, 0.4+0.1j]

time_values = np.linspace(0, 10, 100)  # from t=0 to t=10, creating 100 samples
points = [CreateComplexSHMGeometry(t, r, omega, N, c_x, c_y, c_z) for t in time_values]

# Creating vectors from one point to the next
vectors = [rg.Vector3d(points[i+1] - points[i]) for i in range(len(points) - 1)]

a_out = points
b_out = vectors
# ---------- end simple_harmonic_motion_4 ----------
panel_3 = Panel(simple_harmonic_motion_4.out)  # disabled
geometry = Geometry(simple_harmonic_motion_4.a_out)  # disabled
vector = Vector(simple_harmonic_motion_4.b_out)  # disabled
panel_4 = Panel(simple_harmonic_motion.out)  # disabled
panel_5 = Panel(simple_harmonic_motion_2.out)  # disabled
simple_harmonic_motion_5 = Script(r=number_slider_2, omega=Slider(1, range=-1..1), N=Slider(4, range=0..10), count=Slider(171, range=0..1000))  # -> out, a_out, b_out, c_out; inputs r: Int32, omega: Double, N: Int32, count: Int32
# ---------- simple_harmonic_motion_5: Python ----------
import Rhino.Geometry as rg
import numpy as np

def ComplexTrigonometricPoly(t, N, omega, c):
    n_values = np.arange(-N, N+1)
    harmonics = np.exp(1j * np.outer(n_values, omega * t))
    sum_complex = np.dot(c, harmonics)
    return sum_complex

def CreateComplexSHMGeometry(t, r, omega, N, c_x, c_y, c_z):
    x = np.real(ComplexTrigonometricPoly(t, N, omega, c_x))[0]  # Extracting scalar
    y = np.real(ComplexTrigonometricPoly(t, N, omega, c_y))[0]  # Extracting scalar
    z = np.real(ComplexTrigonometricPoly(t, N, omega, c_z))[0]  # Extracting scalar
    moving_point = rg.Point3d(r*x, r*y, r*z)
    return moving_point

# Test values
#r = 5
#omega = 1
#N = 4  # Increased harmonics for complexity

c_x = np.array([0.3+0.2j, 0.4+0.3j, 0.5+0.4j, 0.4-0.3j, 0.3-0.2j,
                0.3+0.1j, 0.2+0.2j, 0.5-0.3j, 0.4+0.4j])
c_y = np.array([0.3+0.1j, 0.2+0.1j, 0.1+0.3j, 0.4-0.1j, 0.3-0.2j,
                0.2+0.3j, 0.3-0.3j, 0.4+0.3j, 0.5-0.2j])
c_z = np.array([0.2+0.2j, 0.2+0.3j, 0.5-0.1j, 0.1-0.3j, 0.4+0.1j,
                0.3-0.1j, 0.4-0.2j, 0.5+0.3j, 0.2+0.2j])

time_values = np.linspace(0, 10, count)  # Increased samples for smoother curves
points = [CreateComplexSHMGeometry(t_val, r, omega, N, c_x, c_y, c_z) for t_val in time_values]

# Creating vectors from one point to the next
vectors = [rg.Vector3d(points[i+1] - points[i]) for i in range(len(points) - 1)]

# Creating a polyline to visualize the path
path = rg.Polyline(points).ToNurbsCurve()

a_out = points
b_out = vectors
c_out = path
# ---------- end simple_harmonic_motion_5 ----------
geometry_2 = Geometry(simple_harmonic_motion.b_out)  # disabled
geometry_3 = Geometry(simple_harmonic_motion.c_out)  # disabled
geometry_4 = Geometry(simple_harmonic_motion_2.b_out)  # disabled
geometry_5 = Geometry(simple_harmonic_motion_2.c_out)  # disabled
geometry_6 = Geometry(simple_harmonic_motion.a_out)  # disabled
geometry_7 = Geometry(simple_harmonic_motion_2.a_out)  # disabled
panel_6 = Panel(simple_harmonic_motion_3.out)  # disabled
geometry_8 = Geometry(simple_harmonic_motion_3.b)  # disabled
geometry_9 = Geometry(simple_harmonic_motion_3.c)  # disabled
geometry_10 = Geometry(simple_harmonic_motion_3.a)  # disabled
entwine = Entwine(Branch00=geometry, Branch01=vector, FlattenInputs=True)  # disabled
vector_display = VectorDisplay(Anchor=geometry, Vector=vector)  # disabled
entwine_2 = Entwine(Branch00=geometry_6, Branch01=geometry_2, Branch02=geometry_3, FlattenInputs=True)  # disabled
entwine_3 = Entwine(Branch00=geometry_7, Branch01=geometry_4, Branch02=geometry_5, FlattenInputs=True)  # disabled
entwine_4 = Entwine(Branch00=geometry_10, Branch01=geometry_8, Branch02=geometry_9, FlattenInputs=True)  # disabled
panel_7 = Panel(simple_harmonic_motion_5.out)
geometry_11 = Geometry(simple_harmonic_motion_5.a_out)
vector_2 = Vector(simple_harmonic_motion_5.b_out)
geometry_12 = Geometry(simple_harmonic_motion_5.c_out)
panel_8 = Panel(entwine)  # disabled
panel_9 = Panel(entwine_2)  # disabled
panel_10 = Panel(entwine_3)  # disabled
entwine_5 = Entwine(Branch00=geometry_11, Branch01=vector_2, Branch02=geometry_12, FlattenInputs=True)
# gpt-4 Initial Response
# To model a Simple Harmonic Motion (SHM) in
# 3D using single-variable calculus and the
# trigonometric functions, let's take an example
# where a point mass moves in a circular path,
# and we project this motion on one of the axes to
# represent SHM. This is a common method of
# visualizing SHM and relates to the trigonometric
#  functions.
# 
# We will model this with:
# 
# A circle representing the circular motion.
# A point mass moving on the circle (represented
# as a smaller circle or point).
# The projection of this point on one axis (let's
# choose Y-axis) that represents the SHM.
panel_11 = Panel(entwine_4)  # disabled
vector_display_2 = VectorDisplay(Anchor=geometry_11, Vector=vector_2)
panel_12 = Panel(entwine_5)
