# Grasshopper definition 031_Inverse_Sine_Function.gh (Grasshopper 1.0.7)
# plug-ins: RhinoCodePluginGH

# ----
# Oscillation Algorithm
# The oscillation algorithm can be use to animate
# any geometry that is driven by a number sliders.
# Simply swap out the number sliders at the
# multiplication node in the oscillation script.
trigger = Trigger(Interval=10, TimerInterval=10, Target=data_recorder)  # disabled
panel = Panel("1")  # disabled
data_recorder = DataRecorder(panel, DataLimit=-10, RecordData=False)  # disabled
number_slider = Slider(288, range=0..1000)  # disabled
# 2nd gpt-4 Text Prompt
# Great, now make the script much more complex model
# with complex trigonometric polynomials and the
# NUMPY python library. Be sure to incorporate the previous code logic.
# ensure that this script produces 3d geometry as
# well for Data visualization purposes.
# gpt-4 Initial Response
# Making the script parametric means allowing
# users to influence the generated geometry by
# adjusting a set of parameters. I'll introduce
# parameters for the coefficients in the
# trigonometric polynomial, as well as the
# resolution and range of x and y values. This will
# allow for various geometric manifestations
# based on user input.
list_length = ListLength(List=data_recorder)  # disabled
division = Division(A=list_length, B=number_slider)  # disabled
cosine = Cosine(Value=division)  # disabled
sine = Sine(Value=division)  # disabled
panel_2 = Panel([sine, cosine])  # disabled
multiplication = Multiplication(A=cosine)  # disabled
multiplication_2 = Multiplication(B=sine)  # disabled

# ----
# ADVANCED
# PARAMETRIC
# PARAMETRIC
# PARAMETRIC
# # Parameters
# a = 2                # type: float
# b = 1.5              # type: float
# c = 0.5              # type: float
# d = 1                # type: float
# e = 2                # type: float
# f = 1                # type: float
# res_x = 100          # type: int
# res_y = 100          # type: int
# range_x = 2*np.pi    # type: float
# range_y = 2*np.pi    # type: float
the_inverse_sine_function = Script()  # -> out, a, b, c; inputs A: Double, B: Double, C: Double; disabled
# ---------- the_inverse_sine_function: Python ----------
import Rhino.Geometry as rg
import numpy as np

def trig_poly_visualization():
    # Define a range of x-values (let's expand this to -2*pi to 2*pi for a more complex visualization)
    x_values = np.linspace(-2*np.pi, 2*np.pi, 400)

    # Define a complex trigonometric polynomial:
    # y = arcsin(sin(x)) + a*sin(b*x + c) + d*cos(e*x)
    # For simplicity, we're taking a = 2, b = 1.5, c = 0.5, d = 1, e = 2
    y_values = np.arcsin(np.sin(x_values)) + 2*np.sin(1.5*x_values + 0.5) + np.cos(2*x_values)

    # Generate points for the trigonometric polynomial
    points = [rg.Point3d(x, y, 0) for x, y in zip(x_values, y_values)]

    # Similar to the previous approach, create curves through these points
    curves = []
    for pt in points:
        curves.append(rg.LineCurve(rg.Point3d(pt.X, pt.Y, -10), rg.Point3d(pt.X, pt.Y, 10)))

    # Loft these curves to generate a surface
    loft_type = rg.LoftType.Normal
    loft_surfaces = rg.Brep.CreateFromLoft(curves, rg.Point3d.Unset, rg.Point3d.Unset, loft_type, False)

    return loft_surfaces, curves, points

# Get the surfaces, curves, and points from our function
surfaces, curves, points = trig_poly_visualization()

# Output
a = surfaces
b = curves
c = points
# ---------- end the_inverse_sine_function ----------
the_inverse_sine_function_2 = Script()  # -> out, a, b, c; inputs A: Double, B: Double, C: Double; disabled
# ---------- the_inverse_sine_function_2: Python ----------
import Rhino.Geometry as rg
import numpy as np

def complex_trig_poly_visualization():
    # Define a range of x and y values 
    x_values = np.linspace(-2*np.pi, 2*np.pi, 100)
    y_values = np.linspace(-2*np.pi, 2*np.pi, 100)
    
    # Create a mesh to store the points
    mesh = rg.Mesh()
    
    # Define the complex trigonometric polynomial
    for x in x_values:
        for y in y_values:
            # Complex trig polynomial: z = arcsin(sin(x) sin(y)) + a*sin(bx + cy) + d*cos(ex + fy)
            z = np.arcsin(np.sin(x) * np.sin(y)) + 2 * np.sin(1.5 * x + 0.5 * y) + np.cos(2 * x + y)
            
            # Add the vertices to the mesh
            mesh.Vertices.Add(rg.Point3d(x, y, z))
    
    # Now, we define the faces of the mesh
    for i in range(len(x_values) - 1):
        for j in range(len(y_values) - 1):
            mesh.Faces.AddFace(i + j * len(x_values), 
                               (i + 1) + j * len(x_values), 
                               (i + 1) + (j + 1) * len(x_values), 
                               i + (j + 1) * len(x_values))

    return mesh

# Get the mesh from our function
a = complex_trig_poly_visualization()
# ---------- end the_inverse_sine_function_2 ----------
# gpt-4 Text Prompt
# Learn Single-Variable Calculus
# with Python in Grasshopper
# at Wickerson Studios
# Create a geometric 3D model with
# 
# Single-Variable Calculus
#  THE ELEMENTARY
# TRANSCENDENTAL FUNCTIONS
#  The Inverse Trigonometric Functions
# 
# to create a 3D model specifically about
# 
# The Inverse Sine Function
# 
# 
# in python 3 code for the python 3 script
# node in grasshopper for Rhino8WIP using the
# 
# Rhino Common API to create some geometry as well.
# 
# Output the parts of the model in different
# variable outputs in the python 3 node in
# grasshopper.
# 003 THE ELEMENTARY
# TRANSCENDENTAL FUNCTIONS
# 003 The Inverse Trigonometric Functions
# 031 The Inverse SineFunction
the_inverse_sine_function_3 = Script()  # -> out, a, b, c; inputs A: Double, B: Double, C: Double; disabled
# ---------- the_inverse_sine_function_3: Python ----------
import Rhino.Geometry as rg
import math

def arcsin_visualization():
    # 1. Define a range of x-values (from -1 to 1 which is the domain for arcsin)
    x_values = [i * 0.05 for i in range(-20, 21)]  # adjust for higher resolution if needed

    # 2. Compute the arcsin for each x-value
    arcsin_values = [math.asin(x) for x in x_values]

    # 3. Create a point for each (x, arcsin(x)) pair
    points = [rg.Point3d(x, math.degrees(y), 0) for x, y in zip(x_values, arcsin_values)]

    # Generate the curves
    curves = []
    for pt in points:
        curves.append(rg.LineCurve(rg.Point3d(pt.X, pt.Y, -10), rg.Point3d(pt.X, pt.Y, 10)))

    # 4. Loft through these points to generate a surface
    loft_type = rg.LoftType.Normal
    loft_surfaces = rg.Brep.CreateFromLoft(curves, rg.Point3d.Unset, rg.Point3d.Unset, loft_type, False)

    return loft_surfaces, curves, points

# Get the surfaces, curves, and points from our function
surfaces, curves, points = arcsin_visualization()

# Output
a = surfaces
b = curves
c = points
# ---------- end the_inverse_sine_function_3 ----------
panel_3 = Panel(the_inverse_sine_function.out)  # disabled
panel_4 = Panel(the_inverse_sine_function_2.out)  # disabled
panel_5 = Panel(the_inverse_sine_function_3.out)  # disabled
geometry = Geometry(the_inverse_sine_function.a)  # disabled
geometry_2 = Geometry(the_inverse_sine_function.b)  # disabled
geometry_3 = Geometry(the_inverse_sine_function.c)  # disabled
geometry_4 = Geometry(the_inverse_sine_function_2.a)  # disabled
geometry_5 = Geometry(the_inverse_sine_function_3.a)  # disabled
geometry_6 = Geometry(the_inverse_sine_function_3.b)  # disabled
geometry_7 = Geometry(the_inverse_sine_function_3.c)  # disabled
the_inverse_sine_function_4 = Script()  # -> out, result_mesh
# ---------- the_inverse_sine_function_4: Python ----------
import Rhino.Geometry as rg
import numpy as np

def parametric_trig_poly(a=2, b=1.5, c=0.5, d=1, e=2, f=1, res_x=100, res_y=100, range_x=(2*np.pi, 2*np.pi), range_y=(2*np.pi, 2*np.pi)):
    # Define a range of x and y values 
    x_values = np.linspace(-range_x, range_x, res_x)
    y_values = np.linspace(-range_y, range_y, res_y)
    
    # Create a mesh to store the points
    mesh = rg.Mesh()
    
    # Define the complex trigonometric polynomial
    for x in x_values:
        for y in y_values:
            # Complex trig polynomial: z = arcsin(sin(x) sin(y)) + a*sin(bx + cy) + d*cos(ex + fy)
            z = np.arcsin(np.sin(x) * np.sin(y)) + a * np.sin(b * x + c * y) + d * np.cos(e * x + f * y)
            
            # Add the vertices to the mesh
            mesh.Vertices.Add(rg.Point3d(x, y, z))
    
    # Now, we define the faces of the mesh
    for i in range(len(x_values) - 1):
        for j in range(len(y_values) - 1):
            mesh.Faces.AddFace(i + j * len(x_values), 
                               (i + 1) + j * len(x_values), 
                               (i + 1) + (j + 1) * len(x_values), 
                               i + (j + 1) * len(x_values))

    return mesh

# Parameters
a = 2                # type: float
b = 1.5              # type: float
c = 0.5              # type: float
d = 1                # type: float
e = 2                # type: float
f = 1                # type: float
res_x = 100          # type: int
res_y = 100          # type: int
range_x = 2*np.pi    # type: float
range_y = 2*np.pi    # type: float

# Get the mesh from our function using parameters
result_mesh = parametric_trig_poly(a, b, c, d, e, f, res_x, res_y, range_x, range_y)
# ---------- end the_inverse_sine_function_4 ----------
entwine = Entwine(Branch00=geometry, Branch01=geometry_2, Branch02=geometry_3, FlattenInputs=True)  # disabled
entwine_2 = Entwine(Branch00=geometry_4, FlattenInputs=True)  # disabled
entwine_3 = Entwine(Branch00=geometry_5, Branch01=geometry_6, Branch02=geometry_7, FlattenInputs=True)  # disabled
panel_6 = Panel(the_inverse_sine_function_4.out)
geometry_8 = Geometry(the_inverse_sine_function_4.result_mesh)
panel_7 = Panel(entwine)  # disabled
panel_8 = Panel(entwine_2)  # disabled
# gpt-4 Initial Response
# The task of creating a 3D model based on the
#  inverse sine function (also known as arcsin or
# sin^(-1)) can be achieved by visualizing the
# function in 3D space using Rhino's API.
# 
# We will visualize the inverse sine function on a
# plane. Points on the plane will represent the (x,
# arcsin(x)) pair. To create a visual 3D
# representation, we can loft through a set of
# curves defined by these point pairs.
panel_9 = Panel(entwine_3)  # disabled
entwine_4 = Entwine(Branch00=geometry_8, FlattenInputs=True)
panel_10 = Panel(entwine_4)
