# Grasshopper definition 032_Inverse_Tangent_Function.gh (Grasshopper 1.0.7)
# plug-ins: RhinoCodePluginGH

# ----
# Oscillation Algorithm
# The oscillation algorithm can be use to animate
# any geometry that is driven by a number sliders.
# Simply swap out the number sliders at the
# multiplication node in the oscillation script.
trigger = Trigger(Interval=10, TimerInterval=10, Target=data_recorder)  # disabled
panel = Panel("1")  # disabled
data_recorder = DataRecorder(panel, DataLimit=-10, RecordData=False)  # disabled
number_slider = Slider(288, range=0..1000)  # disabled
# 2nd gpt-4 Text Prompt
# Great, now make the script much more complex model
# with complex trigonometric polynomials and the
# NUMPY python library. Be sure to incorporate the previous code logic.
# ensure that this script produces 3d geometry as
# well for Data visualization purposes.
# gpt-4 Initial Response
# To create a more complex 3D model, we can
# use a trigonometric polynomial to manipulate
# the surface further. A trigonometric polynomial
# combines various trigonometric functions with
# varying frequencies and phases.
# 
# In this example, we will use a trigonometric
# polynomial combined with the previous inverse
# tangent function to produce a unique surface.
# The trigonometric polynomial can be defined as:
list_length = ListLength(List=data_recorder)  # disabled
division = Division(A=list_length, B=number_slider)  # disabled
cosine = Cosine(Value=division)  # disabled
sine = Sine(Value=division)  # disabled
panel_2 = Panel([sine, cosine])  # disabled
multiplication = Multiplication(A=cosine)  # disabled
multiplication_2 = Multiplication(B=sine)  # disabled

# ----
# ADVANCED
# PARAMETRIC
# def trig_polynomial(x, y, coeffs):
#     a0, a1, b1, a2, b2 = coeffs
#     return a0 + a1 * np.cos(x) + b1 * np.sin(y) + a2 * np.cos(2*x) + b2 * np.sin(2*y)
number_slider_2 = Slider(-10, range=-10..10)
the_inverse_tangent_function = Script()  # -> out, a, b, c; inputs A: Double, B: Double, C: Double; disabled
# ---------- the_inverse_tangent_function: Python ----------
import Rhino.Geometry as rg
import numpy as np

def trig_polynomial(x, y, coeffs):
    """
    Calculate a 2D trigonometric polynomial.

    Parameters:
    - x, y: numpy arrays representing the x and y coordinates.
    - coeffs: coefficients for the polynomial.

    Returns:
    - A numpy array with the polynomial values.
    """
    a0, a1, b1, a2, b2 = coeffs
    return a0 + a1 * np.cos(x) + b1 * np.sin(y) + a2 * np.cos(2*x) + b2 * np.sin(2*y)

def arctan_complex_surface(uv_domain, resolution, coeffs):
    """
    Generate a 3D surface based on the inverse tangent function and a trigonometric polynomial.

    Parameters as before, with an added coeffs parameter for the polynomial coefficients.

    Returns:
    - A Rhino.Geometry.Mesh representing the surface.
    """

    u_domain, v_domain = uv_domain
    u_min, u_max = u_domain
    v_min, v_max = v_domain

    u_step = (u_max - u_min) / resolution
    v_step = (v_max - v_min) / resolution

    mesh = rg.Mesh()

    # Using numpy for more efficient calculation
    u = np.linspace(u_min, u_max, resolution+1)
    v = np.linspace(v_min, v_max, resolution+1)
    U, V = np.meshgrid(u, v)

    Z = np.arctan(U * V) + trig_polynomial(U, V, coeffs)

    for i in range(resolution + 1):
        for j in range(resolution + 1):
            mesh.Vertices.Add(U[i,j], V[i,j], Z[i,j])

    for i in range(resolution):
        for j in range(resolution):
            mesh.Faces.AddFace(i + j * (resolution + 1),
                               i + 1 + j * (resolution + 1),
                               i + 1 + (j + 1) * (resolution + 1),
                               i + (j + 1) * (resolution + 1))

    return mesh

# Example usage:
uv_domain = ((-10, 10), (-10, 10))
resolution = 100
coeffs = (1.0, 0.5, 0.5, 0.25, 0.25)
arctan_mesh_complex = arctan_complex_surface(uv_domain, resolution, coeffs)

# Output the mesh
a = arctan_mesh_complex
# ---------- end the_inverse_tangent_function ----------
# gpt-4 Text Prompt
# Learn Single-Variable Calculus
# with Python in Grasshopper
# at Wickerson Studios
# Create a geometric 3D model with
# 
# Single-Variable Calculus
#  THE ELEMENTARY
# TRANSCENDENTAL FUNCTIONS
#  The Inverse Trigonometric Functions
# 
# to create a 3D model specifically about
# 
# The Inverse Tangent Function
# 
# 
# in python 3 code for the python 3 script
# node in grasshopper for Rhino8WIP using the
# 
# Rhino Common API to create some geometry as well.
# 
# Output the parts of the model in different
# variable outputs in the python 3 node in
# grasshopper.
# 003 THE ELEMENTARY
# TRANSCENDENTAL FUNCTIONS
# 003 The Inverse Trigonometric Functions
# 032 The Inverse Tangent Function
the_inverse_tangent_function_2 = Script()  # -> out, a, b, c; inputs A: Double, B: Double, C: Double
# ---------- the_inverse_tangent_function_2: Python ----------
import Rhino.Geometry as rg
import math

def arctan_surface(uv_domain, resolution):
    """
    Generate a 3D surface based on the inverse tangent function.

    Parameters:
    - uv_domain: a tuple of tuples defining the x and y domain for the function.
                 For example: ((-10, 10), (-10, 10)) would define x and y each ranging from -10 to 10.
    - resolution: the resolution of the surface in both x and y direction.

    Returns:
    - A Rhino.Geometry.Mesh representing the surface.
    """

    u_domain, v_domain = uv_domain
    u_min, u_max = u_domain
    v_min, v_max = v_domain

    u_step = (u_max - u_min) / resolution
    v_step = (v_max - v_min) / resolution

    mesh = rg.Mesh()

    # Create the vertices for the mesh based on our function
    for i in range(resolution + 1):
        for j in range(resolution + 1):
            u = u_min + i * u_step
            v = v_min + j * v_step
            z = math.atan(u * v)
            mesh.Vertices.Add(u, v, z)

    # Create the faces of the mesh
    for i in range(resolution):
        for j in range(resolution):
            mesh.Faces.AddFace(i + j * (resolution + 1),
                               i + 1 + j * (resolution + 1),
                               i + 1 + (j + 1) * (resolution + 1),
                               i + (j + 1) * (resolution + 1))

    return mesh

# Example usage:
uv_domain = ((-10, 10), (-10, 10))
resolution = 100
arctan_mesh = arctan_surface(uv_domain, resolution)

# Output the mesh
a = arctan_mesh
# ---------- end the_inverse_tangent_function_2 ----------
geometry = Geometry(the_inverse_tangent_function.a)  # disabled
geometry_2 = Geometry(the_inverse_tangent_function_2.a)
panel_3 = Panel(the_inverse_tangent_function.out)  # disabled
panel_4 = Panel(the_inverse_tangent_function_2.out)
the_inverse_tangent_function_3 = Script(
    uMin=number_slider_2,
    uMax=Slider(10, range=-10..10),
    vMin=Slider(-10, range=-10..10),
    vMax=Slider(10, range=-10..10),
    resolution=Slider(100, range=0..100),
    coeffs=[Slider(1, range=0..1), Slider(0.5, range=0..1), Slider(0.5, range=0..1), Slider(0.25, range=0..1), Slider(0.25, range=0..1)])  # -> out, a, b, c; inputs uMin: Double, uMax: Double, vMin: Double, vMax: Double, resolution: Int32, coeffs: list of Double
# ---------- the_inverse_tangent_function_3: Python ----------
import Rhino.Geometry as rg
import numpy as np

def trig_polynomial(x, y, coeffs):
    """
    Calculate a 2D trigonometric polynomial.

    Parameters:
    - x, y: numpy arrays representing the x and y coordinates.
    - coeffs: coefficients for the polynomial.

    Returns:
    - A numpy array with the polynomial values.
    """
    a0, a1, b1, a2, b2 = coeffs
    return a0 + a1 * np.cos(x) + b1 * np.sin(y) + a2 * np.cos(2*x) + b2 * np.sin(2*y)

def arctan_complex_surface(uv_domain, resolution, coeffs):
    """
    Generate a 3D surface based on the inverse tangent function and a trigonometric polynomial.

    Parameters as before, with an added coeffs parameter for the polynomial coefficients.

    Returns:
    - A Rhino.Geometry.Mesh representing the surface.
    """

    u_domain, v_domain = uv_domain
    u_min, u_max = u_domain
    v_min, v_max = v_domain

    u_step = (u_max - u_min) / resolution
    v_step = (v_max - v_min) / resolution

    mesh = rg.Mesh()

    # Using numpy for more efficient calculation
    u = np.linspace(u_min, u_max, resolution+1)
    v = np.linspace(v_min, v_max, resolution+1)
    U, V = np.meshgrid(u, v)

    Z = np.arctan(U * V) + trig_polynomial(U, V, coeffs)

    for i in range(resolution + 1):
        for j in range(resolution + 1):
            mesh.Vertices.Add(U[i,j], V[i,j], Z[i,j])

    for i in range(resolution):
        for j in range(resolution):
            mesh.Faces.AddFace(i + j * (resolution + 1),
                               i + 1 + j * (resolution + 1),
                               i + 1 + (j + 1) * (resolution + 1),
                               i + (j + 1) * (resolution + 1))

    return mesh

# Example usage:
uv_domain = ((uMin, uMax), (vMin, vMax))
#resolution = 100
#coeffs = (1.0, 0.5, 0.5, 0.25, 0.25)
arctan_mesh_complex = arctan_complex_surface(uv_domain, resolution, coeffs)

# Output the mesh
a = arctan_mesh_complex
# ---------- end the_inverse_tangent_function_3 ----------
entwine = Entwine(Branch00=geometry, FlattenInputs=True)  # disabled
entwine_2 = Entwine(Branch00=geometry_2, FlattenInputs=True)
geometry_3 = Geometry(the_inverse_tangent_function_3.a)
panel_5 = Panel(entwine)  # disabled
# gpt-4 Initial Response
# Creating a 3D model using the inverse tangent
# function (arctan or tan^(-1)) involves interpreting
#  the function in a 3D space. One interesting way
#  to visualize the arctan function is to treat it as a
# surface with two input parameters.
# 
# We can model this surface in 3D space with
# 
# z=arctan(x×y). This way, the product of x and y
# determines the height z according to the inverse
#  tangent function.
panel_6 = Panel(entwine_2)
panel_7 = Panel(the_inverse_tangent_function_3.out)
mesh_box = MeshBox(Base={Plane=PlaneXY(0, 0, 0), X=Domain(-10, 10), Y=Domain(-10, 10), Z=Domain(-10, 10)}, XCount=10, YCount=10, ZCount=10)
entwine_3 = Entwine(Branch00=geometry_3, FlattenInputs=True)
mesh_split = MeshSplit(Mesh=mesh_box, Splitters=geometry_3)
panel_8 = Panel(entwine_3)
dispatch = Dispatch(List=mesh_split, DispatchPattern=[True, False])  # -> ListA, ListB
mesh = Mesh(dispatch.ListA)
mesh_2 = Mesh(dispatch.ListB)
mesh_join = MeshJoin(Meshes=flatten([geometry_3, mesh]))
mesh_join_2 = MeshJoin(Meshes=flatten([geometry_3, mesh_2]))
