# Grasshopper definition 033_Inverse_Cosine_Function.gh (Grasshopper 1.0.7)
# plug-ins: RhinoCodePluginGH

# ----
# Oscillation Algorithm
# The oscillation algorithm can be use to animate
# any geometry that is driven by a number sliders.
# Simply swap out the number sliders at the
# multiplication node in the oscillation script.
trigger = Trigger(Interval=10, TimerInterval=10, Target=data_recorder)  # disabled
panel = Panel("1")  # disabled
data_recorder = DataRecorder(panel, DataLimit=-10, RecordData=False)  # disabled
number_slider = Slider(288, range=0..1000)  # disabled
# 2nd gpt-4 Text Prompt
# Great, now make the script much more complex model
# with complex trigonometric polynomials and the
# NUMPY python library. Be sure to incorporate the previous code logic.
# ensure that this script produces 3d geometry as
# well for Data visualization purposes.
# gpt-4 Initial Response
# To create a more complex 3D model, we can
# use a trigonometric polynomial to manipulate
# the surface further. A trigonometric polynomial
# combines various trigonometric functions with
# varying frequencies and phases.
# 
# In this example, we will use a trigonometric
# polynomial combined with the previous inverse
# tangent function to produce a unique surface.
# The trigonometric polynomial can be defined as:
list_length = ListLength(List=data_recorder)  # disabled
division = Division(A=list_length, B=number_slider)  # disabled
cosine = Cosine(Value=division)  # disabled
sine = Sine(Value=division)  # disabled
panel_2 = Panel([sine, cosine])  # disabled
multiplication = Multiplication(A=cosine)  # disabled
multiplication_2 = Multiplication(B=sine)  # disabled

# ----
# ADVANCED
# PARAMETRIC
# def trigonometric_poly(x, y, a, b, c):
#     """Trigonometric polynomial function with arccos."""
#     N = len(a) - 1  # Number of terms
#     result = a[0]
# 
#     for n in range(1, N + 1):
#         arccos_term = np.vectorize(lambda val: math.acos(val) if -1 <= val <= 1 else 0)(x)
#         result += a[n] * np.cos(n * x) + b[n] * np.sin(n * y) + c[n] * arccos_term
# 
#     return result
number_slider_2 = Slider(1, range=0..1)
# gpt-4 Text Prompt
# Learn Single-Variable Calculus
# with Python in Grasshopper
# at Wickerson Studios
# Create a geometric 3D model with
# 
# Single-Variable Calculus
#  THE ELEMENTARY
# TRANSCENDENTAL FUNCTIONS
#  The Inverse Trigonometric Functions
# 
# to create a 3D model specifically about
# 
# The Inverse Cosine Function
# 
# 
# in python 3 code for the python 3 script
# node in grasshopper for Rhino8WIP using the
# 
# Rhino Common API to create some geometry as well.
# 
# Output the parts of the model in different
# variable outputs in the python 3 node in
# grasshopper.
# 003 THE ELEMENTARY
# TRANSCENDENTAL FUNCTIONS
# 003 The Inverse Trigonometric Functions
# 033 The Inverse Cosine Function
the_inverse_cosine_function = Script()  # -> out, a, b, c; inputs A: Double, B: Double, C: Double; disabled
# ---------- the_inverse_cosine_function: Python ----------
import Rhino.Geometry as rg
import math

def create_arccos_surface(u_count, v_count, u_range, v_range):
    """Create a surface representing the arccos function."""

    # Lists to store curves
    curves = []

    # Calculate spacing for u direction
    du = (u_range[1] - u_range[0]) / (u_count - 1)

    # Generate curves for the arccos function
    for i in range(u_count):
        u = u_range[0] + i * du
        points = [rg.Point3d(u, v_range[0] + j * (v_range[1] - v_range[0]) / (v_count - 1), math.acos(u) if -1 <= u <= 1 else 0) for j in range(v_count)]
        curve = rg.Curve.CreateInterpolatedCurve(points, 3)
        curves.append(curve)

    # Create surface from curves using loft
    loft_type = rg.LoftType.Normal
    loft_rebuild_count = 0
    surface = rg.Brep.CreateFromLoft(curves, rg.Point3d.Unset, rg.Point3d.Unset, loft_type, False)[0]

    return surface

# Setting up the parameters
u_count = 50  # number of points in u direction
v_count = 50  # number of points in v direction
u_range = [-1, 1]  # domain of arccos
v_range = [0, 2*math.pi]  # we'll just vary v in the [0, 2π] range for visualization

# Create the arccos surface
surface = create_arccos_surface(u_count, v_count, u_range, v_range)

# Output
a = surface
# ---------- end the_inverse_cosine_function ----------
geometry = Geometry(the_inverse_cosine_function.a)  # disabled
panel_3 = Panel(the_inverse_cosine_function.out)  # disabled
entwine = Entwine(Branch00=geometry, Branch01=the_inverse_cosine_function.b, Branch02=the_inverse_cosine_function.c, FlattenInputs=True)  # disabled
the_inverse_cosine_function_2 = Script(
    a=[number_slider_2, Slider(1, range=0..1), Slider(0.78, range=0..1), Slider(0, range=0..1)],
    b=[Slider(1, range=0..1), Slider(1, range=0..1), Slider(0.12, range=0..1), Slider(0.2, range=0..1)],
    c=[Slider(1, range=0..1), Slider(0.34, range=0..1), Slider(0.26, range=0..1), Slider(0.41, range=0..1)])  # -> out, a, b, c; inputs a: list of Double, b: list of Double, c: list of Double
# ---------- the_inverse_cosine_function_2: Python ----------
import Rhino.Geometry as rg
import numpy as np
import math

def trigonometric_poly(x, y, a, b, c):
    """Trigonometric polynomial function with arccos."""
    N = len(a) - 1  # Number of terms
    result = a[0]
    
    for n in range(1, N + 1):
        arccos_term = np.vectorize(lambda val: math.acos(val) if -1 <= val <= 1 else 0)(x)
        result += a[n] * np.cos(n * x) + b[n] * np.sin(n * y) + c[n] * arccos_term
    
    return result

def create_complex_surface(u_count, v_count, u_range, v_range, a, b, c):
    """Create a surface representing the combination of arccos and trig polynomial."""

    # Calculate spacing for u and v directions
    u = np.linspace(u_range[0], u_range[1], u_count)
    v = np.linspace(v_range[0], v_range[1], v_count)
    U, V = np.meshgrid(u, v)

    # Trigonometric polynomial
    Z = trigonometric_poly(U, V, a, b, c)

    # Convert numpy arrays to Rhino-compatible point grid
    points = [[rg.Point3d(U[i, j], V[i, j], Z[i, j]) for j in range(v_count)] for i in range(u_count)]
    
    # Create curves from points
    curves = [rg.Curve.CreateInterpolatedCurve(pt_row, 3) for pt_row in points]

    # Create surface from curves using loft
    surface = rg.Brep.CreateFromLoft(curves, rg.Point3d.Unset, rg.Point3d.Unset, rg.LoftType.Normal, False)[0]

    return surface

# Coefficients for trigonometric polynomial
#a = [1, 0.5, 0.3, 0.2]  # Coefficients for cosine terms
#b = [0, 0.4, 0.2, 0.1]  # Coefficients for sine terms
#c = [0, 0.3, 0.2, 0.1]  # Coefficients for arccos terms

# Setting up the parameters
u_count = 100  # number of points in u direction
v_count = 100  # number of points in v direction
u_range = [-1, 1]  # domain of arccos
v_range = [0, 2*math.pi]  # we'll just vary v in the [0, 2π] range for visualization

# Create the complex surface
surface = create_complex_surface(u_count, v_count, u_range, v_range, a, b, c)

# Output
a = surface
# ---------- end the_inverse_cosine_function_2 ----------
geometry_2 = Geometry(the_inverse_cosine_function_2.a)
# gpt-4 Initial Response
# Sure, I can provide you with a Python script to
# create a 3D model of the inverse cosine
# function using Rhino's Common API.
# 
# For this example, we'll generate a surface
# representing the inverse cosine (arccos)
# function in 3D space. Since the inverse cosine
# function only takes values in the range [-1, 1],
# and outputs values in the range [0, π], the
# surface will span this domain and range.
panel_4 = Panel(entwine)  # disabled
panel_5 = Panel(the_inverse_cosine_function_2.out)
entwine_2 = Entwine(
    Branch00=geometry_2,
    Branch01=the_inverse_cosine_function_2.b,
    Branch02=the_inverse_cosine_function_2.c,
    FlattenInputs=True)
deconstruct_brep = DeconstructBrep(Brep=geometry_2)  # -> Faces, Edges, Vertices
project = Project(Geometry=deconstruct_brep.Edges, Plane=PlaneXY(0, 0, 0))  # -> Geometry, Transform
panel_6 = Panel(entwine_2)
list_item = ListItem(List=deconstruct_brep.Edges, Index=0, Wrap=True)  # -> Item, Item1, Item2, Item3
list_item_2 = ListItem(List=project.Geometry, Index=0, Wrap=True)  # -> Item, Item1, Item2, Item3
boundary_surfaces = BoundarySurfaces(Edges=project.Geometry)
loft = Loft(
    Curves=[list_item.Item, list_item_2.Item],
    Options={Adjust=False, Closed=False, LoftEnds=0, LoftSimp=0, LoftType=0, Rebuild=10, Refit=0.01})
loft_2 = Loft(
    Curves=[list_item.Item1, list_item_2.Item1],
    Options={Adjust=False, Closed=False, LoftEnds=0, LoftSimp=0, LoftType=0, Rebuild=10, Refit=0.01})
loft_3 = Loft(
    Curves=[list_item.Item2, list_item_2.Item2],
    Options={Adjust=False, Closed=False, LoftEnds=0, LoftSimp=0, LoftType=0, Rebuild=10, Refit=0.01})
loft_4 = Loft(
    Curves=[list_item.Item3, list_item_2.Item3],
    Options={Adjust=False, Closed=False, LoftEnds=0, LoftSimp=0, LoftType=0, Rebuild=10, Refit=0.01})
brep_join = BrepJoin(Breps=[geometry_2, boundary_surfaces, loft, loft_2, loft_3, loft_4])  # -> Breps, Closed
