# Grasshopper definition 033b_Inverse_Cosine_Function.gh (Grasshopper 1.0.7)
# plug-ins: RhinoCodePluginGH

the_inverse_cosine_function = Script(
    a=[Slider(1, range=0..1), Slider(1, range=0..1), Slider(0, range=0..1), Slider(0, range=0..1)],
    b=[Slider(1, range=0..1), Slider(1, range=0..1), Slider(0, range=0..1), Slider(0, range=0..1)],
    c=[Slider(1, range=0..1), Slider(1, range=0..1), Slider(0, range=0..1), Slider(0, range=0..1)])  # -> out, a, b, c; inputs a: list of Double, b: list of Double, c: list of Double
# ---------- the_inverse_cosine_function: Python ----------
import Rhino.Geometry as rg
import numpy as np
import math

def trigonometric_poly(x, y, a, b, c):
    """Trigonometric polynomial function with arccos."""
    N = len(a) - 1  # Number of terms
    result = a[0]
    
    for n in range(1, N + 1):
        arccos_term = np.vectorize(lambda val: math.acos(val) if -1 <= val <= 1 else 0)(x)
        result += a[n] * np.cos(n * x) + b[n] * np.sin(n * y) + c[n] * arccos_term
    
    return result

def create_complex_surface(u_count, v_count, u_range, v_range, a, b, c):
    """Create a surface representing the combination of arccos and trig polynomial."""

    # Calculate spacing for u and v directions
    u = np.linspace(u_range[0], u_range[1], u_count)
    v = np.linspace(v_range[0], v_range[1], v_count)
    U, V = np.meshgrid(u, v)

    # Trigonometric polynomial
    Z = trigonometric_poly(U, V, a, b, c)

    # Convert numpy arrays to Rhino-compatible point grid
    points = [[rg.Point3d(U[i, j], V[i, j], Z[i, j]) for j in range(v_count)] for i in range(u_count)]
    
    # Create curves from points
    curves = [rg.Curve.CreateInterpolatedCurve(pt_row, 3) for pt_row in points]

    # Create surface from curves using loft
    surface = rg.Brep.CreateFromLoft(curves, rg.Point3d.Unset, rg.Point3d.Unset, rg.LoftType.Normal, False)[0]

    return surface

# Coefficients for trigonometric polynomial
#a = [1, 0.5, 0.3, 0.2]  # Coefficients for cosine terms
#b = [0, 0.4, 0.2, 0.1]  # Coefficients for sine terms
#c = [0, 0.3, 0.2, 0.1]  # Coefficients for arccos terms

# Setting up the parameters
u_count = 100  # number of points in u direction
v_count = 100  # number of points in v direction
u_range = [-1, 1]  # domain of arccos
v_range = [0, 2*math.pi]  # we'll just vary v in the [0, 2π] range for visualization

# Create the complex surface
surface = create_complex_surface(u_count, v_count, u_range, v_range, a, b, c)

# Output
a = surface
# ---------- end the_inverse_cosine_function ----------
geometry = Geometry(the_inverse_cosine_function.a)
panel = Panel(the_inverse_cosine_function.out)
entwine = Entwine(Branch00=geometry, Branch01=the_inverse_cosine_function.b, Branch02=the_inverse_cosine_function.c, FlattenInputs=True)
deconstruct_brep = DeconstructBrep(Brep=geometry)  # -> Faces, Edges, Vertices
project = Project(Geometry=deconstruct_brep.Edges, Plane=PlaneXY(0, 0, 0))  # -> Geometry, Transform
panel_2 = Panel(entwine)
list_item = ListItem(List=deconstruct_brep.Edges, Index=0, Wrap=True)  # -> Item, Item1, Item2, Item3
list_item_2 = ListItem(List=project.Geometry, Index=0, Wrap=True)  # -> Item, Item1, Item2, Item3
boundary_surfaces = BoundarySurfaces(Edges=project.Geometry)
loft = Loft(
    Curves=[list_item.Item, list_item_2.Item],
    Options={Adjust=False, Closed=False, LoftEnds=0, LoftSimp=0, LoftType=0, Rebuild=10, Refit=0.01})
loft_2 = Loft(
    Curves=[list_item.Item1, list_item_2.Item1],
    Options={Adjust=False, Closed=False, LoftEnds=0, LoftSimp=0, LoftType=0, Rebuild=10, Refit=0.01})
loft_3 = Loft(
    Curves=[list_item.Item2, list_item_2.Item2],
    Options={Adjust=False, Closed=False, LoftEnds=0, LoftSimp=0, LoftType=0, Rebuild=10, Refit=0.01})
loft_4 = Loft(
    Curves=[list_item.Item3, list_item_2.Item3],
    Options={Adjust=False, Closed=False, LoftEnds=0, LoftSimp=0, LoftType=0, Rebuild=10, Refit=0.01})
brep_join = BrepJoin(Breps=[geometry, boundary_surfaces, loft, loft_2, loft_3, loft_4])  # -> Breps, Closed
dispatch = Dispatch(List=flatten(brep_join.Breps), DispatchPattern=[True, False])  # -> ListA, ListB
brep_join_2 = BrepJoin(Breps=[dispatch.ListA, dispatch.ListB])  # -> Breps, Closed
volume = Volume(Geometry=brep_join_2.Breps)  # -> Volume, Centroid
panel_3 = Panel(volume.Volume)
galapagos = Galapagos()
