# Grasshopper definition 034_Derivative_Arccos_Function - Copy.gh (Grasshopper 1.0.7)
# plug-ins: RhinoCodePluginGH

# ----
# Oscillation Algorithm
# The oscillation algorithm can be use to animate
# any geometry that is driven by a number sliders.
# Simply swap out the number sliders at the
# multiplication node in the oscillation script.
trigger = Trigger(Interval=10, TimerInterval=10, Target=data_recorder)  # disabled
panel = Panel("1")  # disabled
data_recorder = DataRecorder(panel, DataLimit=-10, RecordData=False)  # disabled
number_slider = Slider(288, range=0..1000)  # disabled
# 2nd gpt-4 Text Prompt
# Great, now make the script much more complex model
# with complex trigonometric polynomials and the
# NUMPY python library. Be sure to incorporate the previous code logic.
# ensure that this script produces 3d geometry as
# well for Data visualization purposes.
# gpt-4 Initial Response
# To create a more complex 3D model, we can
# use a trigonometric polynomial to manipulate
# the surface further. A trigonometric polynomial
# combines various trigonometric functions with
# varying frequencies and phases.
# 
# In this example, we will use a trigonometric
# polynomial combined with the previous inverse
# tangent function to produce a unique surface.
# The trigonometric polynomial can be defined as:
list_length = ListLength(List=data_recorder)  # disabled
division = Division(A=list_length, B=number_slider)  # disabled
cosine = Cosine(Value=division)  # disabled
sine = Sine(Value=division)  # disabled
panel_2 = Panel([sine, cosine])  # disabled
multiplication = Multiplication(A=cosine)  # disabled
multiplication_2 = Multiplication(B=sine)  # disabled

# ----
# ADVANCED
# PARAMETRIC
# def trigonometric_poly(x, y, a, b, c):
#     """Trigonometric polynomial function with arccos."""
#     N = len(a) - 1  # Number of terms
#     result = a[0]
# 
#     for n in range(1, N + 1):
#         arccos_term = np.vectorize(lambda val: math.acos(val) if -1 <= val <= 1 else 0)(x)
#         result += a[n] * np.cos(n * x) + b[n] * np.sin(n * y) + c[n] * arccos_term
# 
#     return result
number_slider_2 = Slider(4, range=0..4)
# gpt-4 Text Prompt
# Learn Single-Variable Calculus
# with Python in Grasshopper
# at Wickerson Studios
# Create a geometric 3D model with
# 
# Single-Variable Calculus
#  THE ELEMENTARY
# TRANSCENDENTAL FUNCTIONS
#  The Inverse Trigonometric Functions
# 
# to create a 3D model specifically about
# 
#  Derivative of  Arccos Function
# 
# 
# in python 3 code for the python 3 script
# node in grasshopper for Rhino8WIP using the
# 
# Rhino Common API to create some geometry as well.
# 
# Output the parts of the model in different
# variable outputs in the python 3 node in
# grasshopper.
# 003 THE ELEMENTARY
# TRANSCENDENTAL FUNCTIONS
# 003 The Inverse Trigonometric Functions
# 034 Derivative of  Arccos Function
derivative_of_arccos_function = Script()  # -> out, a_out, a, b, c; inputs A: Double, B: Double, C: Double; disabled
# ---------- derivative_of_arccos_function: Python ----------
import Rhino.Geometry as rg
import numpy as np
import math

def derivative_arccos(x):
    """Derivative of the arccos function."""
    with np.errstate(divide='ignore', invalid='ignore'):
        result = -1 / np.sqrt(1 - x**2)
    result[np.abs(x) >= 1] = 0
    return result

def trigonometric_poly(x, y, a, b, c):
    """Trigonometric polynomial function with derivative of arccos."""
    N = len(a) - 1  # Number of terms
    result = a[0]
    
    for n in range(1, N + 1):
        arccos_derivative = derivative_arccos(x)
        result += a[n] * np.cos(n * x) + b[n] * np.sin(n * y) + c[n] * arccos_derivative
    
    return result

def create_complex_surface(u_count, v_count, u_range, v_range, a, b, c):
    """Create a surface representing the combination of derivative of arccos and trig polynomial."""

    # Calculate spacing for u and v directions
    u = np.linspace(u_range[0], u_range[1], u_count)
    v = np.linspace(v_range[0], v_range[1], v_count)
    U, V = np.meshgrid(u, v)

    # Trigonometric polynomial
    Z = trigonometric_poly(U, V, a, b, c)

    # Convert numpy arrays to Rhino-compatible point grid
    points = [[rg.Point3d(U[i, j], V[i, j], Z[i, j]) for j in range(v_count)] for i in range(u_count)]
    
    # Create curves from points
    curves = [rg.Curve.CreateInterpolatedCurve(pt_row, 3) for pt_row in points]

    # Create surface from curves using loft
    surface = rg.Brep.CreateFromLoft(curves, rg.Point3d.Unset, rg.Point3d.Unset, rg.LoftType.Normal, False)[0]

    return surface

# Coefficients for trigonometric polynomial
a = [1, 0.5, 0.3, 0.2]  # Coefficients for cosine terms
b = [0, 0.4, 0.2, 0.1]  # Coefficients for sine terms
c = [0, 0.3, 0.2, 0.1]  # Coefficients for derivative arccos terms

# Setting up the parameters
u_count = 100  # number of points in u direction
v_count = 100  # number of points in v direction
u_range = [-1, 1]  # domain of arccos derivative
v_range = [0, 2*math.pi]  # we'll just vary v in the [0, 2π] range for visualization

# Create the complex surface
surface = create_complex_surface(u_count, v_count, u_range, v_range, a, b, c)

# Output
a_out = surface
# ---------- end derivative_of_arccos_function ----------
geometry = Geometry(derivative_of_arccos_function.a_out)  # disabled
panel_3 = Panel(derivative_of_arccos_function.out)  # disabled
entwine = Entwine(
    Branch00=geometry,
    Branch01=derivative_of_arccos_function.a,
    Branch02=derivative_of_arccos_function.b,
    Branch03=derivative_of_arccos_function.c,
    FlattenInputs=True)  # disabled
derivative_of_arccos_function_2 = Script(
    a=[number_slider_2, Slider(4, range=0..4), Slider(1, range=0..1), Slider(0, range=0..1)],
    b=[Slider(1, range=0..1), Slider(0, range=0..1), Slider(0, range=0..1), Slider(0.3, range=0..1)],
    c=[Slider(1, range=0..1), Slider(1, range=0..1), Slider(0, range=0..1), Slider(0, range=0..1)])  # -> out, a_out, a, b, c; inputs a: list of Double, b: list of Double, c: list of Double
# ---------- derivative_of_arccos_function_2: Python ----------
import Rhino.Geometry as rg
import numpy as np
import math

def derivative_arccos(x):
    """Derivative of the arccos function."""
    with np.errstate(divide='ignore', invalid='ignore'):
        result = -1 / np.sqrt(1 - x**2)
    result[np.abs(x) >= 1] = 0
    return result

def trigonometric_poly(x, y, a, b, c):
    """Trigonometric polynomial function with derivative of arccos."""
    N = len(a) - 1  # Number of terms
    result = a[0]
    
    for n in range(1, N + 1):
        arccos_derivative = derivative_arccos(x)
        result += a[n] * np.cos(n * x) + b[n] * np.sin(n * y) + c[n] * arccos_derivative
    
    return result

def create_complex_surface(u_count, v_count, u_range, v_range, a, b, c):
    """Create a surface representing the combination of derivative of arccos and trig polynomial."""

    # Calculate spacing for u and v directions
    u = np.linspace(u_range[0], u_range[1], u_count)
    v = np.linspace(v_range[0], v_range[1], v_count)
    U, V = np.meshgrid(u, v)

    # Trigonometric polynomial
    Z = trigonometric_poly(U, V, a, b, c)

    # Convert numpy arrays to Rhino-compatible point grid
    points = [[rg.Point3d(U[i, j], V[i, j], Z[i, j]) for j in range(v_count)] for i in range(u_count)]
    
    # Create curves from points
    curves = [rg.Curve.CreateInterpolatedCurve(pt_row, 3) for pt_row in points]

    # Create surface from curves using loft
    surface = rg.Brep.CreateFromLoft(curves, rg.Point3d.Unset, rg.Point3d.Unset, rg.LoftType.Normal, False)[0]

    return surface

# Coefficients for trigonometric polynomial
#a = [1, 0.5, 0.3, 0.2]  # Coefficients for cosine terms
#b = [0, 0.4, 0.2, 0.1]  # Coefficients for sine terms
#c = [0, 0.3, 0.2, 0.1]  # Coefficients for derivative arccos terms

# Setting up the parameters
u_count = 100  # number of points in u direction
v_count = 100  # number of points in v direction
u_range = [-1, 1]  # domain of arccos derivative
v_range = [0, 2*math.pi]  # we'll just vary v in the [0, 2π] range for visualization

# Create the complex surface
surface = create_complex_surface(u_count, v_count, u_range, v_range, a, b, c)

# Output
a_out = surface
# ---------- end derivative_of_arccos_function_2 ----------
# gpt-4 Initial Response
# The derivative of the arccos function is given by:
# def derivative_arccos(x):
#     """Derivative of the arccos function."""
#     with np.errstate(divide='ignore', invalid='ignore'):
#         result = -1 / np.sqrt(1 - x**2)
#     result[np.abs(x) >= 1] = 0
#     return result
panel_4 = Panel(entwine)  # disabled
geometry_2 = Geometry(derivative_of_arccos_function_2.a_out)
panel_5 = Panel(derivative_of_arccos_function_2.out)
entwine_2 = Entwine(
    Branch00=geometry_2,
    Branch01=derivative_of_arccos_function_2.a,
    Branch02=derivative_of_arccos_function_2.b,
    Branch03=derivative_of_arccos_function_2.c,
    FlattenInputs=True)
panel_6 = Panel(entwine_2)
