# Grasshopper definition 035_DArcsec_Function - Copy.gh (Grasshopper 1.0.7)
# plug-ins: RhinoCodePluginGH

# ----
# Oscillation Algorithm
# The oscillation algorithm can be use to animate
# any geometry that is driven by a number sliders.
# Simply swap out the number sliders at the
# multiplication node in the oscillation script.
trigger = Trigger(Interval=10, TimerInterval=10, Target=data_recorder)  # disabled
panel = Panel("1")  # disabled
data_recorder = DataRecorder(panel, DataLimit=-10, RecordData=False)  # disabled
number_slider = Slider(288, range=0..1000)  # disabled
# 2nd gpt-4 Text Prompt
# Great, now make the script much more complex model
# with complex trigonometric polynomials and the
# NUMPY python library. Be sure to incorporate the previous code logic.
# ensure that this script produces 3d geometry as
# well for Data visualization purposes.
# gpt-4 Initial Response
# To create a more complex 3D model, we can
# use a trigonometric polynomial to manipulate
# the surface further. A trigonometric polynomial
# combines various trigonometric functions with
# varying frequencies and phases.
# 
# In this example, we will use a trigonometric
# polynomial combined with the previous inverse
# tangent function to produce a unique surface.
# The trigonometric polynomial can be defined as:
list_length = ListLength(List=data_recorder)  # disabled
division = Division(A=list_length, B=number_slider)  # disabled
cosine = Cosine(Value=division)  # disabled
sine = Sine(Value=division)  # disabled
panel_2 = Panel([sine, cosine])  # disabled
multiplication = Multiplication(A=cosine)  # disabled
multiplication_2 = Multiplication(B=sine)  # disabled

# ----
# PARAMETRIC
number_slider_2 = Slider(4, range=0..4)
# gpt-4 Text Prompt
# Create a geometric 3D model with
# 
# Single-Variable Calculus
#  THE ELEMENTARY
# TRANSCENDENTAL FUNCTIONS
#  The Inverse Trigonometric Functions
# 
# to create a 3D model specifically about
# 
#  Arcsec Function
# 
# 
# in python 3 code for the python 3 script
# node in grasshopper for Rhino8WIP using the
# 
# Rhino Common API to create some geometry as well.
# 
# Output the parts of the model in different
# variable outputs in the python 3 node in
# grasshopper.
# 003 THE ELEMENTARY
# TRANSCENDENTAL FUNCTIONS
# 003 The Inverse Trigonometric Functions
# 035 Arcsec Function
# ADVANCED
arcsec_function = Script()  # -> out, a_out, a, b, c; inputs a: list of Double, b: list of Double
# ---------- arcsec_function: Python ----------
import Rhino.Geometry as rg
import numpy as np
import math

def arcsec(x):
    """arcsec function."""
    with np.errstate(divide='ignore', invalid='ignore'):
        result = np.arccos(1.0 / x)
    return result

def wavy_surface_function(x, y):
    """Function combining arcsec and a modulated sine wave."""
    arcsec_value = arcsec(x)
    return arcsec_value + np.sin(y + arcsec_value)

def create_wavy_surface(u_count, v_count, u_range, v_range):
    """Create a wavy surface using the arcsec function."""

    # Calculate spacing for u and v directions
    u = np.linspace(u_range[0], u_range[1], u_count)
    v = np.linspace(v_range[0], v_range[1], v_count)
    U, V = np.meshgrid(u, v)

    # Calculate the z values
    Z = wavy_surface_function(U, V)

    # Convert numpy arrays to Rhino-compatible point grid
    points = [[rg.Point3d(U[i, j], V[i, j], Z[i, j]) for j in range(v_count)] for i in range(u_count)]
    
    # Create curves from points
    curves = [rg.Curve.CreateInterpolatedCurve(pt_row, 3) for pt_row in points]

    # Create surface from curves using loft
    surface = rg.Brep.CreateFromLoft(curves, rg.Point3d.Unset, rg.Point3d.Unset, rg.LoftType.Normal, False)[0]

    return surface

# Setting up the parameters
u_count = 100  # number of points in u direction
v_count = 100  # number of points in v direction
u_range = [1.1, 3]  # adjust the range based on the domain of the arcsec function, avoiding x=1
v_range = [0, 2*math.pi]

# Create the wavy surface
surface = create_wavy_surface(u_count, v_count, u_range, v_range)

# Output
a = surface
# ---------- end arcsec_function ----------
geometry = Geometry(arcsec_function.a_out)
arcsec_function_2 = Script(
    a=[number_slider_2, Slider(0.28, range=0..4), Slider(0, range=0..1), Slider(0.32, range=0..1), Slider(0, range=0..1)],
    b=[Slider(1, range=0..1), Slider(0.34, range=0..1), Slider(0.11, range=0..1), Slider(0, range=0..1), Slider(0, range=0..1)])  # -> out, a_out, a, b, c; inputs a: list of Double, b: list of Double
# ---------- arcsec_function_2: Python ----------
import Rhino.Geometry as rg
import numpy as np
import math

def arcsec(x):
    """arcsec function."""
    with np.errstate(divide='ignore', invalid='ignore'):
        result = np.arccos(1.0 / x)
    return result

def trigonometric_poly(y, a, b):
    """Compute a trigonometric polynomial for given coefficients a and b."""
    N = min(len(a), len(b)) - 1
    result = a[0]
    
    for n in range(1, N + 1):
        result += a[n] * np.cos(n * y) + b[n] * np.sin(n * y)
    
    return result

def complex_surface_function(x, y, a, b):
    """Combine arcsec function with a trig polynomial."""
    return arcsec(x) + trigonometric_poly(y, a, b)

def create_complex_surface(u_count, v_count, u_range, v_range, a, b):
    """Create a surface using the complex surface function."""

    # Calculate spacing for u and v directions
    u = np.linspace(u_range[0], u_range[1], u_count)
    v = np.linspace(v_range[0], v_range[1], v_count)
    U, V = np.meshgrid(u, v)

    # Calculate the z values
    Z = complex_surface_function(U, V, a, b)

    # Convert numpy arrays to Rhino-compatible point grid
    points = [[rg.Point3d(U[i, j], V[i, j], Z[i, j]) for j in range(v_count)] for i in range(u_count)]
    
    # Create curves from points
    curves = [rg.Curve.CreateInterpolatedCurve(pt_row, 3) for pt_row in points]

    # Create surface from curves using loft
    surface = rg.Brep.CreateFromLoft(curves, rg.Point3d.Unset, rg.Point3d.Unset, rg.LoftType.Normal, False)[0]

    return surface

# Coefficients for trigonometric polynomial
a = [1, 0.5, 0.3, 0.2, 0.15]  # Coefficients for cosine terms
b = [0, 0.4, 0.2, 0.1, 0.05]  # Coefficients for sine terms

# Setting up the parameters
u_count = 100  # number of points in u direction
v_count = 100  # number of points in v direction
u_range = [1.1, 3]  # adjust the range based on the domain of the arcsec function, avoiding x=1
v_range = [0, 2*math.pi]

# Create the complex surface
surface = create_complex_surface(u_count, v_count, u_range, v_range, a, b)

# Output
a_out = surface
# ---------- end arcsec_function_2 ----------
# Learn Single-Variable Calculus
# with Python in Grasshopper
# at Wickerson Studios
panel_3 = Panel(arcsec_function.out)
entwine = Entwine(
    Branch00=geometry,
    Branch01=arcsec_function.a,
    Branch02=arcsec_function.b,
    Branch03=arcsec_function.c,
    FlattenInputs=True)
geometry_2 = Geometry(arcsec_function_2.a_out)
panel_4 = Panel(arcsec_function_2.out)
# gpt-4 Initial Response
# Certainly! The arccsc (arc-cosecant) function is
# the inverse of the csc function.
panel_5 = Panel(entwine)  # disabled
entwine_2 = Entwine(
    Branch00=geometry_2,
    Branch01=arcsec_function_2.a,
    Branch02=arcsec_function_2.b,
    Branch03=arcsec_function_2.c,
    FlattenInputs=True)
panel_6 = Panel(entwine_2)
