# Grasshopper definition 038_Definitions_of_Exponentials.gh (Grasshopper 1.0.7)
# plug-ins: RhinoCodePluginGH

# ----
# Oscillation Algorithm
# The oscillation algorithm can be use to animate
# any geometry that is driven by a number sliders.
# Simply swap out the number sliders at the
# multiplication node in the oscillation script.
trigger = Trigger(Interval=10, TimerInterval=10, Target=data_recorder)  # disabled
panel = Panel("1")  # disabled
data_recorder = DataRecorder(panel, DataLimit=-10, RecordData=False)  # disabled
number_slider = Slider(288, range=0..1000)  # disabled
# 2nd gpt-4 Text Prompt
# Great, now make the script much more complex model
# with complex trigonometric polynomials and the
# NUMPY python library. Be sure to incorporate the previous code logic.
# ensure that this script produces 3d geometry as
# well for Data visualization purposes.
# gpt-4 Initial Response
# Absolutely! We can certainly enhance the
# complexity of the generated model using more
# intricate trigonometric polynomials and
# leveraging the power of the numpy library for
# more efficient computations.
list_length = ListLength(List=data_recorder)  # disabled
division = Division(A=list_length, B=number_slider)  # disabled
cosine = Cosine(Value=division)  # disabled
sine = Sine(Value=division)  # disabled
panel_2 = Panel([sine, cosine])  # disabled
multiplication = Multiplication(A=cosine)  # disabled
multiplication_2 = Multiplication(A=sine)  # disabled

# ----
# ADVANCED
# z = math.exp(x + y)
# PARAMETRIC
#     Generates a list of points based on the function
#     f(x,y) = e^(x + y) * (sin(2*pi*x) + cos(2*pi*y)).
number_slider_2 = Slider(0.11, range=0.1..1)
# gpt-4 Text Prompt
# Learn Single-Variable Calculus
# with Python in Grasshopper
# at Wickerson Studios
# Create a geometric 3D model with
# 
# Single-Variable Calculus
#  THE ELEMENTARY
# TRANSCENDENTAL FUNCTIONS
# Exponential and Logarithmic Functions
# 
# to create a 3D model specifically about
# 
# Definition of Exponentials
# 
# 
# 
# in python 3 code for the python 3 script
# node in grasshopper for Rhino8WIP using the
# 
# Rhino Common API to create some geometry as well.
# 
# Output the parts of the model in different
# variable outputs in the python 3 node in
# grasshopper.
# 003 THE ELEMENTARY
# TRANSCENDENTAL FUNCTIONS
# 004 Exponential and Logarithmic Functions
# 038 Definition of Exponentials
definition_of_exponentials = Script()  # -> out, a, b; inputs a: list of Double, b: list of Double; disabled
# ---------- definition_of_exponentials: Python ----------
import Rhino.Geometry as rg
import math

def generate_exponential_surface(x_range, y_range, dx, dy):
    """
    Generates a list of points based on the exponential function f(x,y) = e^(x + y).
    
    Args:
        x_range (tuple): (min, max) values for x
        y_range (tuple): (min, max) values for y
        dx (float): spacing between points in x direction
        dy (float): spacing between points in y direction
        
    Returns:
        list of Rhino.Geometry.Point3d objects.
    """
    
    x_min, x_max = x_range
    y_min, y_max = y_range
    
    points = []
    for x in frange(x_min, x_max, dx):
        row = []
        for y in frange(y_min, y_max, dy):
            z = math.exp(x + y)
            row.append(rg.Point3d(x, y, z))
        points.append(row)
    return points

def frange(start, stop, step):
    """
    Floating point range function.
    """
    i = start
    while i < stop:
        yield i
        i += step

def create_surfaces_from_points(points):
    """
    Create a list of surfaces from grid of points.
    
    Args:
        points (list): 2D grid of points
    
    Returns:
        list of Rhino.Geometry.Surface objects.
    """
    surfaces = []
    for i in range(len(points)-1):
        for j in range(len(points[0])-1):
            corner1 = points[i][j]
            corner2 = points[i+1][j]
            corner3 = points[i+1][j+1]
            corner4 = points[i][j+1]
            surfaces.append(rg.NurbsSurface.CreateFromCorners(corner1, corner2, corner3, corner4))
    return surfaces

# Define the ranges and steps for x and y
x_range = (-2, 2)
y_range = (-2, 2)
dx = 0.1
dy = 0.1

# Generate points and surfaces
points = generate_exponential_surface(x_range, y_range, dx, dy)
surfaces = create_surfaces_from_points(points)

# Outputs
a = [pt for row in points for pt in row]
b = surfaces
# ---------- end definition_of_exponentials ----------
geometry = Geometry(definition_of_exponentials.a)  # disabled
geometry_2 = Geometry(definition_of_exponentials.b)  # disabled
definition_of_exponentials_2 = Script(dx=number_slider_2, dy=number_slider_2)  # -> out, a, b; inputs dx: Double, dy: Double
# ---------- definition_of_exponentials_2: Python ----------
import Rhino.Geometry as rg
import numpy as np

def generate_complex_surface(x_range, y_range, dx, dy):
    """
    Generates a list of points based on the function 
    f(x,y) = e^(x + y) * (sin(2*pi*x) + cos(2*pi*y)).
    
    Args:
        x_range (tuple): (min, max) values for x
        y_range (tuple): (min, max) values for y
        dx (float): spacing between points in x direction
        dy (float): spacing between points in y direction
        
    Returns:
        list of Rhino.Geometry.Point3d objects.
    """
    
    x_min, x_max = x_range
    y_min, y_max = y_range
    
    x = np.arange(x_min, x_max, dx)
    y = np.arange(y_min, y_max, dy)
    
    X, Y = np.meshgrid(x, y)
    
    Z = np.exp(X + Y) * (np.sin(2*np.pi*X) + np.cos(2*np.pi*Y))
    
    points = [[rg.Point3d(X[i,j], Y[i,j], Z[i,j]) for j in range(Y.shape[1])] for i in range(X.shape[0])]
    
    return points

def create_surfaces_from_points(points):
    """
    Create a list of surfaces from grid of points.
    
    Args:
        points (list): 2D grid of points
    
    Returns:
        list of Rhino.Geometry.Surface objects.
    """
    surfaces = []
    for i in range(len(points)-1):
        for j in range(len(points[0])-1):
            corner1 = points[i][j]
            corner2 = points[i+1][j]
            corner3 = points[i+1][j+1]
            corner4 = points[i][j+1]
            surfaces.append(rg.NurbsSurface.CreateFromCorners(corner1, corner2, corner3, corner4))
    return surfaces

# Define the ranges and steps for x and y
x_range = (-2, 2)
y_range = (-2, 2)
#dx = 0.1
#dy = 0.1

# Generate points and surfaces
points = generate_complex_surface(x_range, y_range, dx, dy)
surfaces = create_surfaces_from_points(points)

# Outputs
a = [pt for row in points for pt in row]
b = surfaces
# ---------- end definition_of_exponentials_2 ----------
panel_3 = Panel(definition_of_exponentials.out)  # disabled
entwine = Entwine(Branch00=geometry, Branch01=geometry_2, FlattenInputs=True)  # disabled
geometry_3 = Geometry(definition_of_exponentials_2.a)
geometry_4 = Geometry(definition_of_exponentials_2.b)
panel_4 = Panel(definition_of_exponentials_2.out)
entwine_2 = Entwine(Branch00=geometry_3, Branch01=geometry_4, FlattenInputs=True)
# gpt-4 Initial Response
# The following code provides a Python script to
# generate a 3D geometric model in Rhino using
#  Grasshopper's Python node. This code will
# create a surface based on the exponential
# function.
panel_5 = Panel(entwine)  # disabled
panel_6 = Panel(entwine_2)
