# Grasshopper definition 039_Laws_of_Exponents.gh (Grasshopper 1.0.7)
# plug-ins: RhinoCodePluginGH

# ----
# Oscillation Algorithm
# The oscillation algorithm can be use to animate
# any geometry that is driven by a number sliders.
# Simply swap out the number sliders at the
# multiplication node in the oscillation script.
trigger = Trigger(Interval=10, TimerInterval=10, Target=data_recorder)  # disabled
panel = Panel("1")  # disabled
data_recorder = DataRecorder(panel, DataLimit=-10, RecordData=False)  # disabled
number_slider = Slider(288, range=0..1000)  # disabled
# 2nd gpt-4 Text Prompt
# Great, now make the script much more complex model
# with complex trigonometric polynomials and the
# NUMPY python library. Be sure to incorporate the previous code logic.
# ensure that this script produces 3d geometry as
# well for Data visualization purposes.
# gpt-4 Initial Response
# Got it! Let's visualize the laws of exponents by
# creating three different geometries:
list_length = ListLength(List=data_recorder)  # disabled
division = Division(A=list_length, B=number_slider)  # disabled
cosine = Cosine(Value=division)  # disabled
sine = Sine(Value=division)  # disabled
panel_2 = Panel([sine, cosine])  # disabled
multiplication = Multiplication(A=cosine)  # disabled
multiplication_2 = Multiplication(A=sine)  # disabled

# ----
# ADVANCED
# z = math.exp(x + y)
# PARAMETRIC
#  # 1. a^m * a^n = a^{m+n}
#  # 2. a^m / a^n = a^{m-n}
# # 3. a^m * b^m = (a * b)^m
# PARAMETRIC
# def complex_trigonometric_polynomial(z, a, m, b, n):
#     """Compute a complex trigonometric polynomial."""
#     return a * np.sin(m * z) + b * np.cos(n * z)
number_slider_2 = Slider(1.2947, range=0..10)
# gpt-4 Text Prompt
# Create a geometric 3D model with
# 
# Single-Variable Calculus
#  THE ELEMENTARY
# TRANSCENDENTAL FUNCTIONS
# Exponential and Logarithmic Functions
# 
# to create a 3D model specifically about
# 
# Laws of Exponents
# 
# 
# 
# in python 3 code for the python 3 script
# node in grasshopper for Rhino8WIP using the
# 
# Rhino Common API to create some geometry as well.
# 
# Output the parts of the model in different
# variable outputs in the python 3 node in
# grasshopper.
# 003 THE ELEMENTARY
# TRANSCENDENTAL FUNCTIONS
# 004 Exponential and Logarithmic Functions
# 039 Laws of Exponents
laws_of_exponents = Script()  # -> out, a, b; inputs a: list of Double, b: list of Double; disabled
# ---------- laws_of_exponents: Python ----------
import Rhino
import math

def create_exponential_surface(x_range, y_range, x_steps, y_steps):
    """Creates a 3D surface using the exponential function."""
    points = []

    x_step = (x_range[1] - x_range[0]) / x_steps
    y_step = (y_range[1] - y_range[0]) / y_steps

    for i in range(x_steps+1):
        x = x_range[0] + i*x_step
        for j in range(y_steps+1):
            y = y_range[0] + j*y_step
            z = math.exp(x + y)  # Exponential function
            points.append(Rhino.Geometry.Point3d(x, y, z))

    return points

# Define the ranges and steps for the x and y axis
x_range = (-2, 2)
y_range = (-2, 2)
x_steps = 20
y_steps = 20

# Create the surface
points = create_exponential_surface(x_range, y_range, x_steps, y_steps)

# The output variable
a = points
# ---------- end laws_of_exponents ----------
number_slider_3 = Slider(3, range=0..10)  # disabled
number_slider_4 = Slider(2, range=0..10)  # disabled
number_slider_5 = Slider(2, range=0..10)  # disabled
number_slider_6 = Slider(1, range=0..10)  # disabled
geometry = Geometry(laws_of_exponents.a)  # disabled
geometry_2 = Geometry(laws_of_exponents.b)  # disabled
# Learn Single-Variable Calculus
# with Python in Grasshopper
# at Wickerson Studios
panel_3 = Panel(laws_of_exponents.out)  # disabled
entwine = Entwine(Branch00=geometry, Branch01=geometry_2, FlattenInputs=True)  # disabled
laws_of_exponents_2 = Script(
    a=number_slider_2,
    m=Slider(0.7053, range=0..10),
    b=Slider(3.3091, range=0..10),
    n=Slider(0.3122, range=0..10),
    steps=Slider(25, range=0..50))  # -> out, geometries, box_out; inputs a: Double, m: Double, b: Double, n: Double, steps: Int32
# ---------- laws_of_exponents_2: Python ----------
import Rhino
import numpy as np

def complex_trigonometric_polynomial(z, a, m, b, n):
    """Compute a complex trigonometric polynomial."""
    return a * np.sin(m * z) + b * np.cos(n * z)

def visualize_complex_trigonometric(a, m, b, n, x_range, y_range, steps):
    """Visualize the complex trigonometric polynomial."""
    x = np.linspace(x_range[0], x_range[1], steps)
    y = np.linspace(y_range[0], y_range[1], steps)
    
    X, Y = np.meshgrid(x, y)
    Z = X + 1j * Y  # Convert to complex numbers

    F = complex_trigonometric_polynomial(Z, a, m, b, n)
    heights = np.abs(F)  # Use the absolute values as heights

    surfaces = []

    for i in range(steps-1):
        for j in range(steps-1):
            pt1 = Rhino.Geometry.Point3d(X[i,j], Y[i,j], heights[i,j])
            pt2 = Rhino.Geometry.Point3d(X[i+1,j], Y[i+1,j], heights[i+1,j])
            pt3 = Rhino.Geometry.Point3d(X[i+1,j+1], Y[i+1,j+1], heights[i+1,j+1])
            pt4 = Rhino.Geometry.Point3d(X[i,j+1], Y[i,j+1], heights[i,j+1])
            surface = Rhino.Geometry.NurbsSurface.CreateFromCorners(pt1, pt2, pt3, pt4)
            if surface:  # Only add the surface if it was created successfully
                surfaces.append(surface)
            
    return surfaces

# Incorporate the previous box visualization
def visualize_exponent_laws(a, m, n, b):
    boxes = []
    for i in range(5):
        # Some arbitrary values for the box's position and size to demonstrate the laws of exponents.
        pt = Rhino.Geometry.Point3d(i*5, i*5, 0)
        box_size = a**m * b**n
        bounding_box = Rhino.Geometry.BoundingBox(pt, Rhino.Geometry.Point3d(pt.X + box_size, pt.Y + box_size, pt.Z + box_size))
        boxes.append(Rhino.Geometry.Box(bounding_box))
    return boxes

# Parameters
#a, m, b, n = 1, 2, 1, 3
x_range = (-5, 5)
y_range = (-5, 5)
#steps = 50

# Compute the geometries
trigonometric_surfaces = visualize_complex_trigonometric(a, m, b, n, x_range, y_range, steps)
exponent_boxes = visualize_exponent_laws(a, m, n, b)

# Combine and output
geometries = trigonometric_surfaces
box_out = exponent_boxes
output = geometries
# ---------- end laws_of_exponents_2 ----------
laws_of_exponents_3 = Script(a=number_slider_6, m=number_slider_3, b=number_slider_4, n=number_slider_5)  # -> out, a; inputs a: Int32, m: Int32, b: Int32, n: Int32; disabled
# ---------- laws_of_exponents_3: Python ----------
import Rhino
import math

def visualize_exponent_laws(a, m, n, b):
    """Visualize the laws of exponents using boxes."""
    # Initialize empty lists to store our boxes (geometries)
    boxes = []
    
    # 1. a^m * a^n = a^{m+n}
    box1 = Rhino.Geometry.Box(Rhino.Geometry.Plane.WorldXY, Rhino.Geometry.Interval(0, a), Rhino.Geometry.Interval(0, m), Rhino.Geometry.Interval(0, 1)).ToBrep()
    box2 = Rhino.Geometry.Box(Rhino.Geometry.Plane.WorldXY, Rhino.Geometry.Interval(0, a), Rhino.Geometry.Interval(0, n), Rhino.Geometry.Interval(1, 2)).ToBrep()
    box3 = Rhino.Geometry.Box(Rhino.Geometry.Plane.WorldXY, Rhino.Geometry.Interval(0, a), Rhino.Geometry.Interval(0, m+n), Rhino.Geometry.Interval(2, 3)).ToBrep()
    boxes.extend([box1, box2, box3])

    # 2. a^m / a^n = a^{m-n}
    box4 = Rhino.Geometry.Box(Rhino.Geometry.Plane.WorldXY, Rhino.Geometry.Interval(3, 4), Rhino.Geometry.Interval(0, m), Rhino.Geometry.Interval(0, 1)).ToBrep()
    box5 = Rhino.Geometry.Box(Rhino.Geometry.Plane.WorldXY, Rhino.Geometry.Interval(3, 4), Rhino.Geometry.Interval(0, m-n), Rhino.Geometry.Interval(1, 2)).ToBrep()
    boxes.extend([box4, box5])
    
    # 3. a^m * b^m = (a * b)^m
    box6 = Rhino.Geometry.Box(Rhino.Geometry.Plane.WorldXY, Rhino.Geometry.Interval(6, 7), Rhino.Geometry.Interval(0, a), Rhino.Geometry.Interval(0, m)).ToBrep()
    box7 = Rhino.Geometry.Box(Rhino.Geometry.Plane.WorldXY, Rhino.Geometry.Interval(7, 8), Rhino.Geometry.Interval(0, b), Rhino.Geometry.Interval(0, m)).ToBrep()
    box8 = Rhino.Geometry.Box(Rhino.Geometry.Plane.WorldXY, Rhino.Geometry.Interval(9, 10), Rhino.Geometry.Interval(0, a*b), Rhino.Geometry.Interval(0, m)).ToBrep()
    boxes.extend([box6, box7, box8])
    
    return boxes

# Example values
"""
a = 1
m = 3
n = 2
b = 2
"""

# Generate the geometries
geometries = visualize_exponent_laws(a, m, n, b)

# The output variable
a = geometries
# ---------- end laws_of_exponents_3 ----------
# gpt-4 Initial Response
# Creating a geometric 3D model using the laws
# of exponents can involve a lot of creativity. Here,
# I'll provide a simple script that uses the
# exponential and logarithmic functions to
# generate a unique 3D model using the Rhino
# Common API in the Grasshopper environment.
# The model will take the form of a surface
# defined by the exponential function.
# 
# For simplicity, let's consider the laws of
# exponents:
panel_4 = Panel(entwine)  # disabled
geometry_3 = Geometry(laws_of_exponents_3.a)  # disabled
geometry_4 = Geometry(laws_of_exponents_2.geometries)
geometry_5 = Geometry(laws_of_exponents_2.box_out)
panel_5 = Panel(laws_of_exponents_2.out)
panel_6 = Panel(laws_of_exponents_3.out)  # disabled
entwine_2 = Entwine(Branch00=geometry_4, Branch01=geometry_5, FlattenInputs=True)
entwine_3 = Entwine(Branch00=geometry_3, FlattenInputs=True)  # disabled
panel_7 = Panel(entwine_2)
panel_8 = Panel(entwine_3)  # disabled
